# Grasshopper definition PavilionOne.gh (Grasshopper 0.9.76)
# plug-ins: Karamba, MeshEdit Components, Kangaroo Components, PTComponentLibrary, Weaverbird, Kangaroo2 Components

# ---- group: XTranslationControlWatchOutItShouldMatchTheTranslationsThatAreBelowCheckByViewingTheRedWatchOutGroupToTheRight
number_slider = Slider(11, range=0..30)

# ---- group: GridFourOurValleysAndMountains
planar_grid = PlanarGrid(
    BasePoint=Point(0, 0, 0),
    IDir=Vector(1, 0, 0),
    JDir=Vector(0, 1, 0),
    IDistance=Slider(3.491, range=0..10),
    JDistance=Slider(2.04, range=0..10),
    INumber=6,
    JNumber=number_slider)  # -> simplify(Grid)

# ---- group: SetUpOurMeshAndTheTranslations
number_slider_2 = Slider(0, range=0..7)
number_slider_3 = Slider(5, range=0..7)
pickarowwithoutloosingbranch = CSharpScript(tree=planar_grid, branch=number_slider_2)  # -> selected; inputs tree: tree of Point3d, branch: Int32
# ---------- pickarowwithoutloosingbranch: C# ----------
    var treeOut = new DataTree<Point3d>();
    
    var size = tree.BranchCount;
    
    for( int i = branch; i < branch + 1; ++i )
      for( int j = 0; j < tree.Branch(i).Count; ++j )
      {
      
        treeOut.Add( tree.Branch(i)[j], new GH_Path( i ) );
      
      }
    
    selected = treeOut;
# ---------- end pickarowwithoutloosingbranch ----------
pickarowwithoutloosingbranch_2 = CSharpScript(tree=planar_grid, branch=number_slider_3)  # -> selected; inputs tree: tree of Point3d, branch: Int32; same code as pickarowwithoutloosingbranch
unit_y = UnitY(Factor=Slider(0, range=-10..10))
move = Move(Geometry=pickarowwithoutloosingbranch, Motion=expr("-x", unit_y))  # -> Geometry, Transform
pickarowwithoutloosingbranch_3 = CSharpScript(tree=planar_grid, branch=Slider(4, range=0..7))  # -> selected; inputs tree: tree of Point3d, branch: Int32; same code as pickarowwithoutloosingbranch
pickarowwithoutloosingbranch_4 = CSharpScript(tree=planar_grid, branch=Slider(3, range=0..7))  # -> selected; inputs tree: tree of Point3d, branch: Int32; same code as pickarowwithoutloosingbranch
pickarowwithoutloosingbranch_5 = CSharpScript(tree=planar_grid, branch=Slider(2, range=0..7))  # -> selected; inputs tree: tree of Point3d, branch: Int32; same code as pickarowwithoutloosingbranch
unit_y_2 = UnitY(Factor=Slider(0, range=-10..10))
pickarowwithoutloosingbranch_6 = CSharpScript(tree=planar_grid, branch=Slider(1, range=0..7))  # -> selected; inputs tree: tree of Point3d, branch: Int32; same code as pickarowwithoutloosingbranch
number_slider_4 = Slider(22, range=0..100)
number_slider_5 = Slider(21, range=0..100)
number_slider_6 = Slider(5, range=0..10)
number_slider_7 = Slider(7, range=0..10)
number_slider_8 = Slider(24, range=0..100)
number_slider_9 = Slider(2, range=0..10)
number_slider_10 = Slider(7, range=0..10)
number_slider_11 = Slider(6, range=0..100)
number_slider_12 = Slider(4, range=0..10)
number_slider_13 = Slider(2, range=0..10)
number_slider_14 = Slider(3, range=0..50)
number_slider_15 = Slider(32, range=0..100)
number_slider_16 = Slider(28, range=0..100)
move_2 = Move(Geometry=pickarowwithoutloosingbranch_2, Motion=unit_y_2)  # -> Geometry, Transform
number_slider_17 = Slider(21, range=0..100)
number_slider_18 = Slider(0, range=-1..1)
unit_y_3 = UnitY(Factor=Slider(0, range=-2..2))
unit_y_4 = UnitY(Factor=[Slider(0, range=-4..1), Slider(0, range=-4..2), Slider(0, range=-4..4)])
list_item = ListItem(List=move_2.Geometry, Index=number_slider_4, Wrap=True)
unit_y_5 = UnitY(Factor=Slider(0, range=-2..2))
unit_y_6 = UnitY(Factor=[Slider(0, range=0..2), Slider(0, range=-5..5.001), Slider(0, range=0..1)])
list_item_2 = ListItem(List=pickarowwithoutloosingbranch_3, Index=[number_slider_5, number_slider_6, number_slider_7], Wrap=True)
list_item_3 = ListItem(List=pickarowwithoutloosingbranch_4, Index=number_slider_9, Wrap=True)
cull_index = CullIndex(List=move_2.Geometry, Indices=number_slider_4, Wrap=True)
list_item_4 = ListItem(List=pickarowwithoutloosingbranch_5, Index=[number_slider_11, number_slider_12, number_slider_13], Wrap=True)
cull_index_2 = CullIndex(List=pickarowwithoutloosingbranch_3, Indices=[number_slider_5, number_slider_6, number_slider_7], Wrap=True)
unit_y_7 = UnitY(Factor=[Slider(0, range=-1..3), Slider(0, range=-2..3), Slider(0, range=-4..4)])
cull_index_3 = CullIndex(List=pickarowwithoutloosingbranch_4, Indices=number_slider_9, Wrap=True)
cull_index_4 = CullIndex(List=pickarowwithoutloosingbranch_5, Indices=[number_slider_11, number_slider_12, number_slider_13], Wrap=True)
list_item_5 = ListItem(List=pickarowwithoutloosingbranch_6, Index=[number_slider_15, number_slider_14, number_slider_16], Wrap=True)
unit_y_8 = UnitY(Factor=Slider(0, range=-2..2))
cull_index_5 = CullIndex(List=pickarowwithoutloosingbranch_6, Indices=[number_slider_15, number_slider_14, number_slider_16], Wrap=True)
list_item_6 = ListItem(List=move.Geometry, Index=number_slider_17, Wrap=True)
cull_index_6 = CullIndex(List=move.Geometry, Indices=number_slider_17, Wrap=True)
move_3 = Move(Geometry=list_item, Motion=expr("-x", unit_y_3))  # -> Geometry, Transform
move_4 = Move(Geometry=list_item_2, Motion=expr("-x", unit_y_4))  # -> Geometry, Transform
move_5 = Move(Geometry=list_item_3, Motion=expr("-x", unit_y_5))  # -> Geometry, Transform
path_mapper = PathMapper(cull_index, source="{A;B}", target="{A}")
move_6 = Move(Geometry=list_item_4, Motion=unit_y_6)  # -> Geometry, Transform
path_mapper_2 = PathMapper(cull_index_2, source="{A;B}", target="{A}")
move_7 = Move(Geometry=list_item_5, Motion=expr("-x", unit_y_7))  # -> Geometry, Transform
path_mapper_3 = PathMapper(cull_index_3, source="{A;B}", target="{A}")
path_mapper_4 = PathMapper(cull_index_4, source="{A;B}", target="{A}")
move_8 = Move(Geometry=list_item_6, Motion=expr("-x", unit_y_8))  # -> Geometry, Transform
path_mapper_5 = PathMapper(cull_index_5, source="{A;B}", target="{A}")
path_mapper_6 = PathMapper(cull_index_6, source="{A;B}", target="{A}")
point = Point([path_mapper, move_3.Geometry])
point_2 = Point([path_mapper_2, move_4.Geometry])
point_3 = Point([path_mapper_3, move_5.Geometry])
point_4 = Point([path_mapper_4, move_6.Geometry])
point_5 = Point([path_mapper_5, move_7.Geometry])
point_6 = Point([path_mapper_6, move_8.Geometry])
sort_points = SortPoints(Points=point)  # -> Points, Indices
sort_points_2 = SortPoints(Points=point_2)  # -> Points, Indices
sort_points_3 = SortPoints(Points=point_3)  # -> Points, Indices
sort_points_4 = SortPoints(Points=point_4)  # -> Points, Indices
sort_points_5 = SortPoints(Points=point_5)  # -> Points, Indices
sort_points_6 = SortPoints(Points=point_6)  # -> Points, Indices
point_list = PointList(Points=sort_points_2.Points)
point_list_2 = PointList(Points=sort_points_3.Points)
merge = Merge(
    Data1=sort_points_6.Points,
    Data2=sort_points_5.Points,
    Data3=sort_points_4.Points,
    Data4=sort_points_3.Points,
    Data5=sort_points_2.Points,
    Data6=sort_points.Points)

# ----
pickarowwithoutloosingbranch_7 = CSharpScript(tree=planar_grid, branchStart=number_slider_2, branchEnd=number_slider_3, randomOrNot=Toggle(False))  # -> selected; inputs tree: tree of Point3d, branchStart: Int32, branchEnd: Int32, randomOrNot: Boolean
# ---------- pickarowwithoutloosingbranch_7: C# ----------
    var treeOut = new DataTree<Point3d>();

    var size = tree.BranchCount;

    for( int i = branchStart + 1; i < branchEnd; ++i )
      for( int j = 0; j < tree.Branch(i).Count; ++j )
      {

        if( randomOrNot == false )
        {

          if( i != 2 && i != 3 )


            treeOut.Add(tree.Branch(i)[j], new GH_Path(i));

        }

        else
        {

          //if( i != 2 && i != 3 && i != 4 && i != 5 )


          treeOut.Add(tree.Branch(i)[j], new GH_Path(i));

        }

      }

    selected = treeOut;
# ---------- end pickarowwithoutloosingbranch_7 ----------
list_length = ListLength(List=sort_points_6.Points)
list_length_2 = ListLength(List=sort_points.Points)
list_item_7 = ListItem(List=sort_points_6.Points, Index=expr("x-1", list_length), Wrap=True)
list_item_8 = ListItem(List=sort_points_6.Points, Index=0, Wrap=True)
list_item_9 = ListItem(List=sort_points.Points, Index=expr("x-1", list_length_2), Wrap=True)
list_item_10 = ListItem(List=sort_points.Points, Index=0, Wrap=True)
line = Line(StartPoint=list_item_8, EndPoint=list_item_10)
line_2 = Line(StartPoint=list_item_7, EndPoint=list_item_9)
divide_curve = DivideCurve(Curve=line, Count=2, Kinks=False)  # -> Points, Tangents, Parameters
divide_curve_2 = DivideCurve(Curve=line_2, Count=2, Kinks=False)  # -> Points, Tangents, Parameters
list_item_11 = ListItem(List=divide_curve_2.Points, Index=1, Wrap=True)
list_item_12 = ListItem(List=divide_curve.Points, Index=1, Wrap=True)
line_3 = Line(StartPoint=list_item_12, EndPoint=list_item_11)
divide_curve_3 = DivideCurve(Curve=line_3, Count=Slider(6, range=0..10), Kinks=False)  # -> Points, Tangents, Parameters
list_item_13 = ListItem(List=divide_curve_3.Points, Index=3, Wrap=True)
scale_nu = ScaleNU(Geometry=divide_curve_3.Points, Plane=list_item_13, ScaleX=Slider(2, range=0..10), ScaleY=1, ScaleZ=1)  # -> Geometry, Transform
curve = Curve(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)
control_points = ControlPoints(Curve=curve)  # -> Points, Weights, Knots
list_item_14 = ListItem(List=scale_nu.Geometry, Index=0, Wrap=True)  # -> Item, Item1, Item2, Item3, Item4, Item5, Item6
deconstruct = Deconstruct(Point=Point(20.99070808, 3.596462343, 0))  # -> XComponent, YComponent, ZComponent
deconstruct_2 = Deconstruct(Point=Point(14.96881523, 20.18988705, 0))  # -> XComponent, YComponent, ZComponent
deconstruct_3 = Deconstruct(Point=Point(19.78657612, 9.676018932, 0))  # -> XComponent, YComponent, ZComponent
deconstruct_4 = Deconstruct(Point=Point(4.690061528, 8.392349977, 0))  # -> XComponent, YComponent, ZComponent
deconstruct_5 = Deconstruct(Point=Point(4.994841381, -2.612679017, 0))  # -> XComponent, YComponent, ZComponent
number_slider_19 = Slider(-9.6979, range=-10..10)
number_slider_20 = Slider(7.4013, range=-10..10)
number_slider_21 = Slider(0.5134, range=-10..10)
number_slider_22 = Slider(9.4329, range=-10..10)
number_slider_23 = Slider(9.034, range=-10..10)
number_slider_24 = Slider(-5.9768, range=-10..10)
number_slider_25 = Slider(0.6631, range=-10..10)
number_slider_26 = Slider(-6.6, range=-10..10)
addition = Addition(A=deconstruct.XComponent, B=number_slider_26)
number_slider_27 = Slider(6.6, range=-10..10)
addition_2 = Addition(A=deconstruct.YComponent, B=number_slider_27)
number_slider_28 = Slider(4.5, range=-10..10)
addition_3 = Addition(A=deconstruct_2.XComponent, B=number_slider_28)
number_slider_29 = Slider(-2.9, range=-10..10)
addition_4 = Addition(A=deconstruct_2.YComponent, B=number_slider_29)
number_slider_30 = Slider(-4.4, range=-10..10)
addition_5 = Addition(A=deconstruct_3.XComponent, B=number_slider_30)
number_slider_31 = Slider(-7.8, range=-10..10)
addition_6 = Addition(A=deconstruct_3.YComponent, B=number_slider_31)
number_slider_32 = Slider(-0.8, range=-10..10)
addition_7 = Addition(A=deconstruct_4.XComponent, B=number_slider_32)
number_slider_33 = Slider(4.8, range=-10..10)
addition_8 = Addition(A=deconstruct_4.YComponent, B=number_slider_33)
number_slider_34 = Slider(-2.4, range=-10..10)
addition_9 = Addition(A=deconstruct_5.XComponent, B=number_slider_34)
number_slider_35 = Slider(3.9, range=-10..10)
addition_10 = Addition(A=deconstruct_5.YComponent, B=number_slider_35)
number_slider_36 = Slider(19, range=0..1000)  # disabled
construct_point = ConstructPoint(XCoordinate=addition, YCoordinate=addition_2, ZCoordinate=deconstruct.ZComponent)
curve_2 = Curve(<curve referenced from the Rhino model>)  # disabled
construct_point_2 = ConstructPoint(XCoordinate=addition_3, YCoordinate=addition_4, ZCoordinate=deconstruct_2.ZComponent)
unit_x = UnitX(Factor=number_slider_19)
construct_point_3 = ConstructPoint(XCoordinate=addition_5, YCoordinate=addition_6, ZCoordinate=deconstruct_3.ZComponent)
construct_point_4 = ConstructPoint(XCoordinate=addition_7, YCoordinate=addition_8, ZCoordinate=deconstruct_4.ZComponent)
construct_point_5 = ConstructPoint(XCoordinate=addition_9, YCoordinate=addition_10, ZCoordinate=deconstruct_5.ZComponent)
unit_x_2 = UnitX(Factor=number_slider_20)
unit_x_3 = UnitX(Factor=number_slider_21)
unit_x_4 = UnitX(Factor=number_slider_22)
unit_x_5 = UnitX(Factor=number_slider_25)
unit_x_6 = UnitX(Factor=number_slider_24)
unit_x_7 = UnitX(Factor=number_slider_23)
divide_curve_4 = DivideCurve(Curve=curve_2, Count=number_slider_36, Kinks=False)  # -> Points, Tangents, Parameters; disabled
move_9 = Move(Geometry=list_item_14.Item6, Motion=unit_x_2)  # -> Geometry, Transform
move_10 = Move(Geometry=list_item_14.Item5, Motion=unit_x_3)  # -> Geometry, Transform
move_11 = Move(Geometry=list_item_14.Item5, Motion=unit_x)  # -> Geometry, Transform
move_12 = Move(Geometry=list_item_14.Item1, Motion=unit_x_4)  # -> Geometry, Transform
move_13 = Move(Geometry=list_item_14.Item3, Motion=unit_x_5)  # -> Geometry, Transform
move_14 = Move(Geometry=list_item_14.Item, Motion=unit_x_6)  # -> Geometry, Transform
move_15 = Move(Geometry=list_item_14.Item2, Motion=unit_x_7)  # -> Geometry, Transform
number_slider_37 = Slider(0.8397, range=-10..10)
number_slider_38 = Slider(-2.0797, range=-10..10)
number_slider_39 = Slider(8.3492, range=-10..10)
number_slider_40 = Slider(5.392, range=0..10)  # disabled
number_slider_41 = Slider(8.8667, range=-10..10)
number_slider_42 = Slider(-1.3237, range=-10..10)
number_slider_43 = Slider(0.5751, range=-10..10)
number_slider_44 = Slider(-7.8879, range=-10..10)
number_slider_45 = Slider(0.8141, range=0..3)
number_slider_46 = Slider(2.6225, range=0..3)
number_slider_47 = Slider(1.5619, range=0..3)
number_slider_48 = Slider(1.9675, range=0..3)
number_slider_49 = Slider(2.0746, range=0..3)
polyline = PolyLine(Vertices=divide_curve_4.Points, Closed=False)  # disabled
point_7 = Point(<point referenced from the Rhino model>)
point_8 = Point(<point referenced from the Rhino model>)
point_9 = Point(<point referenced from the Rhino model>)
point_10 = Point(<point referenced from the Rhino model>)
point_11 = Point(<point referenced from the Rhino model>)
discontinuity = Discontinuity(Curve=polyline, Level=2)  # -> Points, Parameters; disabled
unit_y_9 = UnitY(Factor=number_slider_38)
unit_y_10 = UnitY(Factor=number_slider_39)
unit_y_11 = UnitY(Factor=number_slider_37)
unit_y_12 = UnitY(Factor=number_slider_43)
unit_y_13 = UnitY(Factor=number_slider_41)
unit_y_14 = UnitY(Factor=number_slider_42)
unit_y_15 = UnitY(Factor=number_slider_44)
point_charge = PointCharge(Point=construct_point_2, Charge=number_slider_45, Decay=Slider(0, range=0..10))
point_charge_2 = PointCharge(Point=construct_point, Charge=number_slider_46, Decay=Slider(0, range=0..10))
point_charge_3 = PointCharge(Point=construct_point_3, Charge=number_slider_47, Decay=Slider(0, range=0..10))
point_charge_4 = PointCharge(Point=construct_point_5, Charge=number_slider_48, Decay=Slider(0, range=0..10))
point_charge_5 = PointCharge(Point=construct_point_4, Charge=number_slider_49, Decay=Slider(0, range=0..10))
move_16 = Move(Geometry=move_9.Geometry, Motion=unit_y_9)  # -> Geometry, Transform
move_17 = Move(Geometry=move_10.Geometry, Motion=unit_y_10)  # -> Geometry, Transform
move_18 = Move(Geometry=move_11.Geometry, Motion=unit_y_11)  # -> Geometry, Transform
shatter = Shatter(Curve=polyline, Parameters=discontinuity.Parameters)  # disabled
line_charge = LineCharge(Line=shatter, Charge=number_slider_40)  # disabled
merge_fields = MergeFields(Fields=line_charge)  # disabled
move_19 = Move(Geometry=move_12.Geometry, Motion=unit_y_12)  # -> Geometry, Transform
move_20 = Move(Geometry=move_13.Geometry, Motion=unit_y_13)  # -> Geometry, Transform
move_21 = Move(Geometry=move_14.Geometry, Motion=unit_y_14)  # -> Geometry, Transform
move_22 = Move(Geometry=move_15.Geometry, Motion=unit_y_15)  # -> Geometry, Transform
merge_fields_2 = MergeFields(Fields=flatten([point_charge_5, point_charge, point_charge_3, point_charge_4, point_charge_2]))
point_12 = Point([move_21.Geometry, move_19.Geometry, move_22.Geometry, move_20.Geometry, move_17.Geometry, move_18.Geometry, move_16.Geometry])
nurbs_curve = NurbsCurve(Vertices=point_12, Degree=3, Periodic=False)  # -> Curve, Length, Domain

# ---- group: Attractors
number_slider_50 = Slider(2, range=0..10)
attractorcurve = CSharpScript(numberOfPoints=Slider(7, range=0..100), disI=Slider(8.8064, range=0..10))  # -> point; inputs numberOfPoints: Int32, disI: Double, fre: Double
# ---------- attractorcurve: C# ----------
    var points = new List<Point3d>();

    for( int i = -numberOfPoints / 2; i < numberOfPoints / 2; ++i )
    {

      points.Add(new Point3d(i * disI, 0, 0));

    }

    point = points;
# ---------- end attractorcurve ----------
point_13 = Point(merge)
nurbs_curve_2 = NurbsCurve(Vertices=attractorcurve, Degree=3, Periodic=False)  # -> Curve, Length, Domain
list_length_3 = ListLength(List=sort_points.Points)
number_slider_51 = Slider(0.252, range=0..1)
point_14 = Point(Point(42.54006911, -14.3092749, 0))
point_15 = Point(<point referenced from the Rhino model>)
end_points = EndPoints(Curve=nurbs_curve_2.Curve)  # -> Start, End
list_item_15 = ListItem(List=sort_points.Points, Index=expr("x-1", list_length_3), Wrap=True)
list_item_16 = ListItem(List=sort_points_6.Points, Index=0, Wrap=True)
spin_force = SpinForce(
    Plane=point_14,
    Strength=expr("-x", Slider(10, range=0..10)),
    Radius=Slider(10, range=0..10),
    Decay=Slider(1.216, range=0..10))
spin_force_2 = SpinForce(
    Plane=point_15,
    Strength=expr("-x", Slider(1.9897, range=0..100)),
    Radius=Slider(10, range=0..10),
    Decay=Slider(0, range=0..10))
vector_2pt = Vector2Pt(PointA=end_points.Start, PointB=end_points.End, Unitize=False)  # -> Vector, Length
vector_2pt_2 = Vector2Pt(PointA=list_item_16, PointB=list_item_15, Unitize=False)  # -> Vector, Length
merge_fields_3 = MergeFields(Fields=flatten(spin_force_2))
angle = Angle(VectorA=vector_2pt.Vector, VectorB=vector_2pt_2.Vector)  # -> Angle, Reflex
evaluate_field = EvaluateField(Field=merge_fields_3, Point=point_13)  # -> Tensor, Strength
point_16 = Point([<point referenced from the Rhino model> x2])
random_attraction = RandomAttraction(Grid=point_13, Magnitude=Slider(0, range=0..1))  # -> simplify(Grid), Weights
curve_attraction = CurveAttraction(Grid=point_13, CrvAtts=nurbs_curve.Curve, Magnitude=number_slider_51)  # -> simplify(Grid), Weights
point_attraction = PointAttraction(Grid=point_13, PtAtts=point_16, Magnitude=Slider(1, range=0..1))  # -> simplify(Grid), Weights
rotate = Rotate(Geometry=nurbs_curve_2.Curve, Angle=expr("-x", angle.Angle), Plane=PlaneXY(0, 0, 0))  # -> Geometry, Transform
move_23 = Move(Geometry=point_13, Motion=evaluate_field.Tensor)  # -> Geometry, Transform
point_17 = Point(point_13)

# ----
evaluate_field_2 = EvaluateField(Field=line_charge, Point=point_13)  # -> Tensor, Strength; disabled
curve_3 = Curve(rotate.Geometry)
move_24 = Move(Geometry=point_13, Motion=evaluate_field_2.Tensor)  # -> simplify(Geometry), Transform; disabled
evaluate_field_3 = EvaluateField(Field=merge_fields_2, Point=curve_attraction.Grid)  # -> Tensor, Strength
move_25 = Move(Geometry=curve_attraction.Grid, Motion=evaluate_field_3.Tensor)  # -> simplify(Geometry), Transform
panel = Panel(nurbs_curve.Length)
expression = Expression(x=nurbs_curve.Length, y=Slider(50, range=0..100), Expression="If(x<y, -10000, 0)")

# ---- group: ParametricMagicThanksRelativeItem
boolean_toggle = BooleanToggle(False)
flip_matrix = FlipMatrix(Data=move_25.Geometry)
relative_item = RelativeItem(Tree=move_25.Geometry, Offset="{0}[+1]", WrapPaths=boolean_toggle, WrapItems=boolean_toggle)  # -> ItemA, ItemB
relative_item_2 = RelativeItem(Tree=flip_matrix, Offset="{0}[+1]", WrapPaths=boolean_toggle, WrapItems=boolean_toggle)  # -> ItemA, ItemB
relative_item_3 = RelativeItem(Tree=move_25.Geometry, Offset="{+1}[+1]", WrapPaths=boolean_toggle, WrapItems=boolean_toggle)  # -> ItemA, ItemB
relative_item_4 = RelativeItem(Tree=move_25.Geometry, Offset="{+1}[-1]", WrapPaths=boolean_toggle, WrapItems=boolean_toggle)  # -> ItemA, ItemB
line_4 = Line(StartPoint=relative_item.ItemA, EndPoint=relative_item.ItemB)
line_5 = Line(StartPoint=relative_item_4.ItemA, EndPoint=relative_item_4.ItemB)
line_6 = Line(StartPoint=relative_item_2.ItemA, EndPoint=relative_item_2.ItemB)
line_7 = Line(StartPoint=relative_item_3.ItemA, EndPoint=relative_item_3.ItemB)
boolean_toggle_2 = BooleanToggle(False)
relative_item_5 = RelativeItem(Tree=line_7, Offset="{+2}[0]", WrapPaths=boolean_toggle_2, WrapItems=boolean_toggle_2)  # -> ItemA, ItemB
relative_item_6 = RelativeItem(Tree=line_5, Offset="{+2}[0]", WrapPaths=boolean_toggle_2, WrapItems=boolean_toggle_2)  # -> ItemA, ItemB
relative_item_7 = RelativeItem(Tree=line_6, Offset="{+2}[0]", WrapPaths=boolean_toggle_2, WrapItems=boolean_toggle_2)  # -> ItemA, ItemB
relative_item_8 = RelativeItem(Tree=line_4, Offset="{+2}[0]", WrapPaths=boolean_toggle_2, WrapItems=boolean_toggle_2)  # -> ItemA, ItemB
boolean_toggle_3 = BooleanToggle(False)
line_8 = Line(relative_item_6.ItemB)
line_9 = Line(relative_item_6.ItemA)
line_10 = Line(relative_item_5.ItemB)
line_11 = Line(relative_item_5.ItemA)
line_12 = Line(relative_item_7.ItemB)
line_13 = Line(relative_item_7.ItemA)
line_14 = Line(relative_item_8.ItemB)
line_15 = Line(relative_item_8.ItemA)
relative_item_9 = RelativeItem(Tree=line_12, Offset="{+1}[0]", WrapPaths=boolean_toggle_3, WrapItems=boolean_toggle_3)  # -> ItemA, ItemB
relative_item_10 = RelativeItem(Tree=line_14, Offset="{+1}[0]", WrapPaths=boolean_toggle_3, WrapItems=boolean_toggle_3)  # -> ItemA, ItemB
relative_item_11 = RelativeItem(Tree=line_13, Offset="{+1}[0]", WrapPaths=boolean_toggle_3, WrapItems=boolean_toggle_3)  # -> ItemA, ItemB
relative_item_12 = RelativeItem(Tree=line_15, Offset="{+1}[0]", WrapPaths=boolean_toggle_3, WrapItems=boolean_toggle_3)  # -> ItemA, ItemB
relative_item_13 = RelativeItem(Tree=line_11, Offset="{+1}[0]", WrapPaths=boolean_toggle_3, WrapItems=boolean_toggle_3)  # -> ItemA, ItemB
relative_item_14 = RelativeItem(Tree=line_10, Offset="{+1}[0]", WrapPaths=boolean_toggle_3, WrapItems=boolean_toggle_3)  # -> ItemA, ItemB
relative_item_15 = RelativeItem(Tree=line_9, Offset="{+1}[0]", WrapPaths=boolean_toggle_3, WrapItems=boolean_toggle_3)  # -> ItemA, ItemB
relative_item_16 = RelativeItem(Tree=line_8, Offset="{+1}[0]", WrapPaths=boolean_toggle_3, WrapItems=boolean_toggle_3)  # -> ItemA, ItemB
line_16 = Line(relative_item_9.ItemB)
line_17 = Line(relative_item_10.ItemB)
line_18 = Line(relative_item_11.ItemA)
line_19 = Line(relative_item_12.ItemA)
line_20 = Line(relative_item_13.ItemB)
line_21 = Line(relative_item_14.ItemA)
line_22 = Line(relative_item_15.ItemB)
line_23 = Line(relative_item_16.ItemA)
flip_matrix_2 = FlipMatrix(Data=line_16)
flip_matrix_3 = FlipMatrix(Data=line_17)
flip_matrix_4 = FlipMatrix(Data=line_18)
flip_matrix_5 = FlipMatrix(Data=line_19)
cull_pattern = CullPattern(List=line_20, CullPattern=[False, True])
cull_pattern_2 = CullPattern(List=line_21, CullPattern=invert([False, True]))
cull_pattern_3 = CullPattern(List=line_22, CullPattern=invert([False, True]))
cull_pattern_4 = CullPattern(List=line_23, CullPattern=[False, True])
list_item_17 = ListItem(List=flip_matrix_3, Index=Slider(5, range=0..10), Wrap=True)
list_item_18 = ListItem(List=flip_matrix_4, Index=0, Wrap=True)
list_item_19 = ListItem(List=flip_matrix_5, Index=0, Wrap=True)
list_item_20 = ListItem(List=flip_matrix_2, Index=Slider(15, range=0..20), Wrap=True)
flip_matrix_6 = FlipMatrix(Data=cull_pattern)
flip_matrix_7 = FlipMatrix(Data=cull_pattern_2)
flip_matrix_8 = FlipMatrix(Data=cull_pattern_3)
flip_matrix_9 = FlipMatrix(Data=cull_pattern_4)

# ----
subtraction = Subtraction(A=number_slider, B=1)

# ---- group: Borders
number_slider_52 = Slider(18, range=0..100)
flip_matrix_10 = FlipMatrix(Data=move_25.Geometry)
flip_matrix_11 = FlipMatrix(Data=move_25.Geometry)
pickarowwithoutloosingbranch_8 = CSharpScript(tree=flip_matrix_10, branch=Slider(0, range=0..100))  # -> selected; inputs tree: tree of Point3d, branch: Int32; same code as pickarowwithoutloosingbranch
pickarowwithoutloosingbranch_9 = CSharpScript(tree=flip_matrix_11, branch=subtraction)  # -> selected; inputs tree: tree of Point3d, branch: Int32
# ---------- pickarowwithoutloosingbranch_9: C# ----------
    var treeOut = new DataTree<Point3d>();

    var size = tree.BranchCount;

    for( int i = branch; i < branch + 1; ++i )
      for( int j = 0; j < tree.Branch(i).Count; ++j )
      {

        treeOut.Add(tree.Branch(i)[j], new GH_Path(i));

      }

    selected = treeOut;
# ---------- end pickarowwithoutloosingbranch_9 ----------
cull_pattern_5 = CullPattern(List=pickarowwithoutloosingbranch_8, CullPattern=[True, False, True, True, False])
cull_pattern_6 = CullPattern(List=pickarowwithoutloosingbranch_9, CullPattern=[True, False, True, True, False])
join_curves = JoinCurves(Curves=flatten(list_item_18), Preserve=False)
join_curves_2 = JoinCurves(Curves=flatten(list_item_20), Preserve=False)
curve_closest_point = CurveClosestPoint(Point=cull_pattern_5, Curve=join_curves)  # -> Point, Parameter, Distance
curve_closest_point_2 = CurveClosestPoint(Point=cull_pattern_6, Curve=join_curves_2)  # -> Point, Parameter, Distance
shatter_2 = Shatter(Curve=join_curves, Parameters=curve_closest_point.Parameter)
shatter_3 = Shatter(Curve=join_curves_2, Parameters=curve_closest_point_2.Parameter)

# ----
centerlines = CSharpScript(lines=line_6)  # -> linesOut; inputs lines: tree of Line
# ---------- centerlines: C# ----------
    var lineTree = new DataTree<Line>();
    
    for( int i = 0; i < lines.BranchCount; ++i )
      for( int j = 1; j < lines.Branch(i).Count - 1; ++j )
      {
      
        if( i % 2 != 0 )
        lineTree.Add( lines.Branch(i)[j], new GH_Path(i) );
        
      }
    
    linesOut = lineTree;
# ---------- end centerlines ----------
leftintersectionrlines = CSharpScript(lines=line_6)  # -> linesOut; inputs lines: tree of Line
# ---------- leftintersectionrlines: C# ----------
    var lineTree = new DataTree<Line>();

    for( int i = 1; i < lines.BranchCount - 1; ++i )
      for( int j = 3; j < lines.Branch(i).Count; ++j )
      {

        if( i % 2 != 1 )
          lineTree.Add(lines.Branch(i)[j], new GH_Path(i));

      }

    linesOut = lineTree;
# ---------- end leftintersectionrlines ----------
rigthintersectionrlines = CSharpScript(lines=line_6)  # -> linesOut; inputs lines: tree of Line
# ---------- rigthintersectionrlines: C# ----------
    var lineTree = new DataTree<Line>();

    for( int i = 1; i < lines.BranchCount - 1; ++i )
      for( int j = 0; j < lines.Branch(i).Count - 3; ++j )
      {

        if( i % 2 != 1 )
          lineTree.Add(lines.Branch(i)[j], new GH_Path(i));

      }

    linesOut = lineTree;
# ---------- end rigthintersectionrlines ----------
leftintersectionrlines_2 = CSharpScript(lines=line_6)  # -> linesOut; inputs lines: tree of Line
# ---------- leftintersectionrlines_2: C# ----------
    var lineTree = new DataTree<Line>();

    for( int i = 0; i < lines.BranchCount; ++i )
      for( int j = 3; j < lines.Branch(i).Count; ++j )
      {

        if( i % 2 != 1 )
          lineTree.Add(lines.Branch(i)[j], new GH_Path(i));

      }

    linesOut = lineTree;
# ---------- end leftintersectionrlines_2 ----------
rigthintersectionrlines_2 = CSharpScript(lines=line_6)  # -> linesOut; inputs lines: tree of Line
# ---------- rigthintersectionrlines_2: C# ----------
    var lineTree = new DataTree<Line>();

    for( int i = 0; i < lines.BranchCount; ++i )
      for( int j = 0; j < lines.Branch(i).Count - 3; ++j )
      {

        if( i % 2 != 1 )
          lineTree.Add(lines.Branch(i)[j], new GH_Path(i));

      }

    linesOut = lineTree;
# ---------- end rigthintersectionrlines_2 ----------
join_curves_3 = JoinCurves(Curves=rigthintersectionrlines, Preserve=False)
join_curves_4 = JoinCurves(Curves=centerlines, Preserve=False)
join_curves_5 = JoinCurves(Curves=rigthintersectionrlines_2, Preserve=False)
join_curves_6 = JoinCurves(Curves=leftintersectionrlines, Preserve=False)
join_curves_7 = JoinCurves(Curves=leftintersectionrlines_2, Preserve=False)
end_points_2 = EndPoints(Curve=join_curves_3)  # -> Start, End
end_points_3 = EndPoints(Curve=join_curves_4)  # -> Start, End
end_points_4 = EndPoints(Curve=join_curves_5)  # -> Start, End
end_points_5 = EndPoints(Curve=join_curves_6)  # -> Start, End
end_points_6 = EndPoints(Curve=join_curves_7)  # -> Start, End
line_24 = Line(StartPoint=end_points_5.Start, EndPoint=end_points_5.End)  # -> simplify(Line)
line_25 = Line(StartPoint=end_points_2.Start, EndPoint=end_points_2.End)  # -> simplify(Line)
line_26 = Line(StartPoint=end_points_3.Start, EndPoint=end_points_3.End)  # -> simplify(Line)
line_27 = Line(StartPoint=end_points_6.Start, EndPoint=end_points_6.End)  # -> simplify(Line)
line_28 = Line(StartPoint=end_points_4.Start, EndPoint=end_points_4.End)  # -> simplify(Line)
topbottomlines = CSharpScript(lines=line_6)  # -> linesOut; inputs lines: tree of Line
# ---------- topbottomlines: C# ----------
    var lineTree = new DataTree<Line>();

    for( int i = 0; i < lines.BranchCount; ++i )
      for( int j = 2; j < lines.Branch(i).Count - 2; ++j )
      {

        if( i % 2 != 1 )
          lineTree.Add(lines.Branch(i)[j], new GH_Path(i));

      }

    linesOut = lineTree;
# ---------- end topbottomlines ----------
rightcenterlines = CSharpScript(lines=line_6)  # -> linesOut; inputs lines: tree of Line
# ---------- rightcenterlines: C# ----------
    var lineTree = new DataTree<Line>();

    for( int i = 0; i < lines.BranchCount; ++i )
      for( int j = 0; j < lines.Branch(i).Count - 4; ++j )
      {

        if( i % 2 != 0 )
          lineTree.Add(lines.Branch(i)[j], new GH_Path(i));

      }

    linesOut = lineTree;
# ---------- end rightcenterlines ----------
leftcenterlines = CSharpScript(lines=line_6)  # -> linesOut; inputs lines: tree of Line
# ---------- leftcenterlines: C# ----------
    var lineTree = new DataTree<Line>();

    for( int i = 0; i < lines.BranchCount; ++i )
      for( int j = 4; j < lines.Branch(i).Count; ++j )
      {

        if( i % 2 != 0 )
          lineTree.Add(lines.Branch(i)[j], new GH_Path(i));

      }

    linesOut = lineTree;
# ---------- end leftcenterlines ----------
list_item_21 = ListItem(List=flip_matrix_6, Index=0, Wrap=True)
list_item_22 = ListItem(List=flip_matrix_7, Index=1, Wrap=True)
list_item_23 = ListItem(List=flip_matrix_8, Index=0, Wrap=True)
list_item_24 = ListItem(List=flip_matrix_9, Index=1, Wrap=True)

topbottomlines_2 = CSharpScript(lines=line_6)  # -> linesOut; inputs lines: tree of Line; same code as topbottomlines
topbottomlines_3 = CSharpScript(lines=line_6)  # -> linesOut; inputs lines: tree of Line
# ---------- topbottomlines_3: C# ----------
    var lineTree = new DataTree<Line>();

    for( int i = 1; i < lines.BranchCount - 1; ++i )
      for( int j = 2; j < lines.Branch(i).Count - 2; ++j )
      {

        if( i % 2 != 1 )
          lineTree.Add(lines.Branch(i)[j], new GH_Path(i));

      }

    linesOut = lineTree;
# ---------- end topbottomlines_3 ----------
divide_curve_5 = DivideCurve(Curve=topbottomlines_2, Count=2, Kinks=False)  # -> Points, Tangents, Parameters
flip_matrix_12 = FlipMatrix(Data=line_27)
end_points_7 = EndPoints(Curve=line_27)  # -> Start, End
list_length_4 = ListLength(List=flip_matrix_12)  # -> expr("x-1", Length)
flip_matrix_13 = FlipMatrix(Data=line_28)
end_points_8 = EndPoints(Curve=line_28)  # -> Start, End
list_length_5 = ListLength(List=flip_matrix_13)  # -> expr("x-1", Length)
flip_matrix_14 = FlipMatrix(Data=topbottomlines)
list_length_6 = ListLength(List=flip_matrix_14)  # -> expr("x-1", Length)
list_item_25 = ListItem(List=flip_matrix_12, Index=0, Wrap=True)
list_item_26 = ListItem(List=flip_matrix_12, Index=list_length_4, Wrap=True)
list_item_27 = ListItem(List=divide_curve_5.Points, Index=1, Wrap=True)  # -> flatten(Item)
list_item_28 = ListItem(List=flip_matrix_13, Index=0, Wrap=True)
list_item_29 = ListItem(List=flip_matrix_13, Index=list_length_5, Wrap=True)
point_18 = Point(flatten([end_points_7.Start, end_points_7.End]))
point_19 = Point(flatten([end_points_8.Start, end_points_8.End]))
list_item_30 = ListItem(List=flip_matrix_14, Index=0, Wrap=True)
list_item_31 = ListItem(List=flip_matrix_14, Index=list_length_6, Wrap=True)
point_list_3 = PointList(Points=point_18)
point_list_4 = PointList(Points=point_19)
point_list_5 = PointList(Points=list_item_27)
distancetwopoints = CSharpScript(points=list_item_27)  # -> distance; inputs points: list of Point3d
# ---------- distancetwopoints: C# ----------
    var distances = new List<double>();
    var size = points.Count;

    for( int i = 0; i < size; ++i )
    {

      if( i != size - 1 )

        distances.Add(points[i].DistanceTo(points[i + 1]));

    }

    distance = distances;
# ---------- end distancetwopoints ----------
distancetwopoints_2 = CSharpScript(points=[end_points_7.Start, end_points_7.End])  # -> distance; inputs points: list of Point3d; same code as distancetwopoints
distancetwopoints_3 = CSharpScript(points=[end_points_8.Start, end_points_8.End])  # -> distance; inputs points: list of Point3d; same code as distancetwopoints
panel_2 = Panel(distancetwopoints)
panel_3 = Panel(distancetwopoints_3)
panel_4 = Panel(distancetwopoints_2)

# ---- group: MeshConstruction
curve_4 = Curve([list_item_21, list_item_22, list_item_23, list_item_24, leftcenterlines, rightcenterlines, topbottomlines, list_item_17, list_item_19])
curve_5 = Curve([line_26, line_27, line_28])
curve_6 = Curve([curve_5, curve_4])
weaverbird_s_mesh_from_lines_weave_back = WeaverbirdsMeshFromLinesWeaveBack(Lines=flatten(curve_6), MaximumValence=Slider(4, range=0..10))

# ----
fitness = CSharpScript(distances=distancetwopoints, min=Slider(1.03, range=0..5), max=Slider(2.64, range=0..5))  # -> penalty, list; inputs distances: list of Double, min: Double, max: Double
# ---------- fitness: C# ----------
    double penal = 0.0; var distancesList = new List<double>();

    for( int i = 0; i < distances.Count - 1; ++i )
    {

      var temp = distances[i] - distances[i + 1];
      temp = Math.Abs(temp);
      distancesList.Add(temp);

      if( temp >= min && temp <= max )
        penal -= 10000;

    }

    penalty = penal;
    list = distancesList;
# ---------- end fitness ----------
number = Number([distancetwopoints_2, distancetwopoints_3])
fitness_2 = CSharpScript(distances=number, min=Slider(3.49, range=0..20), max=Slider(9.21, range=0..20))  # -> penalty, list; inputs distances: list of Double, min: Double, max: Double; same code as fitness
panel_5 = Panel(fitness.penalty)
panel_6 = Panel(fitness.list)
panel_7 = Panel(fitness_2.list)
panel_8 = Panel(fitness_2.penalty)
deconstruct_mesh = DeconstructMesh(Mesh=weaverbird_s_mesh_from_lines_weave_back)  # -> Vertices, Faces, Colours, Normals
area = Area(Geometry=weaverbird_s_mesh_from_lines_weave_back)  # -> Area, Centroid
mass_addition = MassAddition(Input=flatten(fitness_2.penalty))  # -> Result, PartialResults
list_length_7 = ListLength(List=deconstruct_mesh.Faces)
panel_9 = Panel(list_length_7)
panel_10 = Panel(area.Area)
panel_11 = Panel(mass_addition.Result)
addition_11 = Addition(A=panel_5, B=panel_11)
galapagos = Galapagos(
    fitness=addition_14,
    gene=[number_slider_32, number_slider_33, number_slider_34, number_slider_35, number_slider_30, number_slider_31, number_slider_28, number_slider_29, number_slider_26, number_slider_27, number_slider_51, number_slider_49, number_slider_48, number_slider_47, number_slider_45, number_slider_46, number_slider_24, number_slider_42, number_slider_22, number_slider_43, number_slider_23, number_slider_44, number_slider_25, number_slider_41, number_slider_21, number_slider_39, number_slider_19, number_slider_37, number_slider_20, number_slider_38])
curve_7 = Curve([leftcenterlines, rightcenterlines, topbottomlines, list_item_24, list_item_23, list_item_22, list_item_21])
curve_8 = Curve([list_item_17, list_item_19])
curve_9 = Curve([list_item_30, list_item_31, list_item_25, list_item_26, list_item_28, list_item_29])
angle_2 = Panel("-pi")
angle_3 = Panel("pi")

# ---- group: SimulationReset
reset = Button()  # disabled
toggle = BooleanToggle(False)  # disabled

# ---- group: mesh of flat folding pattern
mesh = Mesh(weaverbird_s_mesh_from_lines_weave_back)  # disabled

# ----
folding = Slider(0.583, range=0..0.99)

# ---- group: KangarooOne
curve_10 = Curve([line_26, line_24, line_25])
curve_11 = Curve([curve_7, curve_8, curve_9])
valleys = Curve(flatten(curve_10))
mountains = Curve(flatten(curve_11))
origami = Origami(
    mesh=weaverbird_s_mesh_from_lines_weave_back,
    C=valleys,
    num_4=angle_2,
    C_2=mountains,
    num_2=angle_3,
    num=expr("-x", folding))  # -> data_2, R
timer = Timer(TimerInterval=20, Target=kangaroophysics)  # disabled
kangaroophysics = KangarooPhysics(ForceObjects=origami.data_2, Settings=null, Geometry=origami.R, SimulationReset=Toggle(True))  # -> Out, Iterations, ParticlesOut, GeometryOut, KE; disabled
mesh_2 = Mesh(kangaroophysics.GeometryOut)  # disabled

# ----
hingepoints = HingePoints(Mesh=mesh)  # -> _1, _2, _3, _4; disabled

# ---- group: maintain edge lengths
medges = MeshEdges(Mesh=mesh)  # -> NakedEdges, InteriorEdges, NonManifoldEdges; disabled
length_line = LengthLine(Line=[medges.NakedEdges, medges.InteriorEdges], Strength=1)  # disabled

# ---- group: a weak plastic anchor on all points prevents drift
demesh = DeconstructMesh(Mesh=mesh)  # -> Vertices, Faces, Colours, Normals; disabled
plasticanchor = PlasticAnchor(Point=demesh.Vertices, Limit=0.1, Strength=0.01)  # disabled

# ---- group: AnchorPointsAlthoughWeDontNeedThemNoMore
join_curves_8 = JoinCurves(Curves=line_27, Preserve=False)  # disabled
join_curves_9 = JoinCurves(Curves=line_28, Preserve=False)  # disabled
end_points_9 = EndPoints(Curve=join_curves_8)  # -> Start, End; disabled
end_points_10 = EndPoints(Curve=join_curves_9)  # -> Start, End; disabled
point_20 = Point(end_points_9.End)  # disabled
point_21 = Point(end_points_10.Start)  # disabled

# ----
zombiekangaroo = ZombieKangaroo(ForceObjects=origami.data_2, Settings=null, Geometry=origami.R, Threshold=0.1, MaxIters=2000)  # -> Out, Iterations, ParticlesOut, GeometryOut, KE
mesh_3 = Mesh(zombiekangaroo.GeometryOut)
mesh_edges = MeshEdges(Mesh=mesh_3)  # -> NakedEdges, InteriorEdges, NonManifoldEdges; disabled
mesh_explode = MeshExplode(Mesh=mesh_3, Interpolate=False)
face_normals = FaceNormals(Mesh=mesh_3)  # -> Centers, Normals; disabled
area_2 = Area(Geometry=mesh_explode)  # -> Area, Centroid
point_list_6 = PointList(Points=face_normals.Centers)  # disabled
vector_display = VectorDisplay(Anchor=face_normals.Centers, Vector=face_normals.Normals)  # disabled
list_item_32 = ListItem(List=zombiekangaroo.ParticlesOut, Index=Slider(23, range=0..100), Wrap=True)
list_item_33 = ListItem(List=zombiekangaroo.ParticlesOut, Index=Slider(4, range=0..100), Wrap=True)
list_item_34 = ListItem(List=zombiekangaroo.ParticlesOut, Index=Slider(2, range=0..100), Wrap=True)
deconstruct_mesh_2 = DeconstructMesh(Mesh=mesh_3)  # -> Vertices, Faces, Colours, Normals; disabled

# ---- group: MeasureSizeOfGrid
number_slider_53 = Slider(8, range=0..100)  # disabled
number_slider_54 = Slider(0, range=0..100)  # disabled
number_slider_55 = Slider(45, range=0..100)  # disabled
list_item_35 = ListItem(List=flatten(planar_grid), Index=number_slider_53, Wrap=True)  # disabled
list_item_36 = ListItem(List=flatten(planar_grid), Index=number_slider_55, Wrap=True)  # disabled
list_item_37 = ListItem(List=flatten(planar_grid), Index=number_slider_54, Wrap=True)  # disabled
distance = Distance(PointA=list_item_37, PointB=list_item_35)  # disabled
distance_2 = Distance(PointA=list_item_37, PointB=list_item_36)  # disabled
panel_12 = Panel(distance_2)  # disabled
panel_13 = Panel(distance)  # disabled

# ---- group: WeShouldntNeedThisOnes
load = Load(ForceVector=Vector(0, 0, 1))  # disabled
point_22 = Point([point_20, point_21])  # disabled
move_26 = Move(Geometry=graft(point_22), Motion=Vector(0, 0, 10))  # -> Geometry, Transform; disabled
anchor = Anchor(Point=flatten(move_26.Geometry), Strength=1000)  # disabled

# ----
expression_2 = Expression(x=area_2.Area, y=Slider(23.6, range=0..100), Expression="If(x<y, -10000, 0)")
construct_point_6 = ConstructPoint(XCoordinate=0, YCoordinate=0, ZCoordinate=0)
plane_3pt = Plane3Pt(PointA=list_item_34, PointB=list_item_33, PointC=list_item_32)
target = Target(Plane(origin=(18.62992375, -1.150245166, 0), x=(0.004986066788, 0.9999875695, 0), y=(0.9999875695, -0.004986066788, 0)))
point_list_7 = PointList(Points=deconstruct_mesh_2.Vertices)  # disabled
plane_origin = PlaneOrigin(Base=target, Origin=construct_point_6)
orient = Orient(Geometry=mesh_3, Source=plane_3pt, Target=plane_origin)  # -> Geometry, Transform
area_3 = Area(Geometry=mesh_3)  # -> Area, Centroid; disabled
panel_14 = Panel("S")  # disabled
mass_addition_2 = MassAddition(Input=expression_2)  # -> Result, PartialResults
addition_12 = Addition(A=addition_11, B=mass_addition_2.Result)
addition_13 = Addition(A=expression, B=addition_12)
addition_14 = Addition(A=addition_13, B=area.Area)
panel_15 = Panel(addition_14)

# ----
# 3
panel_16 = Panel("-1")  # disabled
Z = UnitZ(Factor=panel_16)  # disabled

number_slider_56 = Slider(0, range=0..10)  # disabled
number_slider_57 = Slider(10, range=0..10)  # disabled
mesh_edges_2 = MeshEdges(Mesh=orient.Geometry)  # -> NakedEdges, InteriorEdges, NonManifoldEdges; disabled
panel_17 = Panel(mass_addition_2.Result)
curve_12 = Curve(mesh_edges_2.NakedEdges)  # disabled
discontinuity_2 = Discontinuity(Curve=curve_12, Level=1)  # -> Points, Parameters; disabled
unit_y_16 = UnitY(Factor=1)  # disabled
negative = Negative(Value=number_slider_56)  # disabled
negative_2 = Negative(Value=number_slider_57)  # disabled
deconstruct_mesh_3 = DeconstructMesh(Mesh=orient.Geometry)  # -> Vertices, Faces, Colours, Normals; disabled
face_normals_2 = FaceNormals(Mesh=orient.Geometry)  # -> Centers, Normals; disabled
move_27 = Move(Geometry=face_normals_2.Centers, Motion=unit_y_16)  # -> Geometry, Transform; disabled
unit_z = UnitZ(Factor=negative)  # disabled
number_slider_58 = Slider(1.256, range=0..10)  # disabled
unit_z_2 = UnitZ(Factor=negative_2)  # disabled
mesh_explode_2 = MeshExplode(Mesh=orient.Geometry, Interpolate=False)
list_length_8 = ListLength(List=mesh_explode_2)
list_length_9 = ListLength(List=mesh_explode_2)
list_length_10 = ListLength(List=mesh_explode_2)
random = Random(Range=Domain(0, 1), Number=list_length_8, Seed=Slider(14000, range=0..100000))
random_2 = Random(Range=Domain(0, 1), Number=list_length_9, Seed=Slider(50000, range=0..100000))
random_3 = Random(Range=Domain(0, 1), Number=list_length_10, Seed=Slider(100000, range=0..100000))
loads_karamba = LoadsKaramba(Vector=unit_z, LCase=0, mode="Gravity")  # disabled
vector_2pt_3 = Vector2Pt(PointA=face_normals_2.Centers, PointB=move_27.Geometry, Unitize=True)  # -> Vector, Length; disabled
loads_karamba_2 = LoadsKaramba(Vector=unit_z_2, LCase=0, mode="Gravity")  # disabled
mesh_4 = Mesh(<mesh referenced from the Rhino model>)  # disabled
mesh_edges_3 = MeshEdges(Mesh=mesh_4)  # -> NakedEdges, InteriorEdges, NonManifoldEdges; disabled
deconstruct_mesh_4 = DeconstructMesh(Mesh=mesh_4)  # -> Vertices, Faces, Colours, Normals; disabled

# ---- group: GeometryShell / Shell
mesh_5 = Mesh(mesh_4)  # disabled

# ----
curve_13 = Curve(mesh_edges_3.NakedEdges)  # disabled

# ---- group: GeometryShell
# 1
# 2
meshtoshell = MeshToShellKaramba(Mesh=mesh_5, LDist=0.005, Identifier=panel_14)  # -> Point, Element, Info; disabled

# ----
mesh_to_shell_karamba = MeshToShellKaramba(Mesh=mesh_5, LimitDistance_m=0.005)  # -> Element, Points, Info; disabled
closest_point = ClosestPoint(Point=point_22, Cloud=deconstruct_mesh_4.Vertices)  # -> ClosestPoint, CPIndex, Distance; disabled
mesh_to_shell_karamba_2 = MeshToShellKaramba(Mesh=mesh_4, LimitDistance_m=0.005)  # -> Element, Points, Info; disabled
demesh_2 = DeconstructMesh(Mesh=mesh_5)  # -> Vertices, Faces, Colours, Normals; disabled
medges_2 = MeshEdges(Mesh=mesh_5)  # -> NakedEdges, InteriorEdges, NonManifoldEdges; disabled

# ---- group: Material
matselect = MaterialSelectionKaramba(ElementsIdentifiers=meshtoshell.Element, menu=[dropdown(1), dropdown(3)])  # disabled

# ---- group: CrossSection
cross_sections = CrossSectionsKaramba(ElementsIdentifiers=meshtoshell.Element, Heights_cm=1, mode="Shell")  # disabled

# ---- group: Load
loads = LoadsKaramba(Vector=Z, Mesh=mesh_5, LCase=0, mode="Mesh Load", menu=[buttons(off, on, off), buttons(on, on)])  # disabled

# ----
disc = Discontinuity(Curve=medges_2.NakedEdges, Level=1)  # -> Points, Parameters; disabled
deconstruct_6 = Deconstruct(Point=disc.Points)  # -> XComponent, YComponent, ZComponent; disabled
smaller_than = SmallerThan(FirstNumber=deconstruct_6.ZComponent, SecondNumber=number_slider_58)  # -> SmallerThan, OrEqualTo; disabled
cull_pattern_7 = CullPattern(List=disc.Points, CullPattern=invert(smaller_than.SmallerThan))  # disabled
vector_2pt_4 = Vector2Pt(PointA=cull_pattern_7, PointB=unit_z, Unitize=False)  # -> Vector, Length; disabled
pt = Point(disc.Points)  # disabled
colour_rgb_f = ColourRGBF(Alpha=1, Red=random_2, Green=random, Blue=random_3)  # -> graft(Colour)
reverse = Reverse(Vector=face_normals_2.Normals)  # disabled
move_28 = Move(Geometry=face_normals_2.Centers, Motion=reverse)  # -> Geometry, Transform; disabled
vector_display_2 = VectorDisplay(Anchor=face_normals_2.Centers, Vector=reverse)  # disabled
modifyelem = ModifyElementKaramba(mode="Shell")  # disabled
mesh_colours = MeshColours(Mesh=graft(mesh_explode_2), Colours=colour_rgb_f)
vector_display_3 = VectorDisplay(Anchor=face_normals_2.Centers, Vector=vector_2pt_3.Vector)  # disabled
cull_pattern_8 = CullPattern(List=disc.Points, CullPattern=smaller_than.SmallerThan)  # -> flatten(List); disabled
remove_duplicate_points_karamba = RemoveDuplicatePointsKaramba(Point=cull_pattern_8, LimitDistance=0.005)  # -> OutPoint, Info, Indexes; disabled
support_karamba = SupportKaramba(PosInd=remove_duplicate_points_karamba.OutPoint, menu=[buttons(on, on, on, on, off, off)])  # disabled
angle_4 = Angle(VectorA=vector_2pt_3.Vector, VectorB=reverse)  # -> Angle, Reflex; disabled
assemble_model_karamba = AssembleModelKaramba(
    Points=mesh_to_shell_karamba_2.Points,
    Elem=mesh_to_shell_karamba_2.Element,
    Support=support_karamba,
    Load=loads_karamba_2,
    LimitDistance_m=0.005)  # -> Model, Info, Mass_kg, CenterOfGravity; disabled
number_slider_59 = Slider(10, range=0..10)  # disabled
mesh_join = MeshJoin(Meshes=flatten(mesh_colours))

# ---- group: Support
supp = SupportKaramba(PosInd=cull_pattern_8, menu=[buttons(on, on, on, on, off, off)])  # disabled

# ---- group: AssembleModel
# 4
assemble = AssembleModelKaramba(
    Point=mesh_to_shell_karamba.Points,
    Elem=mesh_to_shell_karamba.Element,
    Support=supp,
    Load=loads_karamba,
    CrossSection=cross_sections,
    Material=matselect,
    LimitDistance_m=0.005)  # -> Model, Info, Mass_kg, CenterOfGravity; disabled

# ----
# 5
model_view_karamba = ModelViewKaramba(Model=assemble.Model, LoadCaseFactorsForLinearSuperposition=1, IndexOfVisibleLoadcase=-1)  # -> Model, DeformedMesh, DeformedAxes, DeformedModel; disabled
number_slider_60 = Slider(0.226, range=0..1)  # disabled
degrees = Degrees(Radians=angle_4.Angle)  # disabled
angular_dimension = AngularDimension(
    Center=face_normals_2.Centers,
    PointA=move_28.Geometry,
    PointB=move_27.Geometry,
    Reflex=False,
    Text="{0:0.0}°",
    Size=number_slider_60)  # disabled
mesh_to_shell_karamba_3 = MeshToShellKaramba(Mesh=mesh_4, LimitDistance_m=0.005)  # -> Element, Points, Info; disabled

image_file = Panel("C:\Users\Paula\Desktop\Felipe\textura.png")
save_texture = Button()
mesh_6 = Mesh(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)

weaverbird_s_constant_quads_split_subdiv = WeaverbirdsConstantQuadsSplitSubdivision(MeshCurves=mesh_colours, Level=Slider(3, range=0..10), SmoothNakedEdges=0)
negative_3 = Negative(Value=number_slider_59)  # disabled
shelllineresults = LineResultsOnShellsKaramba(Layer=0, SegmentLength_m=0.5, DA_deg=5, Theta_deg=0, mode="ForceFlow")  # -> AnalyzedModel, Lines; disabled
mass_addition_3 = MassAddition(Input=degrees)  # -> Result, PartialResults; disabled
analyzethi_karamba = AnalyzeThIKaramba(Model=assemble_model_karamba.Model)  # -> CalculatedModel, MaximumDisplacement_m, ResultingForceOfGravity_kN, ElasticEnergy_kNm; disabled
list_length_11 = ListLength(List=degrees)  # disabled
unit_z_3 = UnitZ(Factor=negative_3)  # disabled
weaverbird_s_loop_subdivision = WeaverbirdsLoopSubdivision(Level=1, SmoothNakedEdges=1)
weaverbird_s_constant_quads_split_subdiv_2 = WeaverbirdsConstantQuadsSplitSubdivision(MeshCurves=weaverbird_s_constant_quads_split_subdiv, Level=Slider(3, range=0..10), SmoothNakedEdges=0)
model_view_karamba_2 = ModelViewKaramba(Model=model_view_karamba.Model, LoadCaseFactorsForLinearSuperposition=1, IndexOfVisibleLoadcase=-1)  # -> Model, DeformedMesh, DeformedAxes, DeformedModel; disabled
dismload = DisassembleMeshLoadKaramba()  # -> PointLoad, ElementLoad; disabled
division = Division(A=mass_addition_3.Result, B=list_length_11)  # disabled
loads_karamba_3 = LoadsKaramba(Vector=unit_z_3, LCase=0, mode="Gravity")  # disabled
shell_view_karamba = ShellViewKaramba(Model=model_view_karamba_2.Model, IndexOfLayer=0)  # -> Model, MeshesOfRenderedShells, LegendColors, LegendTags; disabled
model_view_karamba_3 = ModelViewKaramba(Model=analyzethi_karamba.CalculatedModel, LoadCaseFactorsForLinearSuperposition=1, IndexOfVisibleLoadcase=-1)  # -> Model, DeformedMesh, DeformedAxes, DeformedModel; disabled
number_2 = Number(93.01814949)  # disabled
number_3 = Number(division)  # disabled
deconstruct_mesh_5 = DeconstructMesh(Mesh=mesh_join)  # -> Vertices, Faces, Colours, Normals
panel_18 = Panel(number_2)  # disabled
panel_19 = Panel(number_3)  # disabled

# ---- group: ViewModel
# 6
shellview = ShellViewKaramba()  # -> Model, MeshesOfRenderedShells, LegendColors, LegendTags; disabled
nodedisp = NodalDisplacementsKaramba()  # -> AnalyzedModel, NodalTranslations_m, NodalRotations_rad; disabled
vec = Vector(nodedisp.NodalRotations_rad)  # disabled
num = Number()  # disabled
vec_2 = Vector(nodedisp.NodalTranslations_m)  # disabled
mesh_7 = Mesh(shell_view_karamba.MeshesOfRenderedShells)  # disabled
vec_3 = Vector()  # disabled
num_2 = Number()  # disabled
num_3 = Number()  # disabled
num_4 = Number()  # disabled
vec_4 = Vector()  # disabled
num_5 = Number()  # disabled
pt_2 = Point()  # disabled
num_6 = Number()  # disabled
num_7 = Number()  # disabled

# ----
mesh_join_2 = MeshJoin(Meshes=flatten(weaverbird_s_constant_quads_split_subdiv_2))
vb = VBScript(m=mesh_join_2)  # -> out, A, B; inputs m: Mesh
# ---------- vb: VB ----------
    m.Unweld(0, False)

    Dim dt As New datatree(Of color)
    Dim c As Integer = m.Faces.Count

    For i As Integer = 0 To c - 1
      Dim f As meshface = m.Faces(i)
      dt.add(m.VertexColors(f.A), New gh_path(i))
      dt.add(m.VertexColors(f.B), New gh_path(i))
      dt.add(m.VertexColors(f.C), New gh_path(i))
      dt.add(m.VertexColors(f.D), New gh_path(i))
    Next


    m.TextureCoordinates.Clear
    For i As Integer = 1 To m.Vertices.Count
      m.TextureCoordinates.Add(0, 0)
    Next

    Dim size As Integer = Math.Ceiling(math.Sqrt(c))
    Dim count As Integer = -1

    Do
      For x As Integer = 0 To size - 1
        For y As Integer = 0 To size - 1
          count += 1
          If count > c - 1 Then Exit Do
          Dim f As meshface = m.Faces(count)

          Dim sb As Double = size * 2
          m.TextureCoordinates(f.A) = New point2f((x * 2 + 0.5) / sb, (y * 2 + 0.5) / sb)
          m.TextureCoordinates(f.B) = New point2f((x * 2 + 1.5) / sb, (y * 2 + 0.5) / sb)
          m.TextureCoordinates(f.C) = New point2f((x * 2 + 1.5) / sb, (y * 2 + 1.5) / sb)
          m.TextureCoordinates(f.D) = New point2f((x * 2 + 0.5) / sb, (y * 2 + 1.5) / sb)

        Next
      Next
    Loop


    a = m
    b = dt
# ---------- end vb ----------
argb = SplitARGB(Colour=vb.B)  # -> Alpha, Red, Green, Blue
frgb = ColourRGBF(Alpha=1, Red=argb.Red, Green=argb.Green, Blue=argb.Blue)
assemble_model_karamba_2 = AssembleModelKaramba(
    Points=mesh_to_shell_karamba_3.Points,
    Elem=mesh_to_shell_karamba_3.Element,
    Support=support_karamba,
    Load=loads_karamba_3,
    CrossSection=cross_sections,
    Material=matselect,
    LimitDistance_m=0.005)  # -> Model, Info, Mass_kg, CenterOfGravity; disabled
deconstruct_mesh_6 = DeconstructMesh(Mesh=mesh_join_2)  # -> Vertices, Faces, graft(Colours), Normals
vb_2 = VBScript(z=save_texture, col=vb.B, u=image_file)  # -> out, A; inputs col: tree of Color
# ---------- vb_2: VB ----------
    If Not z Then Return

    Dim size As Integer = Math.Ceiling(math.Sqrt(col.BranchCount))
    Dim sb As Double = size * 2 - 1
    Dim bm As New bitmap(size * 2, size * 2)
    Dim bmb As New bitmap(size * 4, size * 4)
    Dim count As Integer = -1

    Do
      For x As Integer = 0 To size - 1
        For y As Integer = 0 To size - 1
          count += 1
          If count > col.BranchCount - 1 Then Exit Do
          bm.SetPixel(x * 2 + 0, sb - (y * 2 + 0), col.Branch(count)(0))
          bm.SetPixel(x * 2 + 1, sb - (y * 2 + 0), col.Branch(count)(1))
          bm.SetPixel(x * 2 + 1, sb - (y * 2 + 1), col.Branch(count)(2))
          bm.SetPixel(x * 2 + 0, sb - (y * 2 + 1), col.Branch(count)(3))

        Next
      Next
    Loop

    Dim g As graphics = graphics.FromImage(bmb)
    g.InterpolationMode = System.Drawing.Drawing2D.InterpolationMode.NearestNeighbor
    g.DrawImage(bm, 0, 0, size * 4 + 1, size * 4 + 1)
    bmb.Save(u)
# ---------- end vb_2 ----------
shellvecresults = ResultVectorsOnShellsKaramba(AnalyzedModel=shell_view_karamba.Model, LayerOfResults=0, mode="PrincStress")  # -> AnalyzedModel, Points, FirstPrincipalStressVector_kN_cm2, SecondPrincipalStressVector_kN_cm2, FirstPrincipalStressValue_kN_cm2, SecondPrincipalStressValue_kN_cm2; disabled

# ---- group: bake mesh
mesh_8 = Mesh(vb.A)

# ----
pt_3 = Point(shellvecresults.Points)  # disabled
vec_5 = Vector()  # disabled
vec_6 = Vector()  # disabled
shell_view_karamba_2 = ShellViewKaramba(Model=model_view_karamba_3.Model, IndexOfLayer=0)  # -> Model, MeshesOfRenderedShells, LegendColors, LegendTags; disabled
analyzethi_karamba_2 = AnalyzeThIKaramba(Model=assemble_model_karamba_2.Model)  # -> CalculatedModel, MaximumDisplacement_m, ResultingForceOfGravity_kN, ElasticEnergy_kNm; disabled
legend = Legend(Colour=shellview.LegendColors, Tags=shellview.LegendTags, LegendType=1)  # disabled
model_view_karamba_4 = ModelViewKaramba(Model=analyzethi_karamba_2.CalculatedModel, LoadCaseFactorsForLinearSuperposition=1, IndexOfVisibleLoadcase=-1)  # -> Model, DeformedMesh, DeformedAxes, DeformedModel; disabled
mesh_9 = Mesh(shell_view_karamba_2.MeshesOfRenderedShells)  # disabled
besobeam = BESOForBeamsKaramba(
    LCases=0,
    TargetMassRatio=0.5,
    NumberOfChangeIterations=10,
    NumberOfConvergenceIterations=20,
    WeightingFactorForTension=1,
    WeightingFactorForCompression=1,
    WeightingFactorForShear=0,
    WeightingFactorForMoments=0,
    BESOFactor=0,
    MinimumDistanceBetweenChangingElements=0,
    RelativeWeightLimit=0)  # -> MaximumDisplacement, OptimizedModel, HistoryOfTheBESO, ElementIsActive, DistributionOfWeights; disabled
shell_view_karamba_3 = ShellViewKaramba(Model=model_view_karamba_4.Model, IndexOfLayer=0)  # -> Model, MeshesOfRenderedShells, LegendColors, LegendTags; disabled
mesh_10 = Mesh(shell_view_karamba_3.MeshesOfRenderedShells)  # disabled
line_results_on_shells_karamba = LineResultsOnShellsKaramba(
    AnalyzedModel=shell_view_karamba_3.Model,
    Layer=0,
    GlobalForceDirections=unit_z_3,
    SegmentLength_m=0.5,
    DA_deg=5,
    Theta_deg=0,
    mode="ForceFlow")  # -> AnalyzedModel, Lines; disabled

curve_14 = Curve([list_item_21, list_item_22, list_item_23, list_item_24, leftcenterlines, rightcenterlines, shatter_2, shatter_3, list_item_17, list_item_19, topbottomlines_3])  # disabled
curve_15 = Curve([line_26, line_24, line_25])  # disabled
valleys_2 = Curve(flatten(curve_15))  # disabled
mountains_2 = Curve(flatten(curve_14))  # disabled
folding_2 = Slider(0, range=0..0.99)  # disabled
number_slider_61 = Slider(-180, range=-360..360)  # disabled
number_slider_62 = Slider(45, range=-360..360)  # disabled
rad = Radians(Degrees=number_slider_61)  # disabled
rad_2 = Radians(Degrees=number_slider_62)  # disabled
hingepoints_2 = HingePoints(Mesh=mesh)  # -> _1, _2, _3, _4; disabled
multiplication = Multiplication(A=angle_3, B=folding_2)  # disabled
multiplication_2 = Multiplication(A=angle_2, B=folding_2)  # disabled
ln = Line(StartPoint=hingepoints._1, EndPoint=hingepoints._2)  # disabled
hinge = Hinge(
    FoldStart=hingepoints._1,
    FoldEnd=hingepoints._2,
    Tip1=hingepoints._3,
    Tip2=hingepoints._4,
    RestAngle=expr("-x", multiplication),
    Strength=0.1)  # disabled
hinge_2 = Hinge(
    FoldStart=hingepoints._1,
    FoldEnd=hingepoints._2,
    Tip1=hingepoints._3,
    Tip2=hingepoints._4,
    RestAngle=expr("-x", multiplication_2),
    Strength=0.1)  # disabled
show = Show(G=mesh)  # disabled
eval = EvaluateCurve(Curve=ln, Parameter=0.5)  # -> graft(Point), Tangent, Angle; disabled

# ---- group: Mountain fold lines
crv = Curve(mountains_2)  # disabled

# ---- group: Valley fold lines
crv_2 = Curve(valleys_2)  # disabled

# ----
eval_2 = EvaluateCurve(Curve=reparameterize(crv_2), Parameter=0.5)  # -> Point, Tangent, Angle; disabled
eval_3 = EvaluateCurve(Curve=reparameterize(crv), Parameter=0.5)  # -> Point, Tangent, Angle; disabled
dist = Distance(PointA=eval_2.Point, PointB=eval.Point)  # disabled
dist_2 = Distance(PointA=eval_3.Point, PointB=eval.Point)  # disabled
sort = SortList(Keys=dist)  # -> Keys, ValuesA; disabled
sort_2 = SortList(Keys=dist_2)  # -> Keys, ValuesA; disabled
item = ListItem(List=sort.Keys, Index=0, Wrap=True)  # disabled
item_2 = ListItem(List=sort_2.Keys, Index=0, Wrap=True)  # disabled
smaller = SmallerThan(FirstNumber=item, SecondNumber=0.01)  # -> flatten(SmallerThan), OrEqualTo; disabled
smaller_2 = SmallerThan(FirstNumber=item_2, SecondNumber=0.01)  # -> flatten(SmallerThan), OrEqualTo; disabled
cull = CullPattern(List=hinge_2, CullPattern=smaller.SmallerThan)  # disabled
cull_2 = CullPattern(List=hinge, CullPattern=smaller_2.SmallerThan)  # disabled

# ---- group: Output
solver = Solver(GoalObjects=[length_line, cull, cull_2, show, plasticanchor], Reset=reset, Threshold=1e-15, Tolerance=0.01, On=toggle)  # -> I, V, O; disabled
onlymeshes = CSharpScript(x=solver.O)  # -> out, A; inputs x: tree; disabled
# ---------- onlymeshes: C# ----------
    var meshOut = new List<object>();

    for( int i = 0; i < x.BranchCount; ++i )
      for( int j = 0; j < x.Branch(i).Count; ++j )
      {
  
        if( x.Branch(i)[j] != null )
          
          if( x.Branch(i)[j].GetType() == typeof( Rhino.Geometry.Mesh ) )
        
            meshOut.Add(x.Branch(i)[j]);
  
      }

    A = meshOut;
# ---------- end onlymeshes ----------

# ==== cluster Origami: Fold a flat pattern into 3d origami
mesh = ClusterInput()
mesh_2 = Mesh(mesh)
num = ClusterInput()
num_2 = ClusterInput()
hingepoints = HingePoints(Mesh=mesh_2)  # -> _1, _2, _3, _4
strength = Panel("1")
num_3 = Number(num)
C = ClusterInput()
C_2 = ClusterInput()
num_4 = ClusterInput()
strength_2 = Panel("1")
num_5 = Number(num_2)
num_6 = Number(strength)
eval = EvaluateCurve(Curve=reparameterize(C), Parameter=0.5)  # -> Point, Tangent, Angle
eval_2 = EvaluateCurve(Curve=reparameterize(C_2), Parameter=0.5)  # -> Point, Tangent, Angle
ln = Line(StartPoint=hingepoints._1, EndPoint=hingepoints._2)
num_7 = Number(num_4)
num_8 = Number(strength_2)
tri = Triangulate(Mesh=mesh_2)  # -> Mesh, Count
multiplication = Multiplication(A=num_7, B=num_3)
multiplication_2 = Multiplication(A=num_5, B=num_3)
eval_3 = EvaluateCurve(Curve=reparameterize(ln), Parameter=0.5)  # -> graft(Point), Tangent, Angle
springsfrommesh = SpringsFromMesh(M=tri.Mesh, stiffness=100, B=1)
planarizequads = PlanarizeQuads(M=mesh_2, planarizestrength=1000)
unweld = UnweldMesh(Mesh=mesh_2, Angle=0)
cp = ClosestPoint(Point=eval_3.Point, Cloud=eval_2.Point)  # -> ClosestPoint, CPIndex, Distance
cp_2 = ClosestPoint(Point=eval_3.Point, Cloud=eval.Point)  # -> ClosestPoint, CPIndex, Distance
R = ClusterOutput(unweld)
larger = LargerThan(FirstNumber=0.01, SecondNumber=cp.Distance)  # -> LargerThan, OrEqualTo
larger_2 = LargerThan(FirstNumber=0.01, SecondNumber=cp_2.Distance)  # -> LargerThan, OrEqualTo
cull = CullPattern(List=num_8, CullPattern=larger_2.LargerThan)
cull_2 = CullPattern(List=multiplication, CullPattern=larger_2.LargerThan)
cull_3 = CullPattern(List=num_6, CullPattern=larger.LargerThan)
cull_4 = CullPattern(List=multiplication_2, CullPattern=larger.LargerThan)
addition = Addition(A=cull, B=cull_3)
addition_2 = Addition(A=cull_2, B=cull_4)
addition_3 = Addition(A=0, B=addition)  # -> flatten(Result)
addition_4 = Addition(A=0, B=addition_2)  # -> flatten(Result)
hinge = Hinge(
    Point1=hingepoints._1,
    Point2=hingepoints._2,
    Point3=hingepoints._3,
    Point4=hingepoints._4,
    Strength=addition_3,
    RestAngle=addition_4)
data = Data([springsfrommesh, hinge, planarizequads])
data_2 = ClusterOutput(data)

# ==== cluster PlanarizeQuads: Applies a planarization force to any quads in a mesh
M = ClusterInput()
mcomp = Decompose(Mesh=M)  # -> Vertices, Faces, Colours, Normals
vertices = FaceVertices(Face=mcomp.Faces)  # -> CornerA, CornerB, CornerC, CornerD
planarizestrength = ClusterInput()
item = ListItem(List=mcomp.Vertices, Index=vertices.CornerA, Wrap=False)
item_2 = ListItem(List=mcomp.Vertices, Index=vertices.CornerB, Wrap=False)
item_3 = ListItem(List=mcomp.Vertices, Index=vertices.CornerC, Wrap=False)
item_4 = ListItem(List=mcomp.Vertices, Index=vertices.CornerD, Wrap=False)
planarize = Planarize(Point1=item, Point2=item_2, Point3=item_3, Point4=item_4, PlanarizeStrength=planarizestrength)
equals = Equality(FirstNumber=vertices.CornerC, SecondNumber=vertices.CornerD)  # -> Equality, Inequality
cull = CullPattern(List=planarize, CullPattern=equals.Inequality)
L = ClusterOutput(cull)

# ==== cluster SpringsFromMesh: Turns all edges of a mesh into springs
M = ClusterInput()
medges = MeshEdges(Mesh=M)  # -> NakedEdges, InteriorEdges, NonManifoldEdges
crv = Curve([medges.NakedEdges, medges.InteriorEdges])
B = ClusterInput()
len = Length(Curve=crv)
multiplication = Multiplication(A=len, B=B)
stiffness = ClusterInput()
springs = SpringsFromLine(Connection=crv, Stiffness=stiffness, Damping=10, RestLength=multiplication, UpperCutoff=0, LowerCutoff=0, Plasticity=0)
S = ClusterOutput(springs)
