# Grasshopper definition PavilionTwo.gh (Grasshopper 0.9.76)
# plug-ins: Karamba, Kangaroo Components, PTComponentLibrary, Weaverbird, Kangaroo2 Components, HAL [Data Utilities], TT Toolbox

galapagos = Galapagos(fitness=analyzethi_karamba, gene=[number_slider_21, number_slider_20])

# ---- group: SetupForKangaroo / SimulationReset
reset = Button()
toggle = BooleanToggle(True)

# ----
strength = Strength(0.1)
multiplication = Multiplication(A=strength, B=Slider(0.738, range=0..1))

# ---- group: AttractorFitness
mesh = Mesh(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)

# ----
number_slider = Slider(1, range=0..10)  # disabled

# ---- group: SpinAttractor
mesh_2 = Mesh(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)

# ----
negative = Negative(Value=number_slider)  # disabled
unit_z = UnitZ(Factor=negative)  # disabled
loads_karamba = LoadsKaramba(Vector=unit_z, LCase=0, mode="Gravity")  # disabled

# ---- group: GridAndVariations
always_even_odd = AlwaysEvenOdd(Integer=Slider(8, range=0..100), EvenOdd=True)  # -> Integer, Corrected
planar_grid = PlanarGrid(
    BasePoint=Point(0, 0, 0),
    IDir=Vector(1, 0, 0),
    JDir=Vector(0, 1, 0),
    IDistance=Slider(3.0725, range=0..10),
    JDistance=Slider(2.782678, range=0..10),
    INumber=Slider(8, range=0..10),
    JNumber=always_even_odd.Integer)  # -> simplify(Grid)
number_slider_2 = Slider(2, range=0..7)
number_slider_3 = Slider(0, range=0..7)
number_slider_4 = Slider(7, range=0..7)
pickarowwithoutloosingbranch = CSharpScript(tree=planar_grid, branchStart=number_slider_3, branchEnd=number_slider_4, randomOrNot=Toggle(False))  # -> selected; inputs tree: tree of Point3d, branchStart: Int32, branchEnd: Int32, randomOrNot: Boolean
# ---------- pickarowwithoutloosingbranch: C# ----------
    var treeOut = new DataTree<Point3d>();

    var size = tree.BranchCount;

    for( int i = branchStart + 1; i < branchEnd; ++i )
      for( int j = 0; j < tree.Branch(i).Count; ++j )
      {

        if( randomOrNot == false )
        {
          
          if( i != 2 && i != 3 && i != 4 && i != 5 )

          
            treeOut.Add(tree.Branch(i)[j], new GH_Path(i));

        }
        
        else
        {
        
          //if( i != 2 && i != 3 && i != 4 && i != 5 )

          
            treeOut.Add(tree.Branch(i)[j], new GH_Path(i));
        
        }
          
      }

    selected = treeOut;
# ---------- end pickarowwithoutloosingbranch ----------
pickarowwithoutloosingbranch_2 = CSharpScript(
    tree=pickarowwithoutloosingbranch,
    branch=Slider(2, range=0..7),
    seed=Slider(354, range=0..1000),
    numberOfPoints=Slider(3, range=0..10))  # -> selected, others, A; inputs tree: tree of Point3d, branch: Int32, seed: Int32, numberOfPoints: Int32
# ---------- pickarowwithoutloosingbranch_2: C# ----------
    var treeOut = new DataTree<Point3d>();
    var treeOutOne = new DataTree<Point3d>();

    var size = tree.Branch(branch).Count;

    var getRandom = new Random(seed);
    var randoms = new List<int>();

    for( int i = 0; i < numberOfPoints; ++i )
    {

      int random = getRandom.Next(0, size);

      if( random % 2 != 0 )
      {
        randoms.Add( random );

        treeOut.Add(tree.Branch(branch)[random], new GH_Path(branch + 1));
        tree.Branch(branch).RemoveAt(random);

      }

    }

    //for( int i = branch; i < branch + 1; ++i )
    //for( int j = 0; j < tree.Branch(i).Count; ++j )
    /*for( int k = 0; k < numberOfPoints; ++k )
    {

    //if( j % 2 != 1 )

    treeOut.Add(tree.Branch(branch)[randoms[k]], new GH_Path(branch));

    }
    */
    selected = treeOut;

    others = tree;
    
    A = randoms;
# ---------- end pickarowwithoutloosingbranch_2 ----------
pickarowwithoutloosingbranch_3 = CSharpScript(tree=planar_grid, branch=Slider(5, range=0..7))  # -> selected; inputs tree: tree of Point3d, branch: Int32
# ---------- pickarowwithoutloosingbranch_3: C# ----------
    var treeOut = new DataTree<Point3d>();
    
    var size = tree.BranchCount;
    
    for( int i = branch; i < branch + 1; ++i )
      for( int j = 0; j < tree.Branch(i).Count; ++j )
      {
      
        treeOut.Add( tree.Branch(i)[j], new GH_Path( i ) );
      
      }
    
    selected = treeOut;
# ---------- end pickarowwithoutloosingbranch_3 ----------
pickarowwithoutloosingbranch_4 = CSharpScript(tree=planar_grid, branch=number_slider_2)  # -> selected; inputs tree: tree of Point3d, branch: Int32; same code as pickarowwithoutloosingbranch_3
pickarowwithoutloosingbranch_5 = CSharpScript(tree=planar_grid, branch=Slider(4, range=0..7))  # -> selected; inputs tree: tree of Point3d, branch: Int32; same code as pickarowwithoutloosingbranch_3
pickarowwithoutloosingbranch_6 = CSharpScript(tree=planar_grid, branch=number_slider_3)  # -> selected; inputs tree: tree of Point3d, branch: Int32; same code as pickarowwithoutloosingbranch_3
pickarowwithoutloosingbranch_7 = CSharpScript(tree=planar_grid, branch=number_slider_4)  # -> selected; inputs tree: tree of Point3d, branch: Int32; same code as pickarowwithoutloosingbranch_3
pickarowwithoutloosingbranch_8 = CSharpScript(tree=planar_grid, branch=Slider(3, range=0..7))  # -> selected; inputs tree: tree of Point3d, branch: Int32; same code as pickarowwithoutloosingbranch_3
number_slider_5 = Slider(27, range=0..100)
number_slider_6 = Slider(3, range=0..10)
number_slider_7 = Slider(7, range=0..10)
point = Point(pickarowwithoutloosingbranch_2.selected)
panel = Panel(pickarowwithoutloosingbranch_2.A)
point_2 = Point(pickarowwithoutloosingbranch_2.others)
number_slider_8 = Slider(6, range=0..100)
number_slider_9 = Slider(8, range=0..10)
number_slider_10 = Slider(2, range=0..10)
number_slider_11 = Slider(27, range=0..100)
number_slider_12 = Slider(1, range=0..10)
number_slider_13 = Slider(7, range=0..10)
number_slider_14 = Slider(24, range=0..100)
number_slider_15 = Slider(0, range=0..10)
number_slider_16 = Slider(6, range=0..10)
unit_y = UnitY(Factor=Slider(0.349, range=0..10))
unit_y_2 = UnitY(Factor=Slider(1.04, range=0..10))
unit_y_3 = UnitY(Factor=Slider(0, range=0..10))
unit_y_4 = UnitY(Factor=Slider(0, range=0..10))
construct_domain = ConstructDomain(DomainStart=Slider(0, range=0..100), DomainEnd=Slider(1, range=0..10))
move = Move(Geometry=point, Motion=expr("-x", unit_y))  # -> Geometry, Transform
number_slider_17 = Slider(10, range=0..10)
unit_y_5 = UnitY(Factor=[Slider(0, range=-1..1), Slider(0, range=-1..1), Slider(0, range=-1..1)])
unit_y_6 = UnitY(Factor=[Slider(0, range=0..1), Slider(0, range=-1..1), Slider(0, range=-1..1)])
unit_y_7 = UnitY(Factor=[Slider(0, range=-1..1), Slider(0, range=-1..1), Slider(0, range=0..1)])
list_item = ListItem(List=pickarowwithoutloosingbranch_3, Index=[number_slider_5, number_slider_6, number_slider_7], Wrap=True)
list_item_2 = ListItem(List=pickarowwithoutloosingbranch_4, Index=[number_slider_8, number_slider_9, number_slider_10], Wrap=True)
list_item_3 = ListItem(List=pickarowwithoutloosingbranch_5, Index=[number_slider_11, number_slider_12, number_slider_13], Wrap=True)
unit_y_8 = UnitY(Factor=[Slider(0, range=-1..1), Slider(0, range=-1..1), Slider(0, range=-1..1)])
cull_index = CullIndex(List=pickarowwithoutloosingbranch_3, Indices=[number_slider_5, number_slider_6, number_slider_7], Wrap=True)
list_item_4 = ListItem(List=pickarowwithoutloosingbranch_8, Index=[number_slider_14, number_slider_15, number_slider_16], Wrap=True)
cull_index_2 = CullIndex(List=pickarowwithoutloosingbranch_4, Indices=[number_slider_8, number_slider_9, number_slider_10], Wrap=True)
cull_index_3 = CullIndex(List=pickarowwithoutloosingbranch_5, Indices=[number_slider_11, number_slider_12, number_slider_13], Wrap=True)
cull_index_4 = CullIndex(List=pickarowwithoutloosingbranch_8, Indices=[number_slider_14, number_slider_15, number_slider_16], Wrap=True)
move_2 = Move(Geometry=pickarowwithoutloosingbranch_6, Motion=expr("-x", unit_y_3))  # -> Geometry, Transform
move_3 = Move(Geometry=pickarowwithoutloosingbranch_7, Motion=unit_y_4)  # -> Geometry, Transform
move_4 = Move(Geometry=list_item, Motion=expr("-x", unit_y_5))  # -> Geometry, Transform
move_5 = Move(Geometry=list_item_3, Motion=expr("-x", unit_y_7))  # -> Geometry, Transform
range = Range(Domain=construct_domain, Steps=number_slider_17)
move_6 = Move(Geometry=list_item_4, Motion=expr("-x", unit_y_8))  # -> Geometry, Transform
move_7 = Move(Geometry=list_item_2, Motion=unit_y_6)  # -> Geometry, Transform
path_mapper = PathMapper(cull_index, source="{A;B}", target="{A}")
path_mapper_2 = PathMapper(cull_index_2, source="{A;B}", target="{A}")
path_mapper_3 = PathMapper(cull_index_3, source="{A;B}", target="{A}")
path_mapper_4 = PathMapper(cull_index_4, source="{A;B}", target="{A}")
point_3 = Point([move.Geometry, point_2])
number_slider_18 = Slider(0.186, range=0..1)
graph_mapper = GraphMapper(
    range,
    x0=0,
    x1=1,
    y0=0,
    y1=1,
    amplitude=0.5,
    container_name="Perlin",
    decay=0.3,
    frequency=0.06811523438,
    x_offset=0.5,
    y_offset=0.5)
point_4 = Point([path_mapper, move_4.Geometry])
point_5 = Point([path_mapper_2, move_7.Geometry])
point_6 = Point([path_mapper_3, move_5.Geometry])
sort_points = SortPoints(Points=point_3)  # -> Points, Indices
pickarowwithoutloosingbranch_9 = CSharpScript(
    tree=sort_points.Points,
    branch=Slider(0, range=0..7),
    seed=Slider(200, range=0..1000),
    numberOfPoints=Slider(4, range=0..10))  # -> selected, others, A; inputs tree: tree of Point3d, branch: Int32, seed: Int32, numberOfPoints: Int32
# ---------- pickarowwithoutloosingbranch_9: C# ----------
    var treeOut = new DataTree<Point3d>();
    var treeOutOne = new DataTree<Point3d>();

    var size = tree.Branch(branch).Count;

    var getRandom = new Random(seed);
    var randoms = new List<int>();

    for( int i = 0; i < numberOfPoints; ++i )
    {

      int random = getRandom.Next(0, size);

      if( random % 2 != 1 )
      {
        randoms.Add( random );

        treeOut.Add(tree.Branch(branch)[random], new GH_Path(branch + 1));
        tree.Branch(branch).RemoveAt(random);

      }

    }

    //for( int i = branch; i < branch + 1; ++i )
    //for( int j = 0; j < tree.Branch(i).Count; ++j )
    /*for( int k = 0; k < numberOfPoints; ++k )
    {

    //if( j % 2 != 1 )

    treeOut.Add(tree.Branch(branch)[randoms[k]], new GH_Path(branch));

    }
    */
    selected = treeOut;

    others = tree;
    
    A = randoms;
# ---------- end pickarowwithoutloosingbranch_9 ----------
point_7 = Point(pickarowwithoutloosingbranch_9.selected)
panel_2 = Panel(pickarowwithoutloosingbranch_9.A)
point_8 = Point(pickarowwithoutloosingbranch_9.others)
move_8 = Move(Geometry=point_7, Motion=expr("-x", unit_y_2))  # -> Geometry, Transform
point_9 = Point([move_8.Geometry, point_8])
sort_points_2 = SortPoints(Points=point_9)  # -> Points, Indices
point_10 = Point([path_mapper_4, move_6.Geometry])
construct_point = ConstructPoint(XCoordinate=0, YCoordinate=0, ZCoordinate=0)
sort_points_3 = SortPoints(Points=point_4)  # -> Points, Indices
sort_points_4 = SortPoints(Points=point_5)  # -> Points, Indices
sort_points_5 = SortPoints(Points=point_6)  # -> Points, Indices
sort_points_6 = SortPoints(Points=point_10)  # -> Points, Indices
point_list = PointList(Points=sort_points_2.Points, Size=Slider(0.3907, range=0..1))
merge = Merge(
    Data1=move_2.Geometry,
    Data2=move_3.Geometry,
    Data3=pickarowwithoutloosingbranch,
    Data4=sort_points_4.Points,
    Data5=sort_points_3.Points,
    Data6=sort_points_6.Points,
    Data7=sort_points_5.Points)
series = Series(Start=0, Step=1, Count=number_slider_17)
unit_x = UnitX(Factor=graph_mapper)
point_11 = Point(merge)
list_length = ListLength(List=flatten(point_11))
construct_domain_2 = ConstructDomain(DomainStart=Slider(0, range=0..1), DomainEnd=list_length)
random = Random(Range=construct_domain_2, Number=list_length, Seed=Slider(5816, range=0..10000))
unit_y_9 = UnitY(Factor=graph_mapper)
point_list_2 = PointList(Points=sort_points_3.Points)
flatten_tree = FlattenTree(Tree=point_11, Path="{0}")
point_list_3 = PointList(Points=sort_points_4.Points)
point_list_4 = PointList(Points=sort_points_5.Points)
point_list_5 = PointList(Points=sort_points_6.Points)
unit_y_10 = UnitY(Factor=series)
move_9 = Move(Geometry=construct_point, Motion=unit_y_10)  # -> Geometry, Transform
floor = CSharpScript(numbers=random, howMany=Slider(4, range=0..10))  # -> floored; inputs numbers: list of Double, howMany: Int32
# ---------- floor: C# ----------
    var numbersOut = new List<int>();
    
    for( int i = 0; i < howMany; ++i )
    {
    
      numbersOut.Add( Convert.ToInt32( numbers[i] ) );
      
    } 
    
    floored = numbersOut;
# ---------- end floor ----------
construct_point_2 = ConstructPoint(
    XCoordinate=Slider(-3.164, range=-100..101),
    YCoordinate=Slider(-4.979, range=-100..101),
    ZCoordinate=Slider(0, range=-100..101))
construct_point_3 = ConstructPoint(
    XCoordinate=Slider(29.238, range=-100..101),
    YCoordinate=Slider(11.388, range=-100..101),
    ZCoordinate=Slider(0, range=-100..101))
list_item_5 = ListItem(List=flatten_tree, Index=Slider(25, range=0..100), Wrap=True)
list_item_6 = ListItem(List=flatten_tree, Index=Slider(72, range=0..100), Wrap=True)
series_2 = Series(Start=0, Step=1, Count=number_slider_17)
point_12 = Point(point_11)
panel_3 = Panel(floor)
list_item_7 = ListItem(List=flatten(point_11), Index=Slider(63, range=0..120), Wrap=True)
list_item_8 = ListItem(List=flatten(point_11), Index=Slider(46, range=0..100), Wrap=True)
unit_x_2 = UnitX(Factor=series_2)
move_10 = Move(Geometry=move_9.Geometry, Motion=unit_x_2)  # -> Geometry, Transform
move_11 = Move(Geometry=move_10.Geometry, Motion=unit_y_9)  # -> Geometry, Transform
number_slider_19 = Slider(2.6344, range=0..100)
list_item_9 = ListItem(List=flatten(point_11), Index=floor, Wrap=True)
polyline = PolyLine(Vertices=move_11.Geometry, Closed=False)
number_slider_20 = Slider(52, range=0..100)
number_slider_21 = Slider(67, range=0..200)
point_charge = PointCharge(Point=[list_item_6, list_item_5], Charge=expr("-x", Slider(0.1703, range=0..1)), Decay=Slider(0, range=0..10))
spin_force = SpinForce(Plane=construct_point_3, Strength=Slider(76.8, range=0..100), Radius=number_slider_19, Decay=Slider(1.518, range=0..10))
spin_force_2 = SpinForce(Plane=construct_point_2, Strength=Slider(7.885, range=0..100), Radius=number_slider_19, Decay=Slider(0.973, range=0..10))
merge_fields = MergeFields(Fields=flatten([spin_force_2, spin_force, point_charge]))
list_item_10 = ListItem(List=flatten(point_11), Index=number_slider_20, Wrap=True)
list_item_11 = ListItem(List=flatten(point_11), Index=number_slider_21, Wrap=True)
curve = Curve(<curve referenced from the Rhino model>)
merge_fields_2 = MergeFields(Fields=flatten(spin_force_2))
evaluate_field = EvaluateField(Field=flatten(merge_fields_2), Point=point_11)  # -> simplify(Tensor), Strength
evaluate_field_2 = EvaluateField(Field=merge_fields, Point=point_11)  # -> Tensor, Strength
direction_attraction = DirectionAttraction(Grid=point_11, Magnitude=Slider(10, range=0..10), Dir=Vector(21.28300888, 15.42176085, 0))  # -> Grid, Weights

# ----
list_item_12 = ListItem(List=flatten(planar_grid), Index=0, Wrap=True)
list_item_13 = ListItem(List=flatten(planar_grid), Index=Slider(63, range=0..100), Wrap=True)
list_item_14 = ListItem(List=flatten(planar_grid), Index=0, Wrap=True)
list_item_15 = ListItem(List=flatten(planar_grid), Index=Slider(8, range=0..100), Wrap=True)
distance = Distance(PointA=list_item_12, PointB=list_item_13)
panel_4 = Panel(distance)
distance_2 = Distance(PointA=list_item_14, PointB=list_item_15)
panel_5 = Panel(distance_2)
panel_6 = Panel(pickarowwithoutloosingbranch)
eraserow = CSharpScript(tree=pickarowwithoutloosingbranch, branch=number_slider_2)  # -> selected; inputs tree: tree of Point3d, branch: Int32
# ---------- eraserow: C# ----------
    var treeOut = new DataTree<Point3d>();

    var size = tree.BranchCount;

    for( int i = 0; i < size; ++i )
      for( int j = 0; j < tree.Branch(i).Count; ++j )
      {

        if( i != branch - 1 )

          treeOut.Add(tree.Branch(i)[j], new GH_Path(i + 1));

      }

    selected = treeOut;
# ---------- end eraserow ----------
point_list_6 = PointList(Points=eraserow)
panel_7 = Panel(eraserow)
panel_8 = Panel(merge)
remove_duplicate_points = RemoveDuplicatePoints(InputPoints=point_12, Tolerance=0.001)  # -> OutputPoints, FirstPointIndexes
clean_tree = CleanTree(RemoveNulls=True, RemoveInvalid=True, RemoveEmpty=False, Tree=remove_duplicate_points.OutputPoints)
sort_points_7 = SortPoints(Points=clean_tree)  # -> simplify(Points), Indices

# ---- group: GridAndVariations (continued)
point_attraction = PointAttraction(Grid=sort_points_7.Points, PtAtts=[list_item_11, list_item_10], Magnitude=expr("-x", Slider(1.33, range=0..10)))  # -> simplify(Grid), Weights
random_attraction = RandomAttraction(Grid=sort_points_7.Points, Magnitude=Slider(0.5857, range=0..1))  # -> simplify(Grid), Weights
curve_attraction = CurveAttraction(Grid=sort_points_7.Points, CrvAtts=curve, Magnitude=Slider(0.4127, range=0..1))  # -> simplify(Grid), Weights
move_12 = Move(Geometry=point_attraction.Grid, Motion=evaluate_field_2.Tensor)  # -> Geometry, Transform
move_13 = Move(Geometry=point_attraction.Grid, Motion=evaluate_field.Tensor)  # -> simplify(Geometry), Transform
point_13 = Point(sort_points_7.Points)

# ---- group: ParametricMagicThanksRelativeItem
boolean_toggle = BooleanToggle(False)
flip_matrix = FlipMatrix(Data=move_12.Geometry)
relative_item = RelativeItem(Tree=move_12.Geometry, Offset="{0}[+1]", WrapPaths=boolean_toggle, WrapItems=boolean_toggle)  # -> ItemA, ItemB
relative_item_2 = RelativeItem(Tree=flip_matrix, Offset="{0}[+1]", WrapPaths=boolean_toggle, WrapItems=boolean_toggle)  # -> ItemA, ItemB
relative_item_3 = RelativeItem(Tree=move_12.Geometry, Offset="{+1}[+1]", WrapPaths=boolean_toggle, WrapItems=boolean_toggle)  # -> ItemA, ItemB
relative_item_4 = RelativeItem(Tree=move_12.Geometry, Offset="{+1}[-1]", WrapPaths=boolean_toggle, WrapItems=boolean_toggle)  # -> ItemA, ItemB
line = Line(StartPoint=relative_item.ItemA, EndPoint=relative_item.ItemB)
line_2 = Line(StartPoint=relative_item_4.ItemA, EndPoint=relative_item_4.ItemB)
line_3 = Line(StartPoint=relative_item_2.ItemA, EndPoint=relative_item_2.ItemB)
line_4 = Line(StartPoint=relative_item_3.ItemA, EndPoint=relative_item_3.ItemB)
boolean_toggle_2 = BooleanToggle(False)
relative_item_5 = RelativeItem(Tree=line_3, Offset="{+2}[0]", WrapPaths=boolean_toggle_2, WrapItems=boolean_toggle_2)  # -> ItemA, ItemB
relative_item_6 = RelativeItem(Tree=line, Offset="{+2}[0]", WrapPaths=boolean_toggle_2, WrapItems=boolean_toggle_2)  # -> ItemA, ItemB
relative_item_7 = RelativeItem(Tree=line_4, Offset="{+2}[0]", WrapPaths=boolean_toggle_2, WrapItems=boolean_toggle_2)  # -> ItemA, ItemB
relative_item_8 = RelativeItem(Tree=line_2, Offset="{+2}[0]", WrapPaths=boolean_toggle_2, WrapItems=boolean_toggle_2)  # -> ItemA, ItemB
boolean_toggle_3 = BooleanToggle(False)
line_5 = Line(relative_item_8.ItemB)
line_6 = Line(relative_item_8.ItemA)
line_7 = Line(relative_item_5.ItemA)
line_8 = Line(relative_item_5.ItemB)
line_9 = Line(relative_item_6.ItemA)
line_10 = Line(relative_item_6.ItemB)
line_11 = Line(relative_item_7.ItemA)
line_12 = Line(relative_item_7.ItemB)
relative_item_9 = RelativeItem(Tree=line_11, Offset="{+1}[0]", WrapPaths=boolean_toggle_3, WrapItems=boolean_toggle_3)  # -> ItemA, ItemB
relative_item_10 = RelativeItem(Tree=line_12, Offset="{+1}[0]", WrapPaths=boolean_toggle_3, WrapItems=boolean_toggle_3)  # -> ItemA, ItemB
relative_item_11 = RelativeItem(Tree=line_6, Offset="{+1}[0]", WrapPaths=boolean_toggle_3, WrapItems=boolean_toggle_3)  # -> ItemA, ItemB
relative_item_12 = RelativeItem(Tree=line_5, Offset="{+1}[0]", WrapPaths=boolean_toggle_3, WrapItems=boolean_toggle_3)  # -> ItemA, ItemB
relative_item_13 = RelativeItem(Tree=line_8, Offset="{+1}[0]", WrapPaths=boolean_toggle_3, WrapItems=boolean_toggle_3)  # -> ItemA, ItemB
relative_item_14 = RelativeItem(Tree=line_7, Offset="{+1}[0]", WrapPaths=boolean_toggle_3, WrapItems=boolean_toggle_3)  # -> ItemA, ItemB
relative_item_15 = RelativeItem(Tree=line_10, Offset="{+1}[0]", WrapPaths=boolean_toggle_3, WrapItems=boolean_toggle_3)  # -> ItemA, ItemB
relative_item_16 = RelativeItem(Tree=line_9, Offset="{+1}[0]", WrapPaths=boolean_toggle_3, WrapItems=boolean_toggle_3)  # -> ItemA, ItemB
line_13 = Line(relative_item_13.ItemB)
line_14 = Line(relative_item_14.ItemA)
line_15 = Line(relative_item_15.ItemB)
line_16 = Line(relative_item_16.ItemA)
line_17 = Line(relative_item_9.ItemB)
line_18 = Line(relative_item_10.ItemA)
line_19 = Line(relative_item_11.ItemB)
line_20 = Line(relative_item_12.ItemA)
cull_pattern = CullPattern(List=line_20, CullPattern=invert([False, True]))
cull_pattern_2 = CullPattern(List=line_17, CullPattern=[False, True])
cull_pattern_3 = CullPattern(List=line_18, CullPattern=invert([False, True]))
cull_pattern_4 = CullPattern(List=line_19, CullPattern=invert([False, True]))
cull_pattern_5 = CullPattern(List=line_20, CullPattern=[False, True])
flip_matrix_2 = FlipMatrix(Data=line_13)
flip_matrix_3 = FlipMatrix(Data=line_14)
flip_matrix_4 = FlipMatrix(Data=line_15)
flip_matrix_5 = FlipMatrix(Data=line_16)
flip_matrix_6 = FlipMatrix(Data=cull_pattern_2)
flip_matrix_7 = FlipMatrix(Data=cull_pattern_3)
flip_matrix_8 = FlipMatrix(Data=cull_pattern_4)
flip_matrix_9 = FlipMatrix(Data=cull_pattern_5)
flip_matrix_10 = FlipMatrix(Data=cull_pattern)

# ----
relative_item_17 = RelativeItem(Tree=line_12, Offset="{+1}[0]", WrapPaths=boolean_toggle_3, WrapItems=boolean_toggle_3)  # -> ItemA, ItemB
line_21 = Line(relative_item_17.ItemA)
cull_pattern_6 = CullPattern(List=line_21, CullPattern=[False, True])
flip_matrix_11 = FlipMatrix(Data=cull_pattern_6)
leftcenterlines = CSharpScript(lines=line_3)  # -> linesOut; inputs lines: tree of Line
# ---------- leftcenterlines: C# ----------
    var lineTree = new DataTree<Line>();

    for( int i = 0; i < lines.BranchCount; ++i )
      for( int j = 5; j < lines.Branch(i).Count; ++j )
      {

        if( i % 2 != 0 )
          lineTree.Add(lines.Branch(i)[j], new GH_Path(i));

      }

    linesOut = lineTree;
# ---------- end leftcenterlines ----------

# ---- group: GetAllTheValleysAndMountains
topbottomsecondlines = CSharpScript(lines=line_3)  # -> linesOut; inputs lines: tree of Line
# ---------- topbottomsecondlines: C# ----------
    var lineTree = new DataTree<Line>();

    for( int i = 1; i < lines.BranchCount - 1; ++i )
      for( int j = 3; j < lines.Branch(i).Count - 1; ++j )
      {

        if( i % 2 != 1 )
          lineTree.Add(lines.Branch(i)[j], new GH_Path(i));

      }

    linesOut = lineTree;
# ---------- end topbottomsecondlines ----------
leftcenterlines_2 = CSharpScript(lines=line_3)  # -> linesOut; inputs lines: tree of Line
# ---------- leftcenterlines_2: C# ----------
    var lineTree = new DataTree<Line>();

    for( int i = 0; i < lines.BranchCount - 1; ++i )
      for( int j = 5; j < lines.Branch(i).Count; ++j )
      {

        if( i % 2 != 0 )
          lineTree.Add(lines.Branch(i)[j], new GH_Path(i));

      }

    linesOut = lineTree;
# ---------- end leftcenterlines_2 ----------
rigthintersectionrlines = CSharpScript(lines=line_3)  # -> linesOut; inputs lines: tree of Line
# ---------- rigthintersectionrlines: C# ----------
    var lineTree = new DataTree<Line>();

    for( int i = 1; i < lines.BranchCount - 1; ++i )
      for( int j = 0; j < lines.Branch(i).Count - 5; ++j )
      {

        if( i % 2 != 1 )
          lineTree.Add(lines.Branch(i)[j], new GH_Path(i));

      }

    linesOut = lineTree;
# ---------- end rigthintersectionrlines ----------
centerlines = CSharpScript(lines=line_3)  # -> linesOut; inputs lines: tree of Line
# ---------- centerlines: C# ----------
    var lineTree = new DataTree<Line>();

    for( int i = 0; i < lines.BranchCount - 1; ++i )
      for( int j = 1; j < lines.Branch(i).Count - 3; ++j )
      {

        if( i % 2 != 0 )
          lineTree.Add(lines.Branch(i)[j], new GH_Path(i));

      }

    linesOut = lineTree;
# ---------- end centerlines ----------
panel_9 = Panel(topbottomsecondlines)
join_curves = JoinCurves(Curves=topbottomsecondlines, Preserve=False)  # -> simplify(Curves)
join_curves_2 = JoinCurves(Curves=rigthintersectionrlines, Preserve=False)  # -> simplify(Curves)
join_curves_3 = JoinCurves(Curves=leftcenterlines_2, Preserve=False)  # -> simplify(Curves)
join_curves_4 = JoinCurves(Curves=centerlines, Preserve=False)  # -> simplify(Curves)
numberofbranches = CSharpScript(lines=relative_item_13.ItemB)  # -> numberOfBranches; inputs lines: tree of Line
# ---------- numberofbranches: C# ----------
    numberOfBranches = lines.BranchCount - 1;
# ---------- end numberofbranches ----------
numberofbranches_2 = CSharpScript(lines=relative_item_15.ItemB)  # -> numberOfBranches; inputs lines: tree of Line; same code as numberofbranches
numberofbranches_3 = CSharpScript(lines=relative_item_17.ItemA)  # -> numberOfBranches; inputs lines: tree of Line; same code as numberofbranches
numberofbranches_4 = CSharpScript(lines=relative_item_12.ItemA)  # -> numberOfBranches; inputs lines: tree of Line; same code as numberofbranches
end_points = EndPoints(Curve=join_curves)  # -> Start, End
end_points_2 = EndPoints(Curve=join_curves_2)  # -> Start, End
end_points_3 = EndPoints(Curve=join_curves_3)  # -> Start, End
end_points_4 = EndPoints(Curve=join_curves_4)  # -> Start, End
line_22 = Line(StartPoint=end_points_4.Start, EndPoint=end_points_4.End)
line_23 = Line(StartPoint=end_points.Start, EndPoint=end_points.End)
line_24 = Line(StartPoint=end_points_3.Start, EndPoint=end_points_3.End)
line_25 = Line(StartPoint=end_points_2.Start, EndPoint=end_points_2.End)
topbottomlines = CSharpScript(lines=line_3)  # -> linesOut; inputs lines: tree of Line
# ---------- topbottomlines: C# ----------
    var lineTree = new DataTree<Line>();

    for( int i = 1; i < lines.BranchCount - 1; ++i )
      for( int j = 2; j < lines.Branch(i).Count - 4; ++j )
      {

        if( i % 2 != 1 )
          lineTree.Add(lines.Branch(i)[j], new GH_Path(i));

      }

    linesOut = lineTree;
# ---------- end topbottomlines ----------
rightcenterlines = CSharpScript(lines=line_3)  # -> linesOut; inputs lines: tree of Line
# ---------- rightcenterlines: C# ----------
    var lineTree = new DataTree<Line>();

    for( int i = 0; i < lines.BranchCount; ++i )
      for( int j = 4; j < lines.Branch(i).Count - 2; ++j )
      {

        if( i % 2 != 0 )
          lineTree.Add(lines.Branch(i)[j], new GH_Path(i));

      }

    linesOut = lineTree;
# ---------- end rightcenterlines ----------
leftintersectionrlines = CSharpScript(lines=line_3)  # -> linesOut; inputs lines: tree of Line
# ---------- leftintersectionrlines: C# ----------
    var lineTree = new DataTree<Line>();

    for( int i = 1; i < lines.BranchCount - 1; ++i )
      for( int j = 6; j < lines.Branch(i).Count; ++j )
      {

        if( i % 2 != 1 )
          lineTree.Add(lines.Branch(i)[j], new GH_Path(i));

      }

    linesOut = lineTree;
# ---------- end leftintersectionrlines ----------
leftleftintersectionrlines = CSharpScript(lines=line_3)  # -> linesOut; inputs lines: tree of Line
# ---------- leftleftintersectionrlines: C# ----------
    var lineTree = new DataTree<Line>();

    for( int i = 0; i < lines.BranchCount; ++i )
      for( int j = 0; j < lines.Branch(i).Count - 6; ++j )
      {

        if( i % 2 != 0 )
          lineTree.Add(lines.Branch(i)[j], new GH_Path(i));

      }

    linesOut = lineTree;
# ---------- end leftleftintersectionrlines ----------
list_item_16 = ListItem(List=flip_matrix_2, Index=numberofbranches, Wrap=True)
list_item_17 = ListItem(List=flip_matrix_3, Index=Slider(0, range=0..10), Wrap=True)
list_item_18 = ListItem(List=flip_matrix_4, Index=numberofbranches_2, Wrap=True)
list_item_19 = ListItem(List=flip_matrix_5, Index=Slider(0, range=0..10), Wrap=True)
list_item_20 = ListItem(List=flip_matrix_11, Index=numberofbranches_3, Wrap=True)
list_item_21 = ListItem(List=flip_matrix_10, Index=numberofbranches_4, Wrap=True)
list_item_22 = ListItem(List=flip_matrix_7, Index=1, Wrap=True)
list_item_23 = ListItem(List=flip_matrix_9, Index=1, Wrap=True)
list_item_24 = ListItem(List=flip_matrix_6, Index=0, Wrap=True)
list_item_25 = ListItem(List=flip_matrix_8, Index=0, Wrap=True)

# ----
join_curves_5 = JoinCurves(Curves=leftcenterlines, Preserve=False)  # -> simplify(Curves)
end_points_5 = EndPoints(Curve=join_curves_5)  # -> Start, End
line_26 = Line(StartPoint=end_points_5.Start, EndPoint=end_points_5.End)

# ---- group: HackyWayOfMakingTheMesh
topbottomsecondlines_2 = CSharpScript(lines=line_3)  # -> linesOut; inputs lines: tree of Line
# ---------- topbottomsecondlines_2: C# ----------
    var lineTree = new DataTree<Line>();

    for( int i = 0; i < lines.BranchCount; ++i )
      for( int j = 3; j < lines.Branch(i).Count - 1; ++j )
      {

        if( i % 2 != 1 )
          lineTree.Add(lines.Branch(i)[j], new GH_Path(i));

      }

    linesOut = lineTree;
# ---------- end topbottomsecondlines_2 ----------
rigthintersectionrlines_2 = CSharpScript(lines=line_3)  # -> linesOut; inputs lines: tree of Line
# ---------- rigthintersectionrlines_2: C# ----------
    var lineTree = new DataTree<Line>();

    for( int i = 0; i < lines.BranchCount; ++i )
      for( int j = 0; j < lines.Branch(i).Count - 5; ++j )
      {

        if( i % 2 != 1 )
          lineTree.Add(lines.Branch(i)[j], new GH_Path(i));

      }

    linesOut = lineTree;
# ---------- end rigthintersectionrlines_2 ----------
centerlines_2 = CSharpScript(lines=line_3)  # -> linesOut; inputs lines: tree of Line
# ---------- centerlines_2: C# ----------
    var lineTree = new DataTree<Line>();

    for( int i = 0; i < lines.BranchCount; ++i )
      for( int j = 1; j < lines.Branch(i).Count - 3; ++j )
      {

        if( i % 2 != 0 )
          lineTree.Add(lines.Branch(i)[j], new GH_Path(i));

      }

    linesOut = lineTree;
# ---------- end centerlines_2 ----------
join_curves_6 = JoinCurves(Curves=topbottomsecondlines_2, Preserve=False)  # -> simplify(Curves)
join_curves_7 = JoinCurves(Curves=rigthintersectionrlines_2, Preserve=False)  # -> simplify(Curves)
join_curves_8 = JoinCurves(Curves=centerlines_2, Preserve=False)  # -> simplify(Curves)
end_points_6 = EndPoints(Curve=join_curves_6)  # -> Start, End
end_points_7 = EndPoints(Curve=join_curves_7)  # -> Start, End
end_points_8 = EndPoints(Curve=join_curves_8)  # -> Start, End
line_27 = Line(StartPoint=end_points_7.Start, EndPoint=end_points_7.End)
line_28 = Line(StartPoint=end_points_6.Start, EndPoint=end_points_6.End)
topbottomlines_2 = CSharpScript(lines=line_3)  # -> linesOut; inputs lines: tree of Line
# ---------- topbottomlines_2: C# ----------
    var lineTree = new DataTree<Line>();

    for( int i = 0; i < lines.BranchCount; ++i )
      for( int j = 2; j < lines.Branch(i).Count - 4; ++j )
      {

        if( i % 2 != 1 )
          lineTree.Add(lines.Branch(i)[j], new GH_Path(i));

      }

    linesOut = lineTree;
# ---------- end topbottomlines_2 ----------
leftintersectionrlines_2 = CSharpScript(lines=line_3)  # -> linesOut; inputs lines: tree of Line
# ---------- leftintersectionrlines_2: C# ----------
    var lineTree = new DataTree<Line>();

    for( int i = 0; i < lines.BranchCount; ++i )
      for( int j = 6; j < lines.Branch(i).Count; ++j )
      {

        if( i % 2 != 1 )
          lineTree.Add(lines.Branch(i)[j], new GH_Path(i));

      }

    linesOut = lineTree;
# ---------- end leftintersectionrlines_2 ----------
line_29 = Line(StartPoint=end_points_8.Start, EndPoint=end_points_8.End)
curve_2 = Curve([list_item_20, list_item_21, list_item_22, list_item_23, list_item_24, list_item_25, rightcenterlines, leftleftintersectionrlines, list_item_18, list_item_19, topbottomlines_2, leftintersectionrlines_2])
curve_3 = Curve([line_27, line_28, line_26, line_29])
weaverbird_s_mesh_from_lines_weave_back = WeaverbirdsMeshFromLinesWeaveBack(Lines=flatten([curve_3, curve_2]), MaximumValence=Slider(4, range=0..10))

# ---- group: SetupForKangaroo / mesh of flat folding pattern
mesh_3 = Mesh(weaverbird_s_mesh_from_lines_weave_back)

# ---- group: Kangaroo2 / maintain edge lengths
medges = MeshEdges(Mesh=mesh_3)  # -> NakedEdges, InteriorEdges, NonManifoldEdges
length_line = LengthLine(Line=[medges.NakedEdges, medges.InteriorEdges], Strength=1)

# ---- group: Kangaroo2 / a weak plastic anchor on all points prevents drift
demesh = DeconstructMesh(Mesh=mesh_3)  # -> Vertices, Faces, Colours, Normals
plasticanchor = PlasticAnchor(Point=demesh.Vertices, Limit=0.01, Strength=0.1)

# ---- group: AnchorPointsAlthoughWeDontNeedThemNoMore
join_curves_9 = JoinCurves(Curves=line_3, Preserve=False)
join_curves_10 = JoinCurves(Curves=line_3, Preserve=False)
end_points_9 = EndPoints(Curve=join_curves_9)  # -> Start, End
end_points_10 = EndPoints(Curve=join_curves_10)  # -> Start, End
point_14 = Point(end_points_9.End)
point_15 = Point(end_points_10.Start)
cull_pattern_7 = CullPattern(List=flatten(point_14), CullPattern=[True, False])
cull_pattern_8 = CullPattern(List=flatten(point_15), CullPattern=[True, False])

# ---- group: WeShouldntNeedThisOnes
load = Load(ForceVector=Vector(0, 0, 1))
point_16 = Point([cull_pattern_7, cull_pattern_8])
anchor = Anchor(Point=flatten(point_16), Strength=Slider(1000, range=0..1000))

# ---- group: SetupForKangaroo
curve_4 = Curve([line_22, line_23, line_24, line_25])
curve_5 = Curve([list_item_20, list_item_21, list_item_22, list_item_23, list_item_24, list_item_25, topbottomlines, rightcenterlines, leftintersectionrlines, leftleftintersectionrlines, list_item_16, list_item_17, list_item_18, list_item_19])
curve_6 = Curve(curve_4)
valleys = Curve(flatten(curve_6))
folding = Slider(0.334, range=0..0.99)
angle = Panel("pi")
angle_2 = Panel("-pi")
rad = Radians(Degrees=Slider(-180, range=-360..360))
rad_2 = Radians(Degrees=Slider(45, range=-360..360))

# ---- group: SetupForKangaroo / WatchOut!ThisComponentHelpsToVisualizeIfTheNumberOnTheFirstParametersOnTheLeftIsOKOrNot
curve_7 = Curve(curve_5)

# ---- group: SetupForKangaroo (continued)
mountains = Curve(flatten(curve_7))

# ---- group: SetupForKangaroo / Mountain fold lines
crv = Curve(mountains)

# ---- group: SetupForKangaroo / Valley fold lines
crv_2 = Curve(valleys)

# ---- group: Kangaroo2
hingepoints = HingePoints(Mesh=mesh_3)  # -> _1, _2, _3, _4
multiplication_2 = Multiplication(A=angle_2, B=folding)
multiplication_3 = Multiplication(A=angle, B=folding)
ln = Line(StartPoint=hingepoints._1, EndPoint=hingepoints._2)
show = Show(G=mesh_3)
hinge = Hinge(
    FoldStart=hingepoints._1,
    FoldEnd=hingepoints._2,
    Tip1=hingepoints._3,
    Tip2=hingepoints._4,
    RestAngle=multiplication_3,
    Strength=0.1)
hinge_2 = Hinge(
    FoldStart=hingepoints._1,
    FoldEnd=hingepoints._2,
    Tip1=hingepoints._3,
    Tip2=hingepoints._4,
    RestAngle=multiplication_2,
    Strength=0.1)
eval = EvaluateCurve(Curve=reparameterize(crv_2), Parameter=0.5)  # -> Point, Tangent, Angle
eval_2 = EvaluateCurve(Curve=reparameterize(crv), Parameter=0.5)  # -> Point, Tangent, Angle
eval_3 = EvaluateCurve(Curve=ln, Parameter=0.5)  # -> graft(Point), Tangent, Angle
dist = Distance(PointA=eval.Point, PointB=eval_3.Point)
dist_2 = Distance(PointA=eval_2.Point, PointB=eval_3.Point)
sort = SortList(Keys=dist)  # -> Keys, ValuesA
sort_2 = SortList(Keys=dist_2)  # -> Keys, ValuesA
item = ListItem(List=sort.Keys, Index=0, Wrap=True)
item_2 = ListItem(List=sort_2.Keys, Index=0, Wrap=True)
smaller = SmallerThan(FirstNumber=item, SecondNumber=0.01)  # -> flatten(SmallerThan), OrEqualTo
smaller_2 = SmallerThan(FirstNumber=item_2, SecondNumber=0.01)  # -> flatten(SmallerThan), OrEqualTo
cull = CullPattern(List=hinge_2, CullPattern=smaller.SmallerThan)
cull_2 = CullPattern(List=hinge, CullPattern=smaller_2.SmallerThan)

# ---- group: Kangaroo1
origami = Origami(mesh=flatten(mesh_3), valleys=crv_2, C=crv, num_2=angle_2, num=expr("-x", folding), num_3=angle)  # -> flatten(data_2), flatten(R)
timer = Timer(TimerInterval=20, Target=kangaroo)
kangaroo = KangarooPhysics(ForceObjects=flatten(origami.data_2), Settings=null, Geometry=origami.R, SimulationReset=toggle)  # -> Out, Iterations, ParticlesOut, GeometryOut, KE
mesh_4 = Mesh(kangaroo.GeometryOut)

# ----
data = Data([length_line, cull, cull_2, show, plasticanchor])

# ---- group: Output
solver = Solver(GoalObjects=data, Reset=reset, Threshold=1e-15, Tolerance=0.01, On=toggle)  # -> I, V, O
onlymeshes = CSharpScript(x=solver.O)  # -> A; inputs x: tree
# ---------- onlymeshes: C# ----------
    var meshOut = new List<object>();

    for( int i = 0; i < x.BranchCount; ++i )
      for( int j = 0; j < x.Branch(i).Count; ++j )
      {
  
        if( x.Branch(i)[j] != null )
          
          if( x.Branch(i)[j].GetType() == typeof( Rhino.Geometry.Mesh ) )
        
            meshOut.Add(x.Branch(i)[j]);
  
      }

    A = meshOut;
# ---------- end onlymeshes ----------

# ----
zombiesolver = ZombieSolver(GoalObjects=data, Threshold=1e-10, Tolerance=0.01, MaxIterations=50000)  # -> I, V, O; disabled
onlymeshes_2 = CSharpScript(x=zombiesolver.O)  # -> A; inputs x: tree; disabled; same code as onlymeshes
closest_point = ClosestPoint(Point=point_16, Cloud=zombiesolver.V)  # -> ClosestPoint, CPIndex, Distance; disabled
mesh_to_shell_karamba = MeshToShellKaramba(Mesh=onlymeshes_2, LimitDistance_m=0.005)  # -> Element, Points, Info; disabled
remove_duplicate_points_karamba = RemoveDuplicatePointsKaramba(Point=closest_point.ClosestPoint, LimitDistance=0.005)  # -> OutPoint, Info, Indexes; disabled
support_karamba = SupportKaramba(PosInd=remove_duplicate_points_karamba.OutPoint, menu=[buttons(on, on, on, on, on, on)])  # disabled
assemble_model_karamba = AssembleModelKaramba(
    Points=mesh_to_shell_karamba.Points,
    Elem=mesh_to_shell_karamba.Element,
    Support=support_karamba,
    Load=loads_karamba,
    LimitDistance_m=0.005)  # -> Model, Info, Mass_kg, CenterOfGravity; disabled
analyzethi_karamba = AnalyzeThIKaramba(Model=assemble_model_karamba.Model)  # -> CalculatedModel, MaximumDisplacement_m, ResultingForceOfGravity_kN, ElasticEnergy_kNm; disabled
model_view_karamba = ModelViewKaramba(Model=analyzethi_karamba.CalculatedModel, LoadCaseFactorsForLinearSuperposition=1, IndexOfVisibleLoadcase=-1)  # -> Model, DeformedMesh, DeformedAxes, DeformedModel; disabled
shell_view_karamba = ShellViewKaramba(Model=model_view_karamba.Model, IndexOfLayer=0)  # -> Model, MeshesOfRenderedShells, LegendColors, LegendTags; disabled
mesh_5 = Mesh(shell_view_karamba.MeshesOfRenderedShells)  # disabled

# ==== cluster Origami: Fold a flat pattern into 3d origami
mesh = ClusterInput()
valleys = ClusterInput()

# ---- group: Mountains
C = ClusterInput()

# ---- group: Folding
num = ClusterInput()

# ---- group: -pi/2
num_2 = ClusterInput()

# ---- group: pi
num_3 = ClusterInput()

# ----
mesh_2 = Mesh(mesh)

# ---- group: GridPointNumbers
demesh = DeconstructMesh(Mesh=mesh_2)  # -> Vertices, Faces, Colours, Normals
points = PointList(Points=demesh.Vertices, Size=Slider(1, range=0..1))

# ----
hingepoints = HingePoints(Mesh=mesh_2)  # -> _1, _2, _3, _4
num_4 = Number(num)
num_5 = Number(num_2)
num_6 = Number(num_3)
ln = Line(StartPoint=hingepoints._1, EndPoint=hingepoints._2)
eval = EvaluateCurve(Curve=reparameterize(C), Parameter=0.5)  # -> Point, Tangent, Angle
eval_2 = EvaluateCurve(Curve=reparameterize(valleys), Parameter=0.5)  # -> Point, Tangent, Angle
multiplication = Multiplication(A=num_6, B=num_4)
unweld = UnweldMesh(Mesh=mesh_2, Angle=0)
eval_3 = EvaluateCurve(Curve=reparameterize(ln), Parameter=0.5)  # -> graft(Point), Tangent, Angle
multiplication_2 = Multiplication(A=num_5, B=num_4)
cp = ClosestPoint(Point=eval_3.Point, Cloud=eval.Point)  # -> ClosestPoint, CPIndex, Distance
cp_2 = ClosestPoint(Point=eval_3.Point, Cloud=eval_2.Point)  # -> ClosestPoint, CPIndex, Distance
strength = Panel("1")
strength_2 = Panel("1")

# ---- group: Forces
springsfrommesh = SpringsFromMesh(M=mesh_2, stiffness=100, B=1)
planarizequads = PlanarizeQuads(M=mesh_2, planarizestrength=1000)

# ----
larger = LargerThan(FirstNumber=0.01, SecondNumber=cp.Distance)  # -> LargerThan, OrEqualTo
num_7 = Number(strength_2)
larger_2 = LargerThan(FirstNumber=0.01, SecondNumber=cp_2.Distance)  # -> LargerThan, OrEqualTo
num_8 = Number(strength)
points_2 = PointList(Points=hingepoints._4, Size=Slider(1, range=0..1))
cull = CullPattern(List=num_7, CullPattern=larger.LargerThan)
cull_2 = CullPattern(List=num_8, CullPattern=larger_2.LargerThan)
cull_3 = CullPattern(List=multiplication_2, CullPattern=larger_2.LargerThan)
cull_4 = CullPattern(List=multiplication, CullPattern=larger.LargerThan)
addition = Addition(A=cull_2, B=cull)
addition_2 = Addition(A=cull_3, B=cull_4)
addition_3 = Addition(A=0, B=addition)  # -> flatten(Result)
addition_4 = Addition(A=0, B=addition_2)  # -> flatten(Result)
hinge = Hinge(
    Point1=hingepoints._1,
    Point2=hingepoints._2,
    Point3=hingepoints._3,
    Point4=hingepoints._4,
    Strength=addition_3,
    RestAngle=addition_4)
panel = Panel(addition_3)
panel_2 = Panel(addition_4)
data = Data([springsfrommesh, hinge, planarizequads])
data_2 = ClusterOutput(data)
R = ClusterOutput(unweld)

# ==== cluster PlanarizeQuads: Applies a planarization force to any quads in a mesh
M = ClusterInput()
mcomp = Decompose(Mesh=M)  # -> Vertices, Faces, Colours, Normals
vertices = FaceVertices(Face=mcomp.Faces)  # -> CornerA, CornerB, CornerC, CornerD
planarizestrength = ClusterInput()
item = ListItem(List=mcomp.Vertices, Index=vertices.CornerA, Wrap=False)
item_2 = ListItem(List=mcomp.Vertices, Index=vertices.CornerB, Wrap=False)
item_3 = ListItem(List=mcomp.Vertices, Index=vertices.CornerC, Wrap=False)
item_4 = ListItem(List=mcomp.Vertices, Index=vertices.CornerD, Wrap=False)
planarize = Planarize(Point1=item, Point2=item_2, Point3=item_3, Point4=item_4, PlanarizeStrength=planarizestrength)
equals = Equality(FirstNumber=vertices.CornerC, SecondNumber=vertices.CornerD)  # -> Equality, Inequality
cull = CullPattern(List=planarize, CullPattern=equals.Inequality)
L = ClusterOutput(cull)

# ==== cluster SpringsFromMesh: Turns all edges of a mesh into springs
M = ClusterInput()
medges = MeshEdges(Mesh=M)  # -> NakedEdges, InteriorEdges, NonManifoldEdges
crv = Curve([medges.NakedEdges, medges.InteriorEdges])
B = ClusterInput()
len = Length(Curve=crv)
multiplication = Multiplication(A=len, B=B)
stiffness = ClusterInput()
springs = SpringsFromLine(Connection=crv, Stiffness=stiffness, Damping=10, RestLength=multiplication, UpperCutoff=0, LowerCutoff=0, Plasticity=0)
S = ClusterOutput(springs)
