# Grasshopper definition TachisPavilion.gh (Grasshopper 0.9.76)
# plug-ins: Kangaroo Components, PTComponentLibrary, Weaverbird, Kangaroo2 Components

# ---- group: XTranslationControlWatchOutItShouldMatchTheTranslationsThatAreBelowCheckByViewingTheRedWatchOutGroupToTheRight
number_slider = Slider(17, range=0..30)

# ---- group: GridFourOurValleysAndMountains
planar_grid = PlanarGrid(
    BasePoint=Point(0, 0, 0),
    IDir=Vector(1, 0, 0),
    JDir=Vector(0, 1, 0),
    IDistance=Slider(4.3265, range=0..10),
    JDistance=Slider(1.34, range=0..10),
    INumber=6,
    JNumber=number_slider)  # -> simplify(Grid)

# ---- group: MeasureSizeOfGrid
list_item = ListItem(List=flatten(planar_grid), Index=Slider(8, range=0..100), Wrap=True)
list_item_2 = ListItem(List=flatten(planar_grid), Index=Slider(45, range=0..100), Wrap=True)
list_item_3 = ListItem(List=flatten(planar_grid), Index=Slider(0, range=0..100), Wrap=True)
distance = Distance(PointA=list_item_3, PointB=list_item)
distance_2 = Distance(PointA=list_item_3, PointB=list_item_2)
panel = Panel(distance_2)
panel_2 = Panel(distance)

# ----
boolean_toggle = BooleanToggle(False)  # disabled
number_slider_2 = Slider(2, range=0..100)
number_slider_3 = Slider(1, range=0..100)
number_slider_4 = Slider(3, range=0..100)
number_slider_5 = Slider(4, range=0..100)
number_slider_6 = Slider(6, range=0..100)
number_slider_7 = Slider(5, range=0..100)
number_slider_8 = Slider(8, range=0..100)
number_slider_9 = Slider(10, range=0..100)
number_slider_10 = Slider(9, range=0..100)
number_slider_11 = Slider(11, range=0..100)
number_slider_12 = Slider(12, range=0..100)
number_slider_13 = Slider(14, range=0..100)
number_slider_14 = Slider(13, range=0..100)
number_slider_15 = Slider(15, range=0..100)
number_slider_16 = Slider(17, range=0..100)
number_slider_17 = Slider(16, range=0..100)
number_slider_18 = Slider(0, range=0..100)
number_slider_19 = Slider(6, range=0..100)
number_slider_20 = Slider(8, range=0..10)
number_slider_21 = Slider(10, range=0..10)
number_slider_22 = Slider(12, range=0..100)
number_slider_23 = Slider(14, range=0..14)
number_slider_24 = Slider(16, range=0..16)
number_slider_25 = Slider(18, range=0..100)
number_slider_26 = Slider(10, range=0..10)
number_slider_27 = Slider(7, range=0..10)
number_slider_28 = Slider(8, range=0..100)
number_slider_29 = Slider(10, range=0..10)
number_slider_30 = Slider(12, range=0..100)
number_slider_31 = Slider(14, range=0..100)
number_slider_32 = Slider(16, range=0..100)
number_slider_33 = Slider(7, range=0..100)
number_slider_34 = Slider(11, range=0..15)
number_slider_35 = Slider(9, range=0..10)
number_slider_36 = Slider(13, range=0..100)
number_slider_37 = Slider(15, range=0..16)
number_slider_38 = Slider(5, range=0..10)
number_slider_39 = Slider(7, range=0..50)
number_slider_40 = Slider(9, range=0..100)
number_slider_41 = Slider(11, range=0..100)
number_slider_42 = Slider(13, range=0..50)
number_slider_43 = Slider(15, range=0..100)
number_slider_44 = Slider(17, range=0..100)
number_slider_45 = Slider(6, range=0..10)
number_slider_46 = Slider(17, range=0..100)
number_slider_47 = Slider(-0.134, range=-4..4)
number_slider_48 = Slider(1.152, range=-4..2)
number_slider_49 = Slider(0.71, range=-4..1)
number_slider_50 = Slider(-0.134, range=-4..4)
number_slider_51 = Slider(-2.161, range=-5..2)
number_slider_52 = Slider(-1.698, range=-5..3)
number_slider_53 = Slider(-2.505, range=-4..4)
number_slider_54 = Slider(-2.382, range=-4..4)
number_slider_55 = Slider(-1.987, range=-5..3)
number_slider_56 = Slider(-0.134, range=-4..4)
number_slider_57 = Slider(1.152, range=-4..2)
number_slider_58 = Slider(0.71, range=-4..1)
number_slider_59 = Slider(0.153, range=-4..4)
number_slider_60 = Slider(-5.997, range=-10..2)
number_slider_61 = Slider(-1.698, range=-5..3)
number_slider_62 = Slider(-2.505, range=-4..4)
number_slider_63 = Slider(-2.382, range=-4..4)
number_slider_64 = Slider(-1.987, range=-5..3)
unit_x = UnitX(Factor=[Slider(-0.1857, range=-5..5), Slider(0.4639, range=-5..5), Slider(1.2843, range=-5..5), Slider(1.7302, range=-5..5), Slider(2.3608, range=-5..10), Slider(2.9549, range=-5..5), Slider(3.7247, range=-5..5), Slider(5.2703, range=-5..6), Slider(5.7156, range=-5..10)])
unit_x_2 = UnitX(Factor=[Slider(1, range=-1..1), Slider(0.502, range=-2..2), Slider(0.104, range=-1..1), Slider(-0.645, range=-2..2), Slider(-0.846, range=-1..1), Slider(-1.195, range=-5..2), Slider(-1.573, range=-5..1), Slider(-4.852, range=-10..2), Slider(-6.354, range=-10..2)])
unit_x_3 = UnitX(Factor=[Slider(-0.49441, range=-5..5), Slider(0.798, range=-5..5), Slider(1.458, range=-5..5), Slider(2.12404, range=-5..5), Slider(2.983, range=-5..5), Slider(3.924, range=-5..5), Slider(5.325, range=-5..10), Slider(6.409, range=-5..10)])
unit_x_4 = UnitX(Factor=[Slider(1.152, range=-4..2), Slider(0.71, range=-4..1), Slider(-0.134, range=-4..4), Slider(-0.691, range=-4..2), Slider(-0.793, range=-4..1), Slider(-1.166, range=-4..4), Slider(-2.629, range=-10..2), Slider(-6.404, range=-10..1)])
unit_x_5 = UnitX(Factor=[Slider(1.475, range=-5..5), Slider(1.859, range=-5..5), Slider(2.624, range=-5..5), Slider(1.885, range=-5..5), Slider(0.41, range=-5..5), Slider(0.328, range=-5..5), Slider(-0.36, range=-5..5), Slider(0.697, range=-5..5), Slider(0.136, range=-5..5), Slider(0.131, range=-5..5), Slider(-0.765, range=-5..5), Slider(-0.832, range=-5..5), Slider(-2.378, range=-5..5), Slider(-2.742, range=-8..5), Slider(-4.808, range=-8..5), Slider(-4.816, range=-6..5), Slider(-5.618, range=-6..5)])
construct_path = ConstructPath(Indices=Slider(0, range=0..100))
construct_path_2 = ConstructPath(Indices=Slider(2, range=0..100))
construct_path_3 = ConstructPath(Indices=Slider(1, range=0..1))
angle = Panel("-pi")
angle_2 = Panel("pi")

# ---- group: SimulationReset
reset = Button()
toggle = BooleanToggle(False)

# ----
folding = Slider(0.655, range=0..0.99)

# ---- group: SetUpOurMeshAndTheTranslations
number_slider_65 = Slider(5, range=0..7)
number_slider_66 = Slider(0, range=0..7)
pickarowwithoutloosingbranch = CSharpScript(tree=planar_grid, branch=number_slider_65)  # -> selected; inputs tree: tree of Point3d, branch: Int32
# ---------- pickarowwithoutloosingbranch: C# ----------
    var treeOut = new DataTree<Point3d>();
    
    var size = tree.BranchCount;
    
    for( int i = branch; i < branch + 1; ++i )
      for( int j = 0; j < tree.Branch(i).Count; ++j )
      {
      
        treeOut.Add( tree.Branch(i)[j], new GH_Path( i ) );
      
      }
    
    selected = treeOut;
# ---------- end pickarowwithoutloosingbranch ----------
pickarowwithoutloosingbranch_2 = CSharpScript(tree=planar_grid, branch=number_slider_66)  # -> selected; inputs tree: tree of Point3d, branch: Int32; same code as pickarowwithoutloosingbranch
unit_y = UnitY(Factor=Slider(0, range=-10..10))
move = Move(Geometry=pickarowwithoutloosingbranch, Motion=unit_y)  # -> Geometry, Transform
unit_y_2 = UnitY(Factor=Slider(0, range=0..10))
move_2 = Move(Geometry=pickarowwithoutloosingbranch_2, Motion=expr("-x", unit_y_2))  # -> Geometry, Transform
pickarowwithoutloosingbranch_3 = CSharpScript(tree=planar_grid, branch=Slider(4, range=0..7))  # -> selected; inputs tree: tree of Point3d, branch: Int32; same code as pickarowwithoutloosingbranch
pickarowwithoutloosingbranch_4 = CSharpScript(tree=planar_grid, branch=Slider(3, range=0..7))  # -> selected; inputs tree: tree of Point3d, branch: Int32; same code as pickarowwithoutloosingbranch
pickarowwithoutloosingbranch_5 = CSharpScript(tree=planar_grid, branch=Slider(2, range=0..7))  # -> selected; inputs tree: tree of Point3d, branch: Int32; same code as pickarowwithoutloosingbranch
pickarowwithoutloosingbranch_6 = CSharpScript(tree=planar_grid, branch=Slider(1, range=0..7))  # -> selected; inputs tree: tree of Point3d, branch: Int32; same code as pickarowwithoutloosingbranch
number_slider_67 = Slider(0, range=0..100)
number_slider_68 = Slider(0, range=0..100)
number_slider_69 = Slider(2, range=0..10)
number_slider_70 = Slider(4, range=0..10)
number_slider_71 = Slider(2, range=0..100)
number_slider_72 = Slider(6, range=0..10)
number_slider_73 = Slider(4, range=0..10)
number_slider_74 = Slider(1, range=0..100)
number_slider_75 = Slider(3, range=0..10)
number_slider_76 = Slider(5, range=0..10)
number_slider_77 = Slider(1, range=0..50)
number_slider_78 = Slider(3, range=0..100)
number_slider_79 = Slider(5, range=0..100)
number_slider_80 = Slider(0, range=0..100)
number_slider_81 = Slider(2, range=0..100)
number_slider_82 = Slider(1, range=0..100)
number_slider_83 = Slider(3, range=0..100)
number_slider_84 = Slider(8, range=0..100)
number_slider_85 = Slider(10, range=0..100)
number_slider_86 = Slider(4, range=0..100)
number_slider_87 = Slider(5, range=0..100)
number_slider_88 = Slider(6, range=0..100)
number_slider_89 = Slider(7, range=0..100)
number_slider_90 = Slider(9, range=0..100)
number_slider_91 = Slider(11, range=0..100)
number_slider_92 = Slider(16, range=0..100)
number_slider_93 = Slider(12, range=0..100)
number_slider_94 = Slider(13, range=0..100)
number_slider_95 = Slider(14, range=0..100)
number_slider_96 = Slider(15, range=0..100)
unit_y_3 = UnitY(Factor=[Slider(1.382, range=-2..2), Slider(1.344, range=-5..5), Slider(1.241, range=-5..5), Slider(0.041, range=-5..5), Slider(0.033, range=-5..5), Slider(-0.164, range=-5..5), Slider(-0.317, range=-5..5), Slider(-0.45, range=-5..5), Slider(-0.55, range=-5..5), Slider(-0.476, range=-5..5), Slider(-0.317, range=-5..5), Slider(-0.098, range=-5..5), Slider(0.533, range=-5..5), Slider(1.004, range=-5..5), Slider(2.089, range=-5..5), Slider(1.987, range=-5..5), Slider(1.987, range=-5..5)])
unit_y_4 = UnitY(Factor=[Slider(0.286, range=-4..1), Slider(-0.58, range=-4..2), Slider(-1.18, range=-4..4), Slider(-0.755, range=-4..2), Slider(-0.704, range=-4..1), Slider(-0.195, range=-4..4), Slider(0.012, range=-4..2), Slider(1.656, range=-4..10)])
list_item_4 = ListItem(
    List=move.Geometry,
    Index=[number_slider_67, number_slider_3, number_slider_2, number_slider_4, number_slider_5, number_slider_7, number_slider_6, number_slider_8, number_slider_10, number_slider_9, number_slider_11, number_slider_12, number_slider_14, number_slider_13, number_slider_15, number_slider_17],
    Wrap=True)
unit_y_5 = UnitY(Factor=[Slider(-3.175, range=-5..4), Slider(-2.574, range=-5..2), Slider(-3.233, range=-5..4), Slider(-3.757, range=-5..2), Slider(-3.859, range=-5..4), Slider(-3.604, range=-5..2), Slider(-2.83, range=-5..4), Slider(-0.281, range=-5..2), Slider(-2.161, range=-5..2)])
unit_y_6 = UnitY(Factor=[Slider(-0.063, range=-5..2), Slider(0.218, range=-5..2), Slider(-0.77, range=-5..5.001), Slider(-0.869, range=-5..2), Slider(-1.099, range=-5..5.001), Slider(-1.484, range=-5..2), Slider(-2.303, range=-5..2), Slider(-2.909, range=-5..2), Slider(-3.336, range=-5..2)])
list_item_5 = ListItem(
    List=pickarowwithoutloosingbranch_3,
    Index=[number_slider_74, number_slider_75, number_slider_76, number_slider_33, number_slider_35, number_slider_34, number_slider_36, number_slider_37],
    Wrap=True)
list_item_6 = ListItem(
    List=pickarowwithoutloosingbranch_4,
    Index=[number_slider_68, number_slider_69, number_slider_70, number_slider_19, number_slider_20, number_slider_21, number_slider_22, number_slider_23, number_slider_24],
    Wrap=True)
cull_index = CullIndex(
    List=move.Geometry,
    Indices=[number_slider_67, number_slider_3, number_slider_2, number_slider_4, number_slider_5, number_slider_7, number_slider_6, Slider(7, range=0..100), number_slider_8, number_slider_10, number_slider_9, number_slider_11, number_slider_12, number_slider_14, number_slider_13, number_slider_15, number_slider_17],
    Wrap=True)
list_item_7 = ListItem(
    List=pickarowwithoutloosingbranch_5,
    Index=[number_slider_18, number_slider_71, number_slider_73, number_slider_72, number_slider_28, number_slider_29, number_slider_30, number_slider_31, number_slider_32],
    Wrap=True)
cull_index_2 = CullIndex(
    List=pickarowwithoutloosingbranch_3,
    Indices=[number_slider_74, number_slider_75, number_slider_76, number_slider_33, number_slider_35, number_slider_34, number_slider_36, number_slider_37],
    Wrap=True)
unit_y_7 = UnitY(Factor=[Slider(-3.52, range=-5..3), Slider(-2.485, range=-5..3), Slider(-2.448, range=-4..4), Slider(-2.126, range=-5..3), Slider(-1.762, range=-5..3), Slider(-1.033, range=-4..4), Slider(-0.149, range=-5..3), Slider(0.078, range=-5..3)])
cull_index_3 = CullIndex(
    List=pickarowwithoutloosingbranch_4,
    Indices=[number_slider_68, number_slider_69, number_slider_70, number_slider_19, number_slider_20, number_slider_21, number_slider_22, number_slider_23, number_slider_24],
    Wrap=True)
cull_index_4 = CullIndex(
    List=pickarowwithoutloosingbranch_5,
    Indices=[number_slider_18, number_slider_71, number_slider_73, number_slider_72, number_slider_28, number_slider_29, number_slider_30, number_slider_31, number_slider_32],
    Wrap=True)
list_item_8 = ListItem(
    List=pickarowwithoutloosingbranch_6,
    Index=[number_slider_77, number_slider_78, number_slider_79, number_slider_39, number_slider_40, number_slider_41, number_slider_42, number_slider_43],
    Wrap=True)
unit_y_8 = UnitY(Factor=[Slider(-4.187, range=-10..2), Slider(-4.248, range=-10..2), Slider(-4.076, range=-10..2), Slider(-2.555, range=-10..2), Slider(-2.319, range=-10..2), Slider(-1.707, range=-10..2), Slider(-1.653, range=-10..2), Slider(-1.115, range=-10..2), Slider(-0.992, range=-10..2), Slider(-0.562, range=-10..2), Slider(-0.439, range=-10..2), Slider(0.363, range=-10..2), Slider(0.239, range=-10..2), Slider(0.501, range=-10..2), Slider(-0.021, range=-10..2), Slider(-0.193, range=-10..2), Slider(-0.193, range=-10..2), Slider(-0.193, range=-10..2)])
cull_index_5 = CullIndex(
    List=pickarowwithoutloosingbranch_6,
    Indices=[number_slider_77, number_slider_78, number_slider_79, number_slider_39, number_slider_40, number_slider_41, number_slider_42, number_slider_43],
    Wrap=True)
list_item_9 = ListItem(
    List=move_2.Geometry,
    Index=[number_slider_80, number_slider_82, number_slider_81, number_slider_83, number_slider_86, number_slider_87, number_slider_88, number_slider_89, number_slider_84, number_slider_90, number_slider_85, number_slider_91, number_slider_93, number_slider_94, number_slider_95, number_slider_96, number_slider_92],
    Wrap=True)
cull_index_6 = CullIndex(
    List=move_2.Geometry,
    Indices=[number_slider_80, number_slider_82, number_slider_81, number_slider_83, number_slider_86, number_slider_87, number_slider_88, number_slider_89, number_slider_84, number_slider_90, number_slider_85, number_slider_91, number_slider_93, number_slider_94, number_slider_95, number_slider_96, number_slider_92],
    Wrap=True)
move_3 = Move(Geometry=list_item_4, Motion=expr("-x", unit_y_3))  # -> Geometry, Transform
move_4 = Move(Geometry=list_item_5, Motion=expr("-x", unit_y_4))  # -> Geometry, Transform
move_5 = Move(Geometry=list_item_6, Motion=expr("-x", unit_y_5))  # -> Geometry, Transform
path_mapper = PathMapper(cull_index, source="{A;B}", target="{A}")
move_6 = Move(Geometry=list_item_7, Motion=unit_y_6)  # -> Geometry, Transform
path_mapper_2 = PathMapper(cull_index_2, source="{A;B}", target="{A}")
move_7 = Move(Geometry=list_item_8, Motion=expr("-x", unit_y_7))  # -> Geometry, Transform
path_mapper_3 = PathMapper(cull_index_3, source="{A;B}", target="{A}")
path_mapper_4 = PathMapper(cull_index_4, source="{A;B}", target="{A}")
move_8 = Move(Geometry=list_item_9, Motion=expr("-x", unit_y_8))  # -> Geometry, Transform
number_slider_97 = Slider(0.37975, range=-10..10)
number_slider_98 = Slider(1.04961, range=-10..10)
path_mapper_5 = PathMapper(cull_index_5, source="{A;B}", target="{A}")
number_slider_99 = Slider(-0.51201, range=-10..10)
number_slider_100 = Slider(0.1065, range=-10..10)
number_slider_101 = Slider(6.84189, range=-10..10)
number_slider_102 = Slider(6.71362, range=-10..10)
number_slider_103 = Slider(5.52343, range=-10..10)
number_slider_104 = Slider(-2.4063, range=-10..10)
number_slider_105 = Slider(-1.09443, range=-10..10)
number_slider_106 = Slider(3.48159, range=-10..10)
number_slider_107 = Slider(5.75899, range=-10..10)
number_slider_108 = Slider(-0.6144, range=-10..10)
number_slider_109 = Slider(-1.38237, range=-10..10)
number_slider_110 = Slider(2.01738, range=-10..10)
number_slider_111 = Slider(3.41113, range=-10..10)
number_slider_112 = Slider(1.10591, range=-10..10)
number_slider_113 = Slider(1.97632, range=-10..10)
path_mapper_6 = PathMapper(cull_index_6, source="{A;B}", target="{A}")

# ----
pickarowwithoutloosingbranch_7 = CSharpScript(tree=planar_grid, branchStart=number_slider_66, branchEnd=number_slider_65, randomOrNot=boolean_toggle)  # -> selected; inputs tree: tree of Point3d, branchStart: Int32, branchEnd: Int32, randomOrNot: Boolean; disabled
# ---------- pickarowwithoutloosingbranch_7: C# ----------
    var treeOut = new DataTree<Point3d>();

    var size = tree.BranchCount;

    for( int i = branchStart + 1; i < branchEnd; ++i )
      for( int j = 0; j < tree.Branch(i).Count; ++j )
      {

        if( randomOrNot == false )
        {

          if( i != 2 && i != 3 )


            treeOut.Add(tree.Branch(i)[j], new GH_Path(i));

        }

        else
        {

          //if( i != 2 && i != 3 && i != 4 && i != 5 )


          treeOut.Add(tree.Branch(i)[j], new GH_Path(i));

        }

      }

    selected = treeOut;
# ---------- end pickarowwithoutloosingbranch_7 ----------
list_item_10 = ListItem(List=pickarowwithoutloosingbranch_5, Index=number_slider_28, Wrap=True)
list_item_11 = ListItem(List=pickarowwithoutloosingbranch_3, Index=Slider(14, range=0..100), Wrap=True)
unit_x_6 = UnitX(Factor=[number_slider_108, number_slider_109, number_slider_104, number_slider_105, number_slider_99, number_slider_100, number_slider_97, number_slider_98, number_slider_112, number_slider_113, number_slider_110, number_slider_111, number_slider_106, number_slider_107, number_slider_101, number_slider_102, number_slider_103, Slider(4.56323, range=-10..10)])
panel_3 = Panel(cull_index_3)
move_9 = Move(Geometry=move_5.Geometry, Motion=expr("-x", unit_x_2))  # -> Geometry, Transform
move_10 = Move(Geometry=move_7.Geometry, Motion=unit_x_3)  # -> Geometry, Transform
move_11 = Move(Geometry=move_6.Geometry, Motion=unit_x)  # -> Geometry, Transform
move_12 = Move(Geometry=move_4.Geometry, Motion=expr("-x", unit_x_4))  # -> Geometry, Transform
move_13 = Move(Geometry=move_3.Geometry, Motion=expr("-x", unit_x_5))  # -> Geometry, Transform

# ---- group: SetUpOurMeshAndTheTranslations (continued)
point = Point(move_13.Geometry)
point_2 = Point(move_12.Geometry)
point_3 = Point(move_9.Geometry)
point_4 = Point(move_11.Geometry)
move_14 = Move(Geometry=move_8.Geometry, Motion=unit_x_6)  # -> Geometry, Transform
point_5 = Point(move_10.Geometry)
point_6 = Point(move_14.Geometry)
sort_points = SortPoints(Points=point)  # -> Points, Indices
sort_points_2 = SortPoints(Points=point_2)  # -> Points, Indices
sort_points_3 = SortPoints(Points=point_3)  # -> Points, Indices
sort_points_4 = SortPoints(Points=point_4)  # -> Points, Indices
sort_points_5 = SortPoints(Points=point_5)  # -> Points, Indices
sort_points_6 = SortPoints(Points=point_6)  # -> Points, Indices
point_list = PointList(Points=sort_points_2.Points)
point_list_2 = PointList(Points=sort_points_3.Points)

# ----
point_list_3 = PointList(Points=move_14.Geometry, Size=Slider(1, range=0..1))
point_list_4 = PointList(Points=sort_points_5.Points, Size=Slider(0.3344, range=0..1))
cull_index_7 = CullIndex(List=sort_points_6.Points, Indices=number_slider_96, Wrap=True)  # -> simplify(List)
path_mapper_7 = PathMapper(cull_index_7, source="{A;B}", target="{B}")

# ---- group: SetUpOurMeshAndTheTranslations (continued)
merge = Merge(
    Data1=path_mapper_7,
    Data2=sort_points_5.Points,
    Data3=sort_points_4.Points,
    Data4=sort_points_3.Points,
    Data5=sort_points_2.Points,
    Data6=sort_points.Points)

# ----
flip_matrix = FlipMatrix(Data=merge)
explode_tree = ExplodeTree(Data=merge)  # -> Branch0, Branch1, Branch2, Branch3, Branch4, Branch5
c_script = CSharpScript(points=flip_matrix)  # -> lines; inputs points: tree of Point3d
# ---------- c_script: C# ----------
    var linesOut = new DataTree<Line>();

    for( int i = 0; i < points.BranchCount; ++i )
      for( int j = 0; j < points.Branch(i).Count; ++j )
      {

        if( i % 2 != 1 )
        {
          linesOut.Add(new Line(points.Branch(0)[0], points.Branch(0)[2]), new GH_Path(i));
          linesOut.Add(new Line(points.Branch(0)[2], points.Branch(0)[3]), new GH_Path(i));
          linesOut.Add(new Line(points.Branch(0)[3], points.Branch(0)[5]), new GH_Path(i));
        }
      }

    var lin = new List<Line>();

    lin.Add(new Line(points.Branch(0)[0], points.Branch(0)[2]));
    lin.Add(new Line(points.Branch(0)[2], points.Branch(0)[3]));
    lin.Add(new Line(points.Branch(0)[3], points.Branch(0)[5]));

    lines = linesOut;
# ---------- end c_script ----------
c_script_2 = CSharpScript(points=merge)  # -> pointTree; inputs points: tree of Point3d
# ---------- c_script_2: C# ----------
    var pointsOut = new DataTree<Point3d>();

    for( int i = 0; i < points.BranchCount; ++i )
      for( int j = 0; j < points.Branch(i).Count; ++j )
      {

        pointsOut.Add(points.Branch(i)[j], new GH_Path(i));

      }

    pointTree = pointsOut;
# ---------- end c_script_2 ----------

# ---- group: Attractors
point_7 = Point(merge)
number_slider_114 = Slider(0.228, range=0..1)
curve = Curve(<curve referenced from the Rhino model>)
point_8 = Point(Point(42.54006911, -14.3092749, 0))
point_9 = Point(<point referenced from the Rhino model>)
spin_force = SpinForce(
    Plane=point_8,
    Strength=expr("-x", Slider(10, range=0..10)),
    Radius=Slider(10, range=0..10),
    Decay=Slider(1.216, range=0..10))
spin_force_2 = SpinForce(
    Plane=point_9,
    Strength=expr("-x", Slider(1.9897, range=0..100)),
    Radius=Slider(10, range=0..10),
    Decay=Slider(0, range=0..10))
merge_fields = MergeFields(Fields=flatten(spin_force_2))
evaluate_field = EvaluateField(Field=merge_fields, Point=point_7)  # -> Tensor, Strength
point_10 = Point([<point referenced from the Rhino model> x2])
random_attraction = RandomAttraction(Grid=point_7, Magnitude=number_slider_114)  # -> simplify(Grid), Weights
curve_attraction = CurveAttraction(Grid=point_7, CrvAtts=curve, Magnitude=number_slider_114)  # -> simplify(Grid), Weights
point_attraction = PointAttraction(Grid=point_7, PtAtts=point_10, Magnitude=Slider(1, range=0..1))  # -> simplify(Grid), Weights
move_15 = Move(Geometry=point_7, Motion=evaluate_field.Tensor)  # -> Geometry, Transform
point_11 = Point(point_7)

# ----
extract_row = ExtractRow(Grid=merge, Row=Slider(1, range=0..100))
extract_row_2 = ExtractRow(Grid=merge, Row=Slider(0, range=0..100))
polyline = PolyLine(Vertices=flip_matrix, Closed=False)
point_12 = Point(flatten([explode_tree.Branch1, explode_tree.Branch2]))
point_13 = Point(flatten([explode_tree.Branch4, explode_tree.Branch3]))
point_14 = Point(explode_tree.Branch0)
point_15 = Point(explode_tree.Branch5)
path_mapper_8 = PathMapper(point_12, source="{A}", target="{1}")
path_mapper_9 = PathMapper(point_13, source="{A}", target="{2}")
path_mapper_10 = PathMapper(point_15, source="{A}", target="{3}")
merge_2 = Merge(Data1=point_14, Data2=path_mapper_8, Data3=path_mapper_9, Data4=path_mapper_10)
sort_points_7 = SortPoints(Points=path_mapper_8)  # -> Points, Indices
sort_points_8 = SortPoints(Points=path_mapper_9)  # -> Points, Indices
polyline_2 = PolyLine(Vertices=sort_points_7.Points, Closed=False)
polyline_3 = PolyLine(Vertices=sort_points_8.Points, Closed=False)
discontinuity = Discontinuity(Curve=polyline_3, Level=1)  # -> Points, Parameters
discontinuity_2 = Discontinuity(Curve=polyline_2, Level=1)  # -> Points, Parameters
sort_points_9 = SortPoints(Points=merge_2)  # -> Points, Indices
point_list_5 = PointList(Points=sort_points_9.Points, Size=Slider(1, range=0..1))

# ---- group: ParametricMagicThanksRelativeItem
boolean_toggle_2 = BooleanToggle(False)
flip_matrix_2 = FlipMatrix(Data=sort_points_9.Points)
relative_item = RelativeItem(Tree=point_11, Offset="{0}[+1]", WrapPaths=boolean_toggle_2, WrapItems=boolean_toggle_2)  # -> ItemA, ItemB
relative_item_2 = RelativeItem(Tree=flip_matrix_2, Offset="{0}[+1]", WrapPaths=boolean_toggle_2, WrapItems=boolean_toggle_2)  # -> ItemA, ItemB
relative_item_3 = RelativeItem(Tree=sort_points_9.Points, Offset="{+1}[+1]", WrapPaths=boolean_toggle_2, WrapItems=boolean_toggle_2)  # -> ItemA, ItemB
relative_item_4 = RelativeItem(Tree=sort_points_9.Points, Offset="{+1}[-1]", WrapPaths=boolean_toggle_2, WrapItems=boolean_toggle_2)  # -> ItemA, ItemB
line = Line(StartPoint=relative_item.ItemA, EndPoint=relative_item.ItemB)
line_2 = Line(StartPoint=relative_item_4.ItemA, EndPoint=relative_item_4.ItemB)
line_3 = Line(StartPoint=relative_item_2.ItemA, EndPoint=relative_item_2.ItemB)
line_4 = Line(StartPoint=relative_item_3.ItemA, EndPoint=relative_item_3.ItemB)
boolean_toggle_3 = BooleanToggle(False)
relative_item_5 = RelativeItem(Tree=line_4, Offset="{+2}[0]", WrapPaths=boolean_toggle_3, WrapItems=boolean_toggle_3)  # -> ItemA, ItemB
relative_item_6 = RelativeItem(Tree=line_2, Offset="{+2}[0]", WrapPaths=boolean_toggle_3, WrapItems=boolean_toggle_3)  # -> ItemA, ItemB
relative_item_7 = RelativeItem(Tree=line_3, Offset="{+2}[0]", WrapPaths=boolean_toggle_3, WrapItems=boolean_toggle_3)  # -> ItemA, ItemB
relative_item_8 = RelativeItem(Tree=line, Offset="{+2}[0]", WrapPaths=boolean_toggle_3, WrapItems=boolean_toggle_3)  # -> ItemA, ItemB
boolean_toggle_4 = BooleanToggle(False)
line_5 = Line(relative_item_6.ItemB)
line_6 = Line(relative_item_6.ItemA)
line_7 = Line(relative_item_5.ItemB)
line_8 = Line(relative_item_5.ItemA)
line_9 = Line(relative_item_7.ItemB)
line_10 = Line(relative_item_7.ItemA)
line_11 = Line(relative_item_8.ItemB)
line_12 = Line(relative_item_8.ItemA)
relative_item_9 = RelativeItem(Tree=line_9, Offset="{+1}[0]", WrapPaths=boolean_toggle_4, WrapItems=boolean_toggle_4)  # -> ItemA, ItemB
relative_item_10 = RelativeItem(Tree=line_11, Offset="{+1}[0]", WrapPaths=boolean_toggle_4, WrapItems=boolean_toggle_4)  # -> ItemA, ItemB
relative_item_11 = RelativeItem(Tree=line_10, Offset="{+1}[0]", WrapPaths=boolean_toggle_4, WrapItems=boolean_toggle_4)  # -> ItemA, ItemB
relative_item_12 = RelativeItem(Tree=line_12, Offset="{+1}[0]", WrapPaths=boolean_toggle_4, WrapItems=boolean_toggle_4)  # -> ItemA, ItemB
relative_item_13 = RelativeItem(Tree=line_8, Offset="{+1}[0]", WrapPaths=boolean_toggle_4, WrapItems=boolean_toggle_4)  # -> ItemA, ItemB
relative_item_14 = RelativeItem(Tree=line_7, Offset="{+1}[0]", WrapPaths=boolean_toggle_4, WrapItems=boolean_toggle_4)  # -> ItemA, ItemB
relative_item_15 = RelativeItem(Tree=line_6, Offset="{+1}[0]", WrapPaths=boolean_toggle_4, WrapItems=boolean_toggle_4)  # -> ItemA, ItemB
relative_item_16 = RelativeItem(Tree=line_5, Offset="{+1}[0]", WrapPaths=boolean_toggle_4, WrapItems=boolean_toggle_4)  # -> ItemA, ItemB
line_13 = Line(relative_item_9.ItemB)
line_14 = Line(relative_item_10.ItemB)
line_15 = Line(relative_item_11.ItemA)
line_16 = Line(relative_item_12.ItemA)
line_17 = Line(relative_item_13.ItemB)
line_18 = Line(relative_item_14.ItemA)
line_19 = Line(relative_item_15.ItemB)
line_20 = Line(relative_item_16.ItemA)
flip_matrix_3 = FlipMatrix(Data=line_13)
flip_matrix_4 = FlipMatrix(Data=line_14)
flip_matrix_5 = FlipMatrix(Data=line_15)
flip_matrix_6 = FlipMatrix(Data=line_16)
cull_pattern = CullPattern(List=line_17, CullPattern=[False, True])
cull_pattern_2 = CullPattern(List=line_18, CullPattern=invert([False, True]))
cull_pattern_3 = CullPattern(List=line_19, CullPattern=invert([False, True]))
cull_pattern_4 = CullPattern(List=line_20, CullPattern=[False, True])
list_item_12 = ListItem(List=flip_matrix_4, Index=Slider(5, range=0..10), Wrap=True)
list_item_13 = ListItem(List=flip_matrix_5, Index=0, Wrap=True)
list_item_14 = ListItem(List=flip_matrix_6, Index=0, Wrap=True)
list_item_15 = ListItem(List=flip_matrix_3, Index=Slider(13, range=0..20), Wrap=True)
flip_matrix_7 = FlipMatrix(Data=cull_pattern)
flip_matrix_8 = FlipMatrix(Data=cull_pattern_2)
flip_matrix_9 = FlipMatrix(Data=cull_pattern_3)
flip_matrix_10 = FlipMatrix(Data=cull_pattern_4)

# ----
flip_matrix_11 = FlipMatrix(Data=line_3)
explode_tree_2 = ExplodeTree(Data=line)  # -> Branch0, Branch1, Branch2, Branch3, Branch4, Branch5
tree_branch = TreeBranch(Tree=flip_matrix_11, Path=construct_path_3, MaintainPaths=True)
tree_branch_2 = TreeBranch(Tree=flip_matrix_11, Path=construct_path, MaintainPaths=True)
tree_branch_3 = TreeBranch(Tree=flip_matrix_11, Path=construct_path_2, MaintainPaths=True)
cull_pattern_5 = CullPattern(List=tree_branch, CullPattern=invert([True, False]))
cull_pattern_6 = CullPattern(List=tree_branch, CullPattern=[True, False])
cull_pattern_7 = CullPattern(List=tree_branch_3, CullPattern=invert([True, False]))
cull_pattern_8 = CullPattern(List=tree_branch_2, CullPattern=invert([True, False]))
cull_pattern_9 = CullPattern(List=tree_branch_2, CullPattern=[True, False])
cull_pattern_10 = CullPattern(List=tree_branch_3, CullPattern=[True, False])
shatter = Shatter(Curve=polyline_2, Parameters=discontinuity_2.Parameters)
shatter_2 = Shatter(Curve=polyline_3, Parameters=discontinuity.Parameters)
line_21 = Line(explode_tree_2.Branch5)
line_22 = Line(explode_tree_2.Branch0)

# ---- group: Borders
flip_matrix_12 = FlipMatrix(Data=point_11)
flip_matrix_13 = FlipMatrix(Data=point_11)
pickarowwithoutloosingbranch_8 = CSharpScript(tree=flip_matrix_12, branch=Slider(0, range=0..100))  # -> selected; inputs tree: tree of Point3d, branch: Int32; same code as pickarowwithoutloosingbranch
pickarowwithoutloosingbranch_9 = CSharpScript(tree=flip_matrix_13, branch=Slider(16, range=0..100))  # -> selected; inputs tree: tree of Point3d, branch: Int32; same code as pickarowwithoutloosingbranch
cull_pattern_11 = CullPattern(List=pickarowwithoutloosingbranch_8, CullPattern=[True, False, True, True, False])
cull_pattern_12 = CullPattern(List=pickarowwithoutloosingbranch_9, CullPattern=[True, False, True, True, False])
join_curves = JoinCurves(Curves=flatten(list_item_13), Preserve=False)
join_curves_2 = JoinCurves(Curves=flatten(list_item_15), Preserve=False)
curve_closest_point = CurveClosestPoint(Point=cull_pattern_11, Curve=join_curves)  # -> Point, Parameter, Distance
curve_closest_point_2 = CurveClosestPoint(Point=cull_pattern_12, Curve=join_curves_2)  # -> Point, Parameter, Distance
shatter_3 = Shatter(Curve=join_curves, Parameters=curve_closest_point.Parameter)
shatter_4 = Shatter(Curve=join_curves_2, Parameters=curve_closest_point_2.Parameter)

# ----
centerlines = CSharpScript(lines=line_3)  # -> linesOut; inputs lines: tree of Line
# ---------- centerlines: C# ----------
    var lineTree = new DataTree<Line>();
    
    for( int i = 0; i < lines.BranchCount; ++i )
      for( int j = 1; j < lines.Branch(i).Count - 1; ++j )
      {
      
        if( i % 2 != 0 )
        lineTree.Add( lines.Branch(i)[j], new GH_Path(i) );
        
      }
    
    linesOut = lineTree;
# ---------- end centerlines ----------
leftintersectionrlines = CSharpScript(lines=line_3)  # -> linesOut; inputs lines: tree of Line
# ---------- leftintersectionrlines: C# ----------
    var lineTree = new DataTree<Line>();

    for( int i = 1; i < lines.BranchCount - 1; ++i )
      for( int j = 3; j < lines.Branch(i).Count; ++j )
      {

        if( i % 2 != 1 )
          lineTree.Add(lines.Branch(i)[j], new GH_Path(i));

      }

    linesOut = lineTree;
# ---------- end leftintersectionrlines ----------
rigthintersectionrlines = CSharpScript(lines=line_3)  # -> linesOut; inputs lines: tree of Line
# ---------- rigthintersectionrlines: C# ----------
    var lineTree = new DataTree<Line>();

    for( int i = 1; i < lines.BranchCount - 1; ++i )
      for( int j = 0; j < lines.Branch(i).Count - 3; ++j )
      {

        if( i % 2 != 1 )
          lineTree.Add(lines.Branch(i)[j], new GH_Path(i));

      }

    linesOut = lineTree;
# ---------- end rigthintersectionrlines ----------
leftintersectionrlines_2 = CSharpScript(lines=line_3)  # -> linesOut; inputs lines: tree of Line
# ---------- leftintersectionrlines_2: C# ----------
    var lineTree = new DataTree<Line>();

    for( int i = 0; i < lines.BranchCount; ++i )
      for( int j = 3; j < lines.Branch(i).Count; ++j )
      {

        if( i % 2 != 1 )
          lineTree.Add(lines.Branch(i)[j], new GH_Path(i));

      }

    linesOut = lineTree;
# ---------- end leftintersectionrlines_2 ----------
rigthintersectionrlines_2 = CSharpScript(lines=line_3)  # -> linesOut; inputs lines: tree of Line
# ---------- rigthintersectionrlines_2: C# ----------
    var lineTree = new DataTree<Line>();

    for( int i = 0; i < lines.BranchCount; ++i )
      for( int j = 0; j < lines.Branch(i).Count - 3; ++j )
      {

        if( i % 2 != 1 )
          lineTree.Add(lines.Branch(i)[j], new GH_Path(i));

      }

    linesOut = lineTree;
# ---------- end rigthintersectionrlines_2 ----------
join_curves_3 = JoinCurves(Curves=rigthintersectionrlines, Preserve=False)
join_curves_4 = JoinCurves(Curves=centerlines, Preserve=False)
join_curves_5 = JoinCurves(Curves=rigthintersectionrlines_2, Preserve=False)
join_curves_6 = JoinCurves(Curves=leftintersectionrlines, Preserve=False)
join_curves_7 = JoinCurves(Curves=leftintersectionrlines_2, Preserve=False)
end_points = EndPoints(Curve=join_curves_3)  # -> Start, End
end_points_2 = EndPoints(Curve=join_curves_4)  # -> Start, End
end_points_3 = EndPoints(Curve=join_curves_5)  # -> Start, End
end_points_4 = EndPoints(Curve=join_curves_6)  # -> Start, End
end_points_5 = EndPoints(Curve=join_curves_7)  # -> Start, End
line_23 = Line(StartPoint=end_points_4.Start, EndPoint=end_points_4.End)  # -> simplify(Line)
line_24 = Line(StartPoint=end_points.Start, EndPoint=end_points.End)  # -> simplify(Line)
line_25 = Line(StartPoint=end_points_2.Start, EndPoint=end_points_2.End)  # -> simplify(Line)
line_26 = Line(StartPoint=end_points_5.Start, EndPoint=end_points_5.End)  # -> simplify(Line)
line_27 = Line(StartPoint=end_points_3.Start, EndPoint=end_points_3.End)  # -> simplify(Line)
topbottomlines = CSharpScript(lines=line_3)  # -> linesOut; inputs lines: tree of Line
# ---------- topbottomlines: C# ----------
    var lineTree = new DataTree<Line>();

    for( int i = 0; i < lines.BranchCount; ++i )
      for( int j = 2; j < lines.Branch(i).Count - 2; ++j )
      {

        if( i % 2 != 1 )
          lineTree.Add(lines.Branch(i)[j], new GH_Path(i));

      }

    linesOut = lineTree;
# ---------- end topbottomlines ----------
rightcenterlines = CSharpScript(lines=line_3)  # -> linesOut; inputs lines: tree of Line
# ---------- rightcenterlines: C# ----------
    var lineTree = new DataTree<Line>();

    for( int i = 0; i < lines.BranchCount; ++i )
      for( int j = 0; j < lines.Branch(i).Count - 4; ++j )
      {

        if( i % 2 != 0 )
          lineTree.Add(lines.Branch(i)[j], new GH_Path(i));

      }

    linesOut = lineTree;
# ---------- end rightcenterlines ----------
leftcenterlines = CSharpScript(lines=line_3)  # -> linesOut; inputs lines: tree of Line
# ---------- leftcenterlines: C# ----------
    var lineTree = new DataTree<Line>();

    for( int i = 0; i < lines.BranchCount; ++i )
      for( int j = 4; j < lines.Branch(i).Count; ++j )
      {

        if( i % 2 != 0 )
          lineTree.Add(lines.Branch(i)[j], new GH_Path(i));

      }

    linesOut = lineTree;
# ---------- end leftcenterlines ----------
list_item_16 = ListItem(List=flip_matrix_7, Index=0, Wrap=True)
list_item_17 = ListItem(List=flip_matrix_8, Index=1, Wrap=True)
list_item_18 = ListItem(List=flip_matrix_9, Index=0, Wrap=True)
list_item_19 = ListItem(List=flip_matrix_10, Index=1, Wrap=True)

pickarowwithoutloosingbranch_10 = CSharpScript(tree=point_11, branch=Slider(0, range=0..100))  # -> selected; inputs tree: tree of Point3d, branch: Int32; same code as pickarowwithoutloosingbranch
weaverbird_s_mesh_from_lines_weave_back = WeaverbirdsMeshFromLinesWeaveBack(Lines=flatten([line_21, line_22, shatter_2, shatter, line_3]), MaximumValence=4)
cull_pattern_13 = CullPattern(List=pickarowwithoutloosingbranch_10, CullPattern=[True, False, True, True, False])
join_curves_8 = JoinCurves(Curves=flatten(list_item_15), Preserve=False)
curve_closest_point_3 = CurveClosestPoint(Point=cull_pattern_13, Curve=join_curves_8)  # -> Point, Parameter, Distance
topbottomlines_2 = CSharpScript(lines=line_3)  # -> linesOut; inputs lines: tree of Line
# ---------- topbottomlines_2: C# ----------
    var lineTree = new DataTree<Line>();

    for( int i = 1; i < lines.BranchCount - 1; ++i )
      for( int j = 2; j < lines.Branch(i).Count - 2; ++j )
      {

        if( i % 2 != 1 )
          lineTree.Add(lines.Branch(i)[j], new GH_Path(i));

      }

    linesOut = lineTree;
# ---------- end topbottomlines_2 ----------
shatter_5 = Shatter(Curve=join_curves_8, Parameters=curve_closest_point_3.Parameter)

# ---- group: MeshConstruction
curve_2 = Curve([list_item_16, list_item_17, list_item_18, list_item_19, leftcenterlines, rightcenterlines, topbottomlines, list_item_12, list_item_14])
curve_3 = Curve([line_25, line_26, line_27])
curve_4 = Curve([curve_3, curve_2])
weaverbird_s_mesh_from_lines_weave_back_2 = WeaverbirdsMeshFromLinesWeaveBack(Lines=flatten(curve_4), MaximumValence=Slider(5, range=0..10))

# ----
curve_5 = Curve([shatter, shatter_2, line_22, line_21, list_item_13, list_item_15, cull_pattern_6, cull_pattern_8, cull_pattern_7])
curve_6 = Curve([cull_pattern_10, cull_pattern_9, cull_pattern_5])

# ---- group: KangarooOne
curve_7 = Curve(curve_6)
curve_8 = Curve(curve_5)
valleys = Curve(flatten(curve_7))
mountains = Curve(flatten(curve_8))
origami = Origami(mesh=weaverbird_s_mesh_from_lines_weave_back, C=valleys, num_4=angle, C_2=mountains, num_2=angle_2, num=folding)  # -> data_2, R
timer = Timer(TimerInterval=20, Target=kangaroophysics)
kangaroophysics = KangarooPhysics(ForceObjects=origami.data_2, Settings=null, Geometry=origami.R, SimulationReset=Toggle(False))  # -> Out, Iterations, ParticlesOut, GeometryOut, KE
mesh = Mesh(kangaroophysics.GeometryOut)

# ---- group: mesh of flat folding pattern
mesh_2 = Mesh(weaverbird_s_mesh_from_lines_weave_back)

# ----
hingepoints = HingePoints(Mesh=mesh_2)  # -> _1, _2, _3, _4
end_points_6 = EndPoints(Curve=join_curves)  # -> Start, End
end_points_7 = EndPoints(Curve=join_curves_2)  # -> Start, End

# ---- group: maintain edge lengths
medges = MeshEdges(Mesh=mesh_2)  # -> NakedEdges, InteriorEdges, NonManifoldEdges
length_line = LengthLine(Line=[medges.NakedEdges, medges.InteriorEdges], Strength=1)

# ---- group: a weak plastic anchor on all points prevents drift
demesh = DeconstructMesh(Mesh=mesh_2)  # -> Vertices, Faces, Colours, Normals
plasticanchor = PlasticAnchor(Point=demesh.Vertices, Limit=0.1, Strength=0.01)

# ---- group: AnchorPointsAlthoughWeDontNeedThemNoMore
join_curves_9 = JoinCurves(Curves=line_26, Preserve=False)
join_curves_10 = JoinCurves(Curves=line_27, Preserve=False)
end_points_8 = EndPoints(Curve=join_curves_9)  # -> Start, End
end_points_9 = EndPoints(Curve=join_curves_10)  # -> Start, End
point_16 = Point(end_points_8.End)
point_17 = Point(end_points_9.Start)

# ---- group: WeShouldntNeedThisOnes
load = Load(ForceVector=Vector(0, 0, 1))
point_18 = Point([point_16, point_17])
move_16 = Move(Geometry=graft(point_18), Motion=Vector(0, 0, 10))  # -> Geometry, Transform
anchor = Anchor(Point=flatten(move_16.Geometry), Strength=1000)

# ----
curve_9 = Curve(curve_5)
curve_10 = Curve(curve_6)
valleys_2 = Curve(flatten(curve_10))
mountains_2 = Curve(flatten(curve_9))
folding_2 = Slider(0.38, range=0..0.99)
rad = Radians(Degrees=Slider(-180, range=-360..360))
rad_2 = Radians(Degrees=Slider(45, range=-360..360))
hingepoints_2 = HingePoints(Mesh=mesh_2)  # -> _1, _2, _3, _4
multiplication = Multiplication(A=angle_2, B=folding_2)
multiplication_2 = Multiplication(A=angle, B=folding_2)
ln = Line(StartPoint=hingepoints._1, EndPoint=hingepoints._2)
show = Show(G=mesh_2)
hinge = Hinge(
    FoldStart=hingepoints._1,
    FoldEnd=hingepoints._2,
    Tip1=hingepoints._3,
    Tip2=hingepoints._4,
    RestAngle=multiplication,
    Strength=0.1)
hinge_2 = Hinge(
    FoldStart=hingepoints._1,
    FoldEnd=hingepoints._2,
    Tip1=hingepoints._3,
    Tip2=hingepoints._4,
    RestAngle=multiplication_2,
    Strength=0.1)
eval = EvaluateCurve(Curve=ln, Parameter=0.5)  # -> graft(Point), Tangent, Angle

# ---- group: Mountain fold lines
crv = Curve(mountains_2)

# ---- group: Valley fold lines
crv_2 = Curve(valleys_2)

# ----
eval_2 = EvaluateCurve(Curve=reparameterize(crv_2), Parameter=0.5)  # -> Point, Tangent, Angle
eval_3 = EvaluateCurve(Curve=reparameterize(crv), Parameter=0.5)  # -> Point, Tangent, Angle
dist = Distance(PointA=eval_2.Point, PointB=eval.Point)
dist_2 = Distance(PointA=eval_3.Point, PointB=eval.Point)
sort = SortList(Keys=dist)  # -> Keys, ValuesA
sort_2 = SortList(Keys=dist_2)  # -> Keys, ValuesA
item = ListItem(List=sort.Keys, Index=0, Wrap=True)
item_2 = ListItem(List=sort_2.Keys, Index=0, Wrap=True)
smaller = SmallerThan(FirstNumber=item, SecondNumber=0.01)  # -> flatten(SmallerThan), OrEqualTo
smaller_2 = SmallerThan(FirstNumber=item_2, SecondNumber=0.01)  # -> flatten(SmallerThan), OrEqualTo
cull = CullPattern(List=hinge_2, CullPattern=smaller.SmallerThan)
cull_2 = CullPattern(List=hinge, CullPattern=smaller_2.SmallerThan)

# ---- group: Output
solver = Solver(GoalObjects=[length_line, cull, cull_2, show, plasticanchor], Reset=reset, Threshold=1e-15, Tolerance=0.01, On=toggle)  # -> I, V, O
onlymeshes = CSharpScript(x=solver.O)  # -> out, A; inputs x: tree
# ---------- onlymeshes: C# ----------
    var meshOut = new List<object>();

    for( int i = 0; i < x.BranchCount; ++i )
      for( int j = 0; j < x.Branch(i).Count; ++j )
      {
  
        if( x.Branch(i)[j] != null )
          
          if( x.Branch(i)[j].GetType() == typeof( Rhino.Geometry.Mesh ) )
        
            meshOut.Add(x.Branch(i)[j]);
  
      }

    A = meshOut;
# ---------- end onlymeshes ----------

# ==== cluster Origami: Fold a flat pattern into 3d origami
mesh = ClusterInput()
mesh_2 = Mesh(mesh)
num = ClusterInput()
num_2 = ClusterInput()
hingepoints = HingePoints(Mesh=mesh_2)  # -> _1, _2, _3, _4
strength = Panel("1")
num_3 = Number(num)
C = ClusterInput()
C_2 = ClusterInput()
num_4 = ClusterInput()
strength_2 = Panel("1")
num_5 = Number(num_2)
num_6 = Number(strength)
eval = EvaluateCurve(Curve=reparameterize(C), Parameter=0.5)  # -> Point, Tangent, Angle
eval_2 = EvaluateCurve(Curve=reparameterize(C_2), Parameter=0.5)  # -> Point, Tangent, Angle
ln = Line(StartPoint=hingepoints._1, EndPoint=hingepoints._2)
num_7 = Number(num_4)
num_8 = Number(strength_2)
tri = Triangulate(Mesh=mesh_2)  # -> Mesh, Count
multiplication = Multiplication(A=num_7, B=num_3)
multiplication_2 = Multiplication(A=num_5, B=num_3)
eval_3 = EvaluateCurve(Curve=reparameterize(ln), Parameter=0.5)  # -> graft(Point), Tangent, Angle
springsfrommesh = SpringsFromMesh(M=tri.Mesh, stiffness=100, B=1)
planarizequads = PlanarizeQuads(M=mesh_2, planarizestrength=1000)
unweld = UnweldMesh(Mesh=mesh_2, Angle=0)
cp = ClosestPoint(Point=eval_3.Point, Cloud=eval_2.Point)  # -> ClosestPoint, CPIndex, Distance
cp_2 = ClosestPoint(Point=eval_3.Point, Cloud=eval.Point)  # -> ClosestPoint, CPIndex, Distance
R = ClusterOutput(unweld)
larger = LargerThan(FirstNumber=0.01, SecondNumber=cp.Distance)  # -> LargerThan, OrEqualTo
larger_2 = LargerThan(FirstNumber=0.01, SecondNumber=cp_2.Distance)  # -> LargerThan, OrEqualTo
cull = CullPattern(List=num_8, CullPattern=larger_2.LargerThan)
cull_2 = CullPattern(List=multiplication, CullPattern=larger_2.LargerThan)
cull_3 = CullPattern(List=num_6, CullPattern=larger.LargerThan)
cull_4 = CullPattern(List=multiplication_2, CullPattern=larger.LargerThan)
addition = Addition(A=cull, B=cull_3)
addition_2 = Addition(A=cull_2, B=cull_4)
addition_3 = Addition(A=0, B=addition)  # -> flatten(Result)
addition_4 = Addition(A=0, B=addition_2)  # -> flatten(Result)
hinge = Hinge(
    Point1=hingepoints._1,
    Point2=hingepoints._2,
    Point3=hingepoints._3,
    Point4=hingepoints._4,
    Strength=addition_3,
    RestAngle=addition_4)
data = Data([springsfrommesh, hinge, planarizequads])
data_2 = ClusterOutput(data)

# ==== cluster PlanarizeQuads: Applies a planarization force to any quads in a mesh
M = ClusterInput()
mcomp = Decompose(Mesh=M)  # -> Vertices, Faces, Colours, Normals
vertices = FaceVertices(Face=mcomp.Faces)  # -> CornerA, CornerB, CornerC, CornerD
planarizestrength = ClusterInput()
item = ListItem(List=mcomp.Vertices, Index=vertices.CornerA, Wrap=False)
item_2 = ListItem(List=mcomp.Vertices, Index=vertices.CornerB, Wrap=False)
item_3 = ListItem(List=mcomp.Vertices, Index=vertices.CornerC, Wrap=False)
item_4 = ListItem(List=mcomp.Vertices, Index=vertices.CornerD, Wrap=False)
planarize = Planarize(Point1=item, Point2=item_2, Point3=item_3, Point4=item_4, PlanarizeStrength=planarizestrength)
equals = Equality(FirstNumber=vertices.CornerC, SecondNumber=vertices.CornerD)  # -> Equality, Inequality
cull = CullPattern(List=planarize, CullPattern=equals.Inequality)
L = ClusterOutput(cull)

# ==== cluster SpringsFromMesh: Turns all edges of a mesh into springs
M = ClusterInput()
medges = MeshEdges(Mesh=M)  # -> NakedEdges, InteriorEdges, NonManifoldEdges
crv = Curve([medges.NakedEdges, medges.InteriorEdges])
B = ClusterInput()
len = Length(Curve=crv)
multiplication = Multiplication(A=len, B=B)
stiffness = ClusterInput()
springs = SpringsFromLine(Connection=crv, Stiffness=stiffness, Damping=10, RestLength=multiplication, UpperCutoff=0, LowerCutoff=0, Plasticity=0)
S = ClusterOutput(springs)
