# Grasshopper definition TachisPavilionThree.gh (Grasshopper 0.9.76)
# plug-ins: Kangaroo Components, PTComponentLibrary, Weaverbird, Kangaroo2 Components

# ---- group: XTranslationControlWatchOutItShouldMatchTheTranslationsThatAreBelowCheckByViewingTheRedWatchOutGroupToTheRight
number_slider = Slider(17, range=0..30)

# ---- group: GridFourOurValleysAndMountains
planar_grid = PlanarGrid(
    BasePoint=Point(0, 0, 0),
    IDir=Vector(1, 0, 0),
    JDir=Vector(0, 1, 0),
    IDistance=Slider(4.3265, range=0..10),
    JDistance=Slider(1.34, range=0..10),
    INumber=4,
    JNumber=number_slider)  # -> simplify(Grid)

# ---- group: MeasureSizeOfGrid
list_item = ListItem(List=flatten(planar_grid), Index=Slider(8, range=0..100), Wrap=True)
list_item_2 = ListItem(List=flatten(planar_grid), Index=Slider(45, range=0..100), Wrap=True)
list_item_3 = ListItem(List=flatten(planar_grid), Index=Slider(0, range=0..100), Wrap=True)
distance = Distance(PointA=list_item_3, PointB=list_item)
distance_2 = Distance(PointA=list_item_3, PointB=list_item_2)
panel = Panel(distance_2)
panel_2 = Panel(distance)

# ----
number_slider_2 = Slider(-2.474, range=-10..10)
number_slider_3 = Slider(0, range=-10..10)
unit_x = UnitX(Factor=Slider(0, range=-10..10))
unit_x_2 = UnitX(Factor=Slider(0, range=-10..10))
unit_x_3 = UnitX(Factor=number_slider_3)
unit_x_4 = UnitX(Factor=number_slider_3)
unit_x_5 = UnitX(Factor=Slider(0, range=-10..10))
unit_x_6 = UnitX(Factor=Slider(0, range=-10..10))
angle = Panel("-pi")
angle_2 = Panel("pi")

# ---- group: SimulationReset
reset = Button()
toggle = BooleanToggle(False)

# ----
folding = Slider(0.684, range=0..0.99)

# ---- group: SetUpOurMeshAndTheTranslations / BranchOne
pickarowwithoutloosingbranch = CSharpScript(tree=planar_grid, branch=Slider(0, range=0..7))  # -> selected; inputs tree: tree of Point3d, branch: Int32
# ---------- pickarowwithoutloosingbranch: C# ----------
    var treeOut = new DataTree<Point3d>();
    
    var size = tree.BranchCount;
    
    for( int i = branch; i < branch + 1; ++i )
      for( int j = 0; j < tree.Branch(i).Count; ++j )
      {
      
        treeOut.Add( tree.Branch(i)[j], new GH_Path( i ) );
      
      }
    
    selected = treeOut;
# ---------- end pickarowwithoutloosingbranch ----------
unit_y = UnitY(Factor=Slider(0, range=0..10))
move = Move(Geometry=pickarowwithoutloosingbranch, Motion=expr("-x", unit_y))  # -> Geometry, Transform
number_slider_4 = Slider(17, range=0..100)
unit_y_2 = UnitY(Factor=[Slider(1.221, range=-10..2), Slider(0.773, range=-10..2), Slider(1.031, range=-10..2), Slider(1.411, range=-10..2), Slider(1.31, range=-10..2), Slider(1.052, range=-10..2), Slider(0.882, range=-10..2), Slider(0.498, range=-10..2), Slider(0.083, range=-10..2), Slider(-0.562, range=-10..2), Slider(-0.439, range=-10..2), Slider(0.363, range=-10..2), Slider(0.239, range=-10..2), Slider(0.501, range=-10..2), Slider(-0.021, range=-10..2), Slider(-0.193, range=-10..2), Slider(-0.195, range=-10..2)])
unit_x_7 = UnitX(Factor=[Slider(-1.36635, range=-10..10), Slider(-0.52343, range=-10..10), Slider(0.89962, range=-10..10), Slider(1.76098, range=-10..10), Slider(3.02363, range=-10..10), Slider(2.89727, range=-10..10), Slider(3.03487, range=-10..10), Slider(3.09961, range=-10..10), Slider(2.98188, range=-10..10), Slider(2.61636, range=-10..10), Slider(2.65737, range=-10..10), Slider(3.41113, range=-10..10), Slider(3.48159, range=-10..10), Slider(5.75899, range=-10..10), Slider(6.84189, range=-10..10), Slider(8.32641, range=-10..10), Slider(5.0311, range=-10..10)])

# ----
move_2 = Move(Geometry=move.Geometry, Motion=unit_x_5)  # -> Geometry, Transform

# ---- group: SetUpOurMeshAndTheTranslations / BranchOne (continued)
list_item_4 = ListItem(
    List=move_2.Geometry,
    Index=[Slider(0, range=0..100), Slider(1, range=0..100), Slider(2, range=0..100), Slider(3, range=0..100), Slider(4, range=0..100), Slider(5, range=0..100), Slider(6, range=0..100), Slider(7, range=0..100), Slider(8, range=0..100), Slider(9, range=0..100), Slider(10, range=0..100), Slider(11, range=0..100), Slider(12, range=0..100), Slider(13, range=0..100), Slider(14, range=0..100), Slider(15, range=0..100), Slider(16, range=0..100)],
    Wrap=True)
move_3 = Move(Geometry=list_item_4, Motion=expr("-x", unit_y_2))  # -> Geometry, Transform
move_4 = Move(Geometry=move_3.Geometry, Motion=unit_x_7)  # -> Geometry, Transform
point = Point(move_4.Geometry)
sort_points = SortPoints(Points=point)  # -> Points, Indices

# ---- group: SetUpOurMeshAndTheTranslations / BranchTwo
pickarowwithoutloosingbranch_2 = CSharpScript(tree=planar_grid, branch=Slider(1, range=0..7))  # -> selected; inputs tree: tree of Point3d, branch: Int32; same code as pickarowwithoutloosingbranch
unit_y_3 = UnitY(Factor=Slider(4.526, range=-10..10))
pickarowwithoutloosingbranch_3 = CSharpScript(tree=planar_grid, branch=Slider(1, range=0..7))  # -> selected; inputs tree: tree of Point3d, branch: Int32; same code as pickarowwithoutloosingbranch
move_5 = Move(Geometry=pickarowwithoutloosingbranch_2, Motion=unit_y_3)  # -> Geometry, Transform
number_slider_5 = Slider(8, range=0..100)
number_slider_6 = Slider(17, range=0..100)
number_slider_7 = Slider(6, range=0..10)
number_slider_8 = Slider(-1.698, range=-5..3)
number_slider_9 = Slider(-2.505, range=-4..4)
number_slider_10 = Slider(-2.382, range=-4..4)
number_slider_11 = Slider(-1.987, range=-5..3)
list_item_5 = ListItem(List=pickarowwithoutloosingbranch_2, Index=number_slider_5, Wrap=True)
unit_y_4 = UnitY(Factor=[Slider(-2.751, range=-5..2), Slider(-0.634, range=-5..2), Slider(-3.535, range=-5..5.001), Slider(-2.41, range=-5..2), Slider(-1.099, range=-5..5.001), Slider(-1.484, range=-5..2), Slider(-2.303, range=-5..2), Slider(-2.909, range=-5..2), Slider(-3.336, range=-5..2)])
unit_y_5 = UnitY(Factor=[Slider(1.364, range=-5..3), Slider(2.793, range=-5..3), Slider(1.074, range=-4..4), Slider(0.475, range=-5..3), Slider(-0.81, range=-5..3), Slider(-0.46, range=-4..4), Slider(-0.083, range=-5..3), Slider(-0.25, range=-5..3)])
number_slider_12 = Slider(-1.698, range=-5..3)
number_slider_13 = Slider(-2.505, range=-4..4)
number_slider_14 = Slider(-2.382, range=-4..4)
number_slider_15 = Slider(-1.987, range=-5..3)
unit_x_8 = UnitX(Factor=[Slider(-1.9137, range=-5..5), Slider(0.9498, range=-5..5), Slider(1.756, range=-5..5), Slider(1.6502, range=-5..5), Slider(2.0008, range=-5..10), Slider(3.1149, range=-5..5), Slider(3.7247, range=-5..5), Slider(5.2703, range=-5..6), Slider(6.9636, range=-5..10)])
unit_x_9 = UnitX(Factor=[Slider(-1.13203, range=-5..5), Slider(2.081, range=-5..5), Slider(1.4, range=-5..5), Slider(1.76564, range=-5..5), Slider(2.676, range=-5..5), Slider(3.924, range=-5..5), Slider(5.325, range=-5..10), Slider(6.409, range=-5..10)])

# ----
move_6 = Move(Geometry=move_5.Geometry, Motion=unit_x_3)  # -> Geometry, Transform
move_7 = Move(Geometry=pickarowwithoutloosingbranch_3, Motion=unit_x_4)  # -> Geometry, Transform

# ---- group: SetUpOurMeshAndTheTranslations / BranchTwo (continued)
list_item_6 = ListItem(
    List=move_6.Geometry,
    Index=[Slider(0, range=0..100), Slider(2, range=0..100), number_slider_5, Slider(4, range=0..10), Slider(10, range=0..10), Slider(6, range=0..10), Slider(12, range=0..100), Slider(14, range=0..100), Slider(16, range=0..100)],
    Wrap=True)
list_item_7 = ListItem(
    List=move_7.Geometry,
    Index=[Slider(1, range=0..50), Slider(3, range=0..100), Slider(5, range=0..100), Slider(7, range=0..50), Slider(9, range=0..100), Slider(11, range=0..100), Slider(13, range=0..50), Slider(15, range=0..100)],
    Wrap=True)
move_8 = Move(Geometry=list_item_6, Motion=unit_y_4)  # -> Geometry, Transform
move_9 = Move(Geometry=list_item_7, Motion=expr("-x", unit_y_5))  # -> Geometry, Transform
move_10 = Move(Geometry=move_9.Geometry, Motion=unit_x_9)  # -> Geometry, Transform
move_11 = Move(Geometry=move_8.Geometry, Motion=unit_x_8)  # -> Geometry, Transform
point_2 = Point(move_11.Geometry)
point_3 = Point(move_10.Geometry)
merge = Merge(Data1=point_3, Data2=point_2)
sort_points_2 = SortPoints(Points=merge)  # -> Points, Indices

# ---- group: SetUpOurMeshAndTheTranslations / BranchThree
pickarowwithoutloosingbranch_4 = CSharpScript(tree=planar_grid, branch=Slider(2, range=0..7))  # -> selected; inputs tree: tree of Point3d, branch: Int32; same code as pickarowwithoutloosingbranch
pickarowwithoutloosingbranch_5 = CSharpScript(tree=planar_grid, branch=Slider(2, range=0..7))  # -> selected; inputs tree: tree of Point3d, branch: Int32; same code as pickarowwithoutloosingbranch
unit_y_6 = UnitY(Factor=Slider(1.199, range=-10..10))
unit_y_7 = UnitY(Factor=Slider(8.586, range=-10..10))
move_12 = Move(Geometry=pickarowwithoutloosingbranch_4, Motion=unit_y_6)  # -> Geometry, Transform
move_13 = Move(Geometry=pickarowwithoutloosingbranch_5, Motion=unit_y_7)  # -> Geometry, Transform
number_slider_16 = Slider(18, range=0..100)
number_slider_17 = Slider(7, range=0..10)
number_slider_18 = Slider(10, range=0..10)
number_slider_19 = Slider(5, range=0..10)
number_slider_20 = Slider(-0.134, range=-4..4)
number_slider_21 = Slider(1.152, range=-4..2)
number_slider_22 = Slider(0.71, range=-4..1)
number_slider_23 = Slider(-0.134, range=-4..4)
number_slider_24 = Slider(-2.161, range=-5..2)
unit_y_8 = UnitY(Factor=[Slider(1, range=-4..1), Slider(-0.288, range=-4..2), Slider(-0.054, range=-4..4), Slider(-0.755, range=-4..2), Slider(-0.704, range=-4..1), Slider(-0.195, range=-4..4), Slider(0.012, range=-4..2), Slider(1.656, range=-4..10)])
unit_y_9 = UnitY(Factor=[Slider(-3.9, range=-5..4), Slider(-3.021, range=-5..2), Slider(-4.843, range=-5..4), Slider(-3.757, range=-5..2), Slider(-3.859, range=-5..4), Slider(-3.604, range=-5..2), Slider(-2.83, range=-5..4), Slider(-0.281, range=-5..2), Slider(-2.161, range=-5..2)])
number_slider_25 = Slider(1.152, range=-4..2)
number_slider_26 = Slider(0.71, range=-4..1)
number_slider_27 = Slider(0.153, range=-4..4)
number_slider_28 = Slider(-0.134, range=-4..4)
number_slider_29 = Slider(-5.997, range=-10..2)
list_item_8 = ListItem(List=move_13.Geometry, Index=Slider(14, range=0..100), Wrap=True)
unit_x_10 = UnitX(Factor=[Slider(1.806, range=-1..5), Slider(2, range=-2..2), Slider(-0.829, range=-1..5), Slider(-1.068, range=-2..2), Slider(-0.846, range=-1..1), Slider(-1.109, range=-5..2), Slider(-1.573, range=-5..1), Slider(-4.852, range=-10..2), Slider(-6.354, range=-10..2)])
unit_x_11 = UnitX(Factor=[Slider(1.723, range=-4..2), Slider(0.686, range=-4..5), Slider(-0.795, range=-4..4), Slider(-0.937, range=-4..2), Slider(-0.793, range=-4..1), Slider(-1.166, range=-4..4), Slider(-3.121, range=-10..2), Slider(-6.404, range=-10..1)])

# ----
move_14 = Move(Geometry=move_12.Geometry, Motion=unit_x)  # -> Geometry, Transform
move_15 = Move(Geometry=move_13.Geometry, Motion=unit_x_2)  # -> Geometry, Transform

# ---- group: SetUpOurMeshAndTheTranslations / BranchThree (continued)
list_item_9 = ListItem(
    List=move_15.Geometry,
    Index=[Slider(1, range=0..100), Slider(7, range=0..100), Slider(3, range=0..10), Slider(9, range=0..10), Slider(5, range=0..10), Slider(11, range=0..15), Slider(13, range=0..100), Slider(15, range=0..16)],
    Wrap=True)
list_item_10 = ListItem(
    List=move_14.Geometry,
    Index=[Slider(0, range=0..100), Slider(6, range=0..100), Slider(2, range=0..10), Slider(8, range=0..10), Slider(4, range=0..10), Slider(10, range=0..10), Slider(12, range=0..100), Slider(14, range=0..14), Slider(16, range=0..16)],
    Wrap=True)
move_16 = Move(Geometry=list_item_9, Motion=expr("-x", unit_y_8))  # -> Geometry, Transform
move_17 = Move(Geometry=list_item_10, Motion=expr("-x", unit_y_9))  # -> Geometry, Transform
move_18 = Move(Geometry=move_17.Geometry, Motion=expr("-x", unit_x_10))  # -> Geometry, Transform
point_4 = Point(move_18.Geometry)
move_19 = Move(Geometry=move_16.Geometry, Motion=expr("-x", unit_x_11))  # -> Geometry, Transform
point_5 = Point(move_19.Geometry)
merge_2 = Merge(Data1=point_4, Data2=point_5)
sort_points_3 = SortPoints(Points=merge_2)  # -> Points, Indices

# ---- group: SetUpOurMeshAndTheTranslations / BranchFour
pickarowwithoutloosingbranch_6 = CSharpScript(tree=planar_grid, branch=Slider(3, range=0..7))  # -> selected; inputs tree: tree of Point3d, branch: Int32; same code as pickarowwithoutloosingbranch
unit_y_10 = UnitY(Factor=Slider(8.57, range=-10..20))
move_20 = Move(Geometry=pickarowwithoutloosingbranch_6, Motion=unit_y_10)  # -> Geometry, Transform
number_slider_30 = Slider(7, range=0..100)
number_slider_31 = Slider(17, range=0..100)
unit_y_11 = UnitY(Factor=[Slider(0.25, range=-2..2), Slider(0.25, range=-5..5), Slider(0.25, range=-5..5), Slider(0.025, range=-5..5), Slider(0.25, range=-5..5), Slider(0.25, range=-5..5), Slider(0.25, range=-5..5), Slider(0.25, range=-5..5), Slider(0.25, range=-5..5), Slider(0.25, range=-5..5), Slider(0.25, range=-5..5), Slider(0.25, range=-5..5), Slider(0.25, range=-5..5), Slider(0.25, range=-5..5), Slider(0.25, range=-5..5), Slider(0.25, range=-5..5), Slider(0.25, range=-5..5)])
unit_x_12 = UnitX(Factor=[Slider(1.68, range=-5..5), Slider(1.859, range=-5..5), Slider(1.866, range=-5..5), Slider(1.885, range=-5..5), Slider(1.81, range=-5..5), Slider(1.228, range=-5..5), Slider(0.34, range=-5..5), Slider(0.997, range=-5..5), Slider(0.136, range=-5..5), Slider(0.131, range=-5..5), Slider(-0.765, range=-5..5), Slider(-0.832, range=-5..5), Slider(-2.378, range=-5..5), Slider(-2.742, range=-8..5), Slider(-4.808, range=-8..5), Slider(-4.816, range=-6..5), Slider(-5.618, range=-6..5)])

# ----
move_21 = Move(Geometry=move_20.Geometry, Motion=unit_x_6)  # -> Geometry, Transform

# ---- group: SetUpOurMeshAndTheTranslations / BranchFour (continued)
list_item_11 = ListItem(
    List=move_21.Geometry,
    Index=[Slider(0, range=0..100), Slider(1, range=0..100), Slider(2, range=0..100), Slider(3, range=0..100), Slider(4, range=0..100), Slider(5, range=0..100), Slider(6, range=0..100), Slider(8, range=0..100), Slider(9, range=0..100), Slider(10, range=0..100), Slider(11, range=0..100), Slider(12, range=0..100), Slider(13, range=0..100), Slider(14, range=0..100), Slider(15, range=0..100), Slider(16, range=0..100)],
    Wrap=True)
move_22 = Move(Geometry=list_item_11, Motion=expr("-x", unit_y_11))  # -> Geometry, Transform
move_23 = Move(Geometry=move_22.Geometry, Motion=expr("-x", unit_x_12))  # -> Geometry, Transform
point_6 = Point(move_23.Geometry)
sort_points_4 = SortPoints(Points=point_6)  # -> Points, Indices

# ---- group: SetUpOurMeshAndTheTranslations
merge_3 = Merge(Data1=sort_points.Points, Data2=sort_points_2.Points, Data3=sort_points_3.Points, Data4=sort_points_4.Points)

# ---- group: Attractors
point_7 = Point(merge_3)
number_slider_32 = Slider(0.228, range=0..1)
curve = Curve(<curve referenced from the Rhino model>)
point_8 = Point(Point(42.54006911, -14.3092749, 0))
point_9 = Point(<point referenced from the Rhino model>)
spin_force = SpinForce(
    Plane=point_8,
    Strength=expr("-x", Slider(10, range=0..10)),
    Radius=Slider(10, range=0..10),
    Decay=Slider(1.216, range=0..10))
spin_force_2 = SpinForce(
    Plane=point_9,
    Strength=expr("-x", Slider(1.9897, range=0..100)),
    Radius=Slider(10, range=0..10),
    Decay=Slider(0, range=0..10))
merge_fields = MergeFields(Fields=flatten(spin_force_2))
evaluate_field = EvaluateField(Field=merge_fields, Point=point_7)  # -> Tensor, Strength
point_10 = Point([<point referenced from the Rhino model> x2])
random_attraction = RandomAttraction(Grid=point_7, Magnitude=number_slider_32)  # -> simplify(Grid), Weights
curve_attraction = CurveAttraction(Grid=point_7, CrvAtts=curve, Magnitude=number_slider_32)  # -> simplify(Grid), Weights
point_attraction = PointAttraction(Grid=point_7, PtAtts=point_10, Magnitude=Slider(1, range=0..1))  # -> simplify(Grid), Weights
move_24 = Move(Geometry=point_7, Motion=evaluate_field.Tensor)  # -> Geometry, Transform
point_11 = Point(point_7)

# ---- group: ParametricMagicThanksRelativeItem
boolean_toggle = BooleanToggle(False)
flip_matrix = FlipMatrix(Data=point_11)
relative_item = RelativeItem(Tree=point_11, Offset="{0}[+1]", WrapPaths=boolean_toggle, WrapItems=boolean_toggle)  # -> ItemA, ItemB
relative_item_2 = RelativeItem(Tree=flip_matrix, Offset="{0}[+1]", WrapPaths=boolean_toggle, WrapItems=boolean_toggle)  # -> ItemA, ItemB
line = Line(StartPoint=relative_item.ItemA, EndPoint=relative_item.ItemB)
line_2 = Line(StartPoint=relative_item_2.ItemA, EndPoint=relative_item_2.ItemB)
flip_matrix_2 = FlipMatrix(Data=line_2)
explode_tree = ExplodeTree(Data=flip_matrix_2)  # -> Branch0, Branch1, Branch2
relative_item_3 = RelativeItem(Tree=line_2, Offset="{+2}[0]", WrapPaths=False, WrapItems=False)  # -> ItemA, ItemB
relative_item_4 = RelativeItem(Tree=line, Offset="{+2}[0]", WrapPaths=False, WrapItems=False)  # -> ItemA, ItemB
cull_pattern = CullPattern(List=explode_tree.Branch0, CullPattern=invert([True, False]))
cull_pattern_2 = CullPattern(List=explode_tree.Branch2, CullPattern=invert([True, False]))
cull_pattern_3 = CullPattern(List=explode_tree.Branch1, CullPattern=invert([True, False]))
cull_pattern_4 = CullPattern(List=explode_tree.Branch1, CullPattern=[True, False])
cull_pattern_5 = CullPattern(List=explode_tree.Branch0, CullPattern=[True, False])
cull_pattern_6 = CullPattern(List=explode_tree.Branch2, CullPattern=[True, False])
line_3 = Line(relative_item_3.ItemB)
line_4 = Line(relative_item_3.ItemA)
curve_2 = Curve([cull_pattern_2, cull_pattern_4, cull_pattern])
line_5 = Line(relative_item_4.ItemB)
line_6 = Line(relative_item_4.ItemA)
panel_3 = Panel("{+1}[0]")
polyline = PolyLine(Vertices=sort_points_2.Points, Closed=False)
polyline_2 = PolyLine(Vertices=sort_points_3.Points, Closed=False)
relative_item_5 = RelativeItem(Tree=line_3, Offset="{+1}[0]", WrapPaths=False, WrapItems=False)  # -> ItemA, ItemB
relative_item_6 = RelativeItem(Tree=line_5, Offset="{+1}[0]", WrapPaths=False, WrapItems=False)  # -> ItemA, ItemB
relative_item_7 = RelativeItem(Tree=line_4, Offset="{+1}[0]", WrapPaths=False, WrapItems=False)  # -> ItemA, ItemB
relative_item_8 = RelativeItem(Tree=line_6, Offset="{+1}[0]", WrapPaths=False, WrapItems=False)  # -> ItemA, ItemB
line_7 = Line(relative_item_5.ItemB)
line_8 = Line(relative_item_6.ItemB)
line_9 = Line(relative_item_7.ItemA)
line_10 = Line(relative_item_8.ItemA)
discontinuity = Discontinuity(Curve=polyline, Level=1)  # -> Points, Parameters
discontinuity_2 = Discontinuity(Curve=polyline_2, Level=1)  # -> Points, Parameters
flip_matrix_3 = FlipMatrix(Data=line_7)
flip_matrix_4 = FlipMatrix(Data=line_8)
flip_matrix_5 = FlipMatrix(Data=line_9)
flip_matrix_6 = FlipMatrix(Data=line_10)
shatter = Shatter(Curve=polyline, Parameters=discontinuity.Parameters)
shatter_2 = Shatter(Curve=polyline_2, Parameters=discontinuity_2.Parameters)
list_item_12 = ListItem(List=flip_matrix_5, Index=0, Wrap=True)
list_item_13 = ListItem(List=flip_matrix_3, Index=Slider(13, range=0..15), Wrap=True)
list_item_14 = ListItem(List=flip_matrix_6, Index=0, Wrap=True)
list_item_15 = ListItem(List=flip_matrix_4, Index=Slider(5, range=0..10), Wrap=True)

# ---- group: Borders
curve_3 = Curve([list_item_12, list_item_13, list_item_14, list_item_15])

# ---- group: MeshConstruction
curve_4 = Curve([curve_3, shatter, shatter_2, line_2])
weaverbird_s_mesh_from_lines_weave_back = WeaverbirdsMeshFromLinesWeaveBack(Lines=flatten(curve_4), MaximumValence=Slider(5, range=0..10))

# ----
curve_5 = Curve([curve_3, shatter, curve_2, shatter_2])
curve_6 = Curve([cull_pattern_5, cull_pattern_3, cull_pattern_6])

# ---- group: KangarooOne
valleys = Curve(flatten(curve_6))
mountains = Curve(flatten(curve_5))
origami = Origami(
    mesh=weaverbird_s_mesh_from_lines_weave_back,
    C=valleys,
    num_4=angle,
    C_2=mountains,
    num_2=angle_2,
    num=expr("-x", folding))  # -> data_2, R
timer = Timer(TimerInterval=20, Target=kangaroophysics)
kangaroophysics = KangarooPhysics(ForceObjects=origami.data_2, Settings=null, Geometry=origami.R, SimulationReset=Toggle(False))  # -> Out, Iterations, ParticlesOut, GeometryOut, KE
mesh = Mesh(kangaroophysics.GeometryOut)

# ---- group: mesh of flat folding pattern
mesh_2 = Mesh(weaverbird_s_mesh_from_lines_weave_back)

# ----
hingepoints = HingePoints(Mesh=mesh_2)  # -> _1, _2, _3, _4

# ---- group: maintain edge lengths
medges = MeshEdges(Mesh=mesh_2)  # -> NakedEdges, InteriorEdges, NonManifoldEdges
length_line = LengthLine(Line=[medges.NakedEdges, medges.InteriorEdges], Strength=1)

# ---- group: a weak plastic anchor on all points prevents drift
demesh = DeconstructMesh(Mesh=mesh_2)  # -> Vertices, Faces, Colours, Normals
plasticanchor = PlasticAnchor(Point=demesh.Vertices, Limit=0.1, Strength=0.01)

# ---- group: AnchorPointsAlthoughWeDontNeedThemNoMore
join_curves = JoinCurves(Curves=flatten(list_item_12), Preserve=False)
join_curves_2 = JoinCurves(Curves=flatten(list_item_13), Preserve=False)
end_points = EndPoints(Curve=join_curves)  # -> Start, End
end_points_2 = EndPoints(Curve=join_curves_2)  # -> Start, End
point_12 = Point([end_points.End, end_points.Start])
point_13 = Point([end_points_2.Start, end_points_2.End])

# ---- group: WeShouldntNeedThisOnes
load = Load(ForceVector=Vector(0, 0, 1))
point_14 = Point([point_12, point_13])
move_25 = Move(Geometry=graft(point_14), Motion=Vector(0, 0, 10))  # -> Geometry, Transform
anchor = Anchor(Point=flatten(move_25.Geometry), Strength=1000)

# ----
curve_7 = Curve(curve_5)
curve_8 = Curve(curve_6)
valleys_2 = Curve(flatten(curve_8))
mountains_2 = Curve(flatten(curve_7))
folding_2 = Slider(0, range=0..0.99)
rad = Radians(Degrees=Slider(-180, range=-360..360))
rad_2 = Radians(Degrees=Slider(45, range=-360..360))
hingepoints_2 = HingePoints(Mesh=mesh_2)  # -> _1, _2, _3, _4
multiplication = Multiplication(A=angle_2, B=folding_2)
multiplication_2 = Multiplication(A=angle, B=folding_2)
ln = Line(StartPoint=hingepoints._1, EndPoint=hingepoints._2)
show = Show(G=mesh_2)
hinge = Hinge(
    FoldStart=hingepoints._1,
    FoldEnd=hingepoints._2,
    Tip1=hingepoints._3,
    Tip2=hingepoints._4,
    RestAngle=multiplication,
    Strength=0.1)
hinge_2 = Hinge(
    FoldStart=hingepoints._1,
    FoldEnd=hingepoints._2,
    Tip1=hingepoints._3,
    Tip2=hingepoints._4,
    RestAngle=multiplication_2,
    Strength=0.1)
eval = EvaluateCurve(Curve=ln, Parameter=0.5)  # -> graft(Point), Tangent, Angle

# ---- group: Mountain fold lines
crv = Curve(mountains_2)

# ---- group: Valley fold lines
crv_2 = Curve(valleys_2)

# ----
eval_2 = EvaluateCurve(Curve=reparameterize(crv_2), Parameter=0.5)  # -> Point, Tangent, Angle
eval_3 = EvaluateCurve(Curve=reparameterize(crv), Parameter=0.5)  # -> Point, Tangent, Angle
dist = Distance(PointA=eval_2.Point, PointB=eval.Point)
dist_2 = Distance(PointA=eval_3.Point, PointB=eval.Point)
sort = SortList(Keys=dist)  # -> Keys, ValuesA
sort_2 = SortList(Keys=dist_2)  # -> Keys, ValuesA
item = ListItem(List=sort.Keys, Index=0, Wrap=True)
item_2 = ListItem(List=sort_2.Keys, Index=0, Wrap=True)
smaller = SmallerThan(FirstNumber=item, SecondNumber=0.01)  # -> flatten(SmallerThan), OrEqualTo
smaller_2 = SmallerThan(FirstNumber=item_2, SecondNumber=0.01)  # -> flatten(SmallerThan), OrEqualTo
cull = CullPattern(List=hinge_2, CullPattern=smaller.SmallerThan)
cull_2 = CullPattern(List=hinge, CullPattern=smaller_2.SmallerThan)

# ---- group: Output
solver = Solver(GoalObjects=[length_line, plasticanchor, cull, show, cull_2], Reset=reset, Threshold=1e-15, Tolerance=0.01, On=toggle)  # -> I, V, O
onlymeshes = CSharpScript(x=solver.O)  # -> out, A; inputs x: tree
# ---------- onlymeshes: C# ----------
    var meshOut = new List<object>();

    for( int i = 0; i < x.BranchCount; ++i )
      for( int j = 0; j < x.Branch(i).Count; ++j )
      {
  
        if( x.Branch(i)[j] != null )
          
          if( x.Branch(i)[j].GetType() == typeof( Rhino.Geometry.Mesh ) )
        
            meshOut.Add(x.Branch(i)[j]);
  
      }

    A = meshOut;
# ---------- end onlymeshes ----------

# ==== cluster Origami: Fold a flat pattern into 3d origami
mesh = ClusterInput()
mesh_2 = Mesh(mesh)
num = ClusterInput()
num_2 = ClusterInput()
hingepoints = HingePoints(Mesh=mesh_2)  # -> _1, _2, _3, _4
strength = Panel("1")
num_3 = Number(num)
C = ClusterInput()
C_2 = ClusterInput()
num_4 = ClusterInput()
strength_2 = Panel("1")
num_5 = Number(num_2)
num_6 = Number(strength)
eval = EvaluateCurve(Curve=reparameterize(C), Parameter=0.5)  # -> Point, Tangent, Angle
eval_2 = EvaluateCurve(Curve=reparameterize(C_2), Parameter=0.5)  # -> Point, Tangent, Angle
ln = Line(StartPoint=hingepoints._1, EndPoint=hingepoints._2)
num_7 = Number(num_4)
num_8 = Number(strength_2)
tri = Triangulate(Mesh=mesh_2)  # -> Mesh, Count
multiplication = Multiplication(A=num_7, B=num_3)
multiplication_2 = Multiplication(A=num_5, B=num_3)
eval_3 = EvaluateCurve(Curve=reparameterize(ln), Parameter=0.5)  # -> graft(Point), Tangent, Angle
springsfrommesh = SpringsFromMesh(M=tri.Mesh, stiffness=100, B=1)
planarizequads = PlanarizeQuads(M=mesh_2, planarizestrength=1000)
unweld = UnweldMesh(Mesh=mesh_2, Angle=0)
cp = ClosestPoint(Point=eval_3.Point, Cloud=eval_2.Point)  # -> ClosestPoint, CPIndex, Distance
cp_2 = ClosestPoint(Point=eval_3.Point, Cloud=eval.Point)  # -> ClosestPoint, CPIndex, Distance
R = ClusterOutput(unweld)
larger = LargerThan(FirstNumber=0.01, SecondNumber=cp.Distance)  # -> LargerThan, OrEqualTo
larger_2 = LargerThan(FirstNumber=0.01, SecondNumber=cp_2.Distance)  # -> LargerThan, OrEqualTo
cull = CullPattern(List=num_8, CullPattern=larger_2.LargerThan)
cull_2 = CullPattern(List=multiplication, CullPattern=larger_2.LargerThan)
cull_3 = CullPattern(List=num_6, CullPattern=larger.LargerThan)
cull_4 = CullPattern(List=multiplication_2, CullPattern=larger.LargerThan)
addition = Addition(A=cull, B=cull_3)
addition_2 = Addition(A=cull_2, B=cull_4)
addition_3 = Addition(A=0, B=addition)  # -> flatten(Result)
addition_4 = Addition(A=0, B=addition_2)  # -> flatten(Result)
hinge = Hinge(
    Point1=hingepoints._1,
    Point2=hingepoints._2,
    Point3=hingepoints._3,
    Point4=hingepoints._4,
    Strength=addition_3,
    RestAngle=addition_4)
data = Data([springsfrommesh, hinge, planarizequads])
data_2 = ClusterOutput(data)

# ==== cluster PlanarizeQuads: Applies a planarization force to any quads in a mesh
M = ClusterInput()
mcomp = Decompose(Mesh=M)  # -> Vertices, Faces, Colours, Normals
vertices = FaceVertices(Face=mcomp.Faces)  # -> CornerA, CornerB, CornerC, CornerD
planarizestrength = ClusterInput()
item = ListItem(List=mcomp.Vertices, Index=vertices.CornerA, Wrap=False)
item_2 = ListItem(List=mcomp.Vertices, Index=vertices.CornerB, Wrap=False)
item_3 = ListItem(List=mcomp.Vertices, Index=vertices.CornerC, Wrap=False)
item_4 = ListItem(List=mcomp.Vertices, Index=vertices.CornerD, Wrap=False)
planarize = Planarize(Point1=item, Point2=item_2, Point3=item_3, Point4=item_4, PlanarizeStrength=planarizestrength)
equals = Equality(FirstNumber=vertices.CornerC, SecondNumber=vertices.CornerD)  # -> Equality, Inequality
cull = CullPattern(List=planarize, CullPattern=equals.Inequality)
L = ClusterOutput(cull)

# ==== cluster SpringsFromMesh: Turns all edges of a mesh into springs
M = ClusterInput()
medges = MeshEdges(Mesh=M)  # -> NakedEdges, InteriorEdges, NonManifoldEdges
crv = Curve([medges.NakedEdges, medges.InteriorEdges])
B = ClusterInput()
len = Length(Curve=crv)
multiplication = Multiplication(A=len, B=B)
stiffness = ClusterInput()
springs = SpringsFromLine(Connection=crv, Stiffness=stiffness, Damping=10, RestLength=multiplication, UpperCutoff=0, LowerCutoff=0, Plasticity=0)
S = ClusterOutput(springs)
